# Dynamo graph elevacionColumNum_script.dyn (Dynamo 2.3.2.15696)
# packages: Clockwork for Dynamo 2.x 2.4.0, Orchid 200.4.0.7938, Data-Shapes 2021.2.94, Crumple 2022.2.13, BIM4Struc.Productivity 2.2.2, Genius Loci 2020.8.3, archi-lab.net 2022.210.2419, Genius Loci 2021.11.10, Rhythm 2020.7.25

code_block = CodeBlock { "Elevación Columna Numerada"; }
code_block_2 = CodeBlock()
# ---------- code_block_2.designscript (10 lines) ----------
//buttonText
"INICIAR";
//buttonCancel
"CANCELAR";
//maxHeight

//width
440;
//label
180;
# ----------------------------------------
code_block_3 = CodeBlock { "Seleccionar una Columna Numerada:"; }
code_block_4 = CodeBlock { "SELECCIONAR"; }
code_block_5 = CodeBlock { "Structural Columns"; }
byName = Category.ByName(name=code_block_5)
selectmodelelements_data_ordered = Custom[SelectModelElements Data (ordered)](InputName=code_block_3, ButtonText=code_block_4, CategoryFilter=byName)  # package Data-Shapes; Creates a Revit element selection input for UI.MultipleInputForm++ . Check out www.data-shapes.net for more infos!
code_block_6 = CodeBlock { "Orientación Seccion:"; }
code_block_7 = CodeBlock { ["Horizontal","Vertical"]; [0,1]; }
code_block_8 = CodeBlock { 0; }
radiobuttons_data = Custom[RadioButtons Data](InputName=code_block_6, Keys=code_block_7.out0, Values=code_block_7.out1, DefaultValueIndex=code_block_8)  # package Data-Shapes; Create radio buttons input for UI.MultipleInputForm ++ .
code_block_9 = CodeBlock { "Escala:"; }
code_block_10 = CodeBlock()
# ---------- code_block_10.designscript (6 lines) ----------
[
"1:50",
"1:75",
"1:100",
"1:125"
];
# ----------------------------------------
code_block_11 = CodeBlock { ":"; }
split = String.Split(str=code_block_10, separator0=code_block_11)
code_block_12 = CodeBlock { 1; }
getItemAtIndex = List.GetItemAtIndex(list=split@L2, index=code_block_12)
toNumber = String.ToNumber(str=getItemAtIndex)
code_block_13 = CodeBlock { 0; false; }
dropdown_data = Custom[DropDown Data](InputName=code_block_9, Keys=code_block_10, Values=toNumber, DefaultValueIndex=code_block_13.out0, Sorted_optional=code_block_13.out1)  # package Data-Shapes; Create data for DropDown input in UI.MultiInputForm ++ . Check out www.data-shapes.net for more infos.
list_create = List.Create(item0=selectmodelelements_data_ordered, item1=radiobuttons_data, item2=dropdown_data)
inputgroup_data = Custom[InputGroup Data](Inputs=list_create)  # package Data-Shapes; Creates a group of inputs for UI.MultipleInputForm ++ . Check out www.data-shapes.net for more infos !
boolean = BoolSelector(true)
multipleinputform = Custom[MultipleInputForm ++](Description_optional=code_block, ButtonText_optional=code_block_2.out0, Inputs=inputgroup_data, Toggle=boolean, CancelButtonText_optional=code_block_2.out1, Width_optional=code_block_2.out2, LabelWidth_optional=code_block_2.out3)  # package Data-Shapes; Create a form with multiple inputs. see www.data-shapes.net for tutorials and infos!
code_block_14 = CodeBlock(x=multipleinputform.User_Inputs)
# ---------- code_block_14.designscript (13 lines) ----------
x;

[Imperative]
{
	if(x == null)
	{
		return = [[],[],[]];
	}
	else
	{
		return = x;
	}
};
# ----------------------------------------
code_block_15 = CodeBlock(x=code_block_14.out1) { x[0]; }
code_block_16 = CodeBlock { "Numeracion Columna"; }
getParameterValueByName = Element.GetParameterValueByName(element=code_block_15, parameterName=code_block_16)
code_block_17 = CodeBlock { ""; }
eq = getParameterValueByName == code_block_17
anyTrue = Orchid.Common.List.AnyTrue(list=eq)
code_block_18 = CodeBlock(x=anyTrue, y=code_block_14.out1)
# ---------- code_block_18.designscript (14 lines) ----------
x;
y;

[Imperative]
{
	if(x == true)
	{
		return = null;
	}
	else
	{
		return = y;
	}
};
# ----------------------------------------
code_block_19 = CodeBlock(x=code_block_18.out2)  # same code as code_block_14
code_block_20 = CodeBlock(x=code_block_19.out1) { x[0]; }
code_block_21 = CodeBlock { "Column Style"; 1; }
setParameterByName = Element.SetParameterByName(element=code_block_20, parameterName=code_block_21.out0, value=code_block_21.out1)
geometry = Element.Geometry(element=setParameterByName)
flatten = List.Flatten(list=geometry)
location = Custom[Element.Location+](element=setParameterByName)  # package Clockwork for Dynamo 2.x; Returns the location of an element as point, curve or curve loop, along with some booleans to help filtering the results. Unlike the OOTB Element.GetLocation node, it also retunrs sketch lines of sketch-based elements like floor slabs as well as the element's rotation property.
code_block_22 = CodeBlock(x=location.curves)
# ---------- code_block_22.designscript (12 lines) ----------
x;
[Imperative]
{
	if(x == null)
	{
		return = [];
	}
	else
	{
		return = x;
	}
};
# ----------------------------------------
code_block_23 = CodeBlock { 0.5; }
pointAtParameter = Curve.PointAtParameter(curve=code_block_22.out1, param=code_block_23)
activeView = Orchid.RevitProject.Common.Document.ActiveView()
plane = Custom[View.Plane](view=activeView)  # package Clockwork for Dynamo 2.x; Retrieves the plane of a given view
normal = Plane.Normal(plane=plane)
byOriginNormal = Plane.ByOriginNormal(origin=pointAtParameter, normal=normal)
intersect = Geometry.Intersect(geometry=flatten, other=byOriginNormal)
await_ = Orchid.Common.DataStream.Await(pass=setParameterByName, waitFor=intersect)
code_block_24 = CodeBlock { "Column Style"; 0; }
setParameterByName_2 = Element.SetParameterByName(element=await_, parameterName=code_block_24.out0, value=code_block_24.out1)
code_block_25 = CodeBlock { "Error."; }
code_block_26 = CodeBlock(x=code_block_18.out2)
# ---------- code_block_26.designscript (12 lines) ----------
x;
[Imperative]
{
	if (x == null)
	{
		return = "La Columna seleccionada no tienen Numeración.\nLa Columna seleccionada debe haber sido numerada antes de ser elevada.";
	}
	else
	{
		return = [];
	}
};
# ----------------------------------------
uimessenger = Custom[© UIMessenger](title=code_block_25, body=code_block_26.out1)  # package Crumple; Displays a message box with a title/body and OK/cancel button. If OK is selected, the third input's data will be passed through.
all = Orchid.RevitProject.Views.View.All()
code_block_27 = CodeBlock { "Subclasificacion"; }
getParameterValueByName_2 = Element.GetParameterValueByName(element=all, parameterName=code_block_27)
code_block_28 = CodeBlock { "04_CH"; }
eq_2 = getParameterValueByName_2 == code_block_28
filterByBoolMask = List.FilterByBoolMask(list=all, mask=eq_2)
viewType = archilab.Revit.Views.Views.ViewType(view=filterByBoolMask.in)
code_block_29 = CodeBlock { "CeilingPlan"; }
eq_3 = viewType == code_block_29
filterByBoolMask_2 = List.FilterByBoolMask(list=filterByBoolMask.in, mask=eq_3)
code_block_30 = CodeBlock { "Structural Columns"; }
byName_2 = Category.ByName(name=code_block_30)
all_elements_of_category = ElementsOfCategory(Category=byName_2)
code_block_31 = CodeBlock { "Numeracion Columna"; }
exists = Orchid.RevitProject.Parameters.Parameter.Exists(parameterName=code_block_31, element=all_elements_of_category)
filterByBoolMask_3 = List.FilterByBoolMask(list=all_elements_of_category, mask=exists)
code_block_32 = CodeBlock { "Numeracion Columna"; }
getParameterValueByName_3 = Element.GetParameterValueByName(element=filterByBoolMask_3.in, parameterName=code_block_32)
code_block_33 = CodeBlock(x=code_block_19.out1) { x[0]; }
code_block_34 = CodeBlock { "Numeracion Columna"; }
getParameterValueByName_4 = Element.GetParameterValueByName(element=code_block_33, parameterName=code_block_34)
code_block_35 = CodeBlock { null; }
replaceEmptyLists = Custom[List.ReplaceEmptyLists](seq=getParameterValueByName_4, Replacement=code_block_35)  # package Clockwork for Dynamo 2.x; Replaces all empty lists within a given list with a substitute
eq_4 = getParameterValueByName_3@L1 == replaceEmptyLists@L2  # lacing=Longest
anyTrue_2 = Orchid.Common.List.AnyTrue(list=eq_4@L2)
filterByBoolMask_4 = List.FilterByBoolMask(list=filterByBoolMask_3.in, mask=anyTrue_2)
code_block_36 = CodeBlock { null; }
replaceEmptyLists_2 = Custom[List.ReplaceEmptyLists](seq=filterByBoolMask_4.in, Replacement=code_block_36)
fillpatterns = Custom[© FillPatterns]()  # package Crumple; Returns all fill patterns in a document.
code_block_37 = CodeBlock { "<Solid fill>"; }
eq_5 = fillpatterns.names == code_block_37
filterByBoolMask_5 = List.FilterByBoolMask(list=fillpatterns.elements, mask=eq_5)
firstItem = List.FirstItem(list=filterByBoolMask_5.in)
color_palette = ColorPalette({R: 46, G: 139, B: 87, A: 255})
create_overridegraphicsettings = Custom[Create OverrideGraphicSettings](SurfaceForegroundPattern=firstItem, SurfaceForegroundPatternColor=color_palette, SurfaceBackgroundPattern=firstItem, SurfaceBackgroundColor=color_palette, CutForegroundPattern=firstItem, CutForegroundPatternColor=color_palette, CutBackgroundPattern=firstItem, CutBackgroundPatternColor=color_palette)  # package Genius Loci; Create a OverrideGraphicSettings (All graphic inputs are optional). Unlike the OOTB OverrideGraphicSettings.ByProperties node, the Foreground and background patterns are available. Note : Prior to Revit 2019, the materials have only one surface pattern and one cut pattern.
view_setelementoverrides = Custom[View SetElementOverrides](view=filterByBoolMask_2.in@L1, elements=replaceEmptyLists_2@L2, overrides=create_overridegraphicsettings@L1, lacing=Longest)  # package Genius Loci; Overrides element graphics settings in the given view. For use with the Create OverrideGraphicSettings node. Can also be used to hide or unhide elements.
code_block_38 = CodeBlock { 0; }
code_block_39 = CodeBlock(x=code_block_19.out1) { x[1]; }
eq_6 = code_block_38 == code_block_39
byBestFitThroughPoints = Line.ByBestFitThroughPoints()  # unwired: bestFitPoints
byJoinedCurves = PolyCurve.ByJoinedCurves()  # unwired: curves
flatten_2 = List.Flatten(list=intersect)
perimeterCurves = Surface.PerimeterCurves(surface=flatten_2)
flatten_3 = List.Flatten(list=perimeterCurves)
function_apply = ApplyFunction(func=byJoinedCurves, arg1=flatten_3)
code_block_40 = CodeBlock(x=function_apply)  # same code as code_block_22
code_block_41 = CodeBlock { 1750; false; }
offset = PolyCurve.Offset(polyCurve=code_block_40.out1, signedDistance=code_block_41.out0, extendCircular=code_block_41.out1)
byPatch = Surface.ByPatch(closedCurve=offset)
code_block_42 = CodeBlock { [0,1]; [0.5,0.5]; }
pointAtParameter_2 = Surface.PointAtParameter(surface=byPatch, u=code_block_42.out0, v=code_block_42.out1, lacing=Longest)
flatten_4 = List.Flatten(list=pointAtParameter_2)
function_apply_2 = ApplyFunction(func=byBestFitThroughPoints, arg1=flatten_4)
byBestFitThroughPoints_2 = Line.ByBestFitThroughPoints()  # unwired: bestFitPoints
code_block_43 = CodeBlock { [0.5,0.5]; [0,1]; }
pointAtParameter_3 = Surface.PointAtParameter(surface=byPatch, u=code_block_43.out0, v=code_block_43.out1, lacing=Longest)
flatten_5 = List.Flatten(list=pointAtParameter_3)
function_apply_3 = ApplyFunction(func=byBestFitThroughPoints_2, arg1=flatten_5)
scopeIf = Custom[ScopeIf+](test=eq_6, True=function_apply_2, False=function_apply_3)  # package Clockwork for Dynamo 2.x; A (hopefully) more robust implementation of ScopeIf. Tests a single boolean and returns a value accordingly.
code_block_44 = CodeBlock(x=byOriginNormal) { x; }
rotationAngle = Custom[Element.RotationAngle](element=code_block_20)  # package BIM4Struc.Productivity; Get the rotation element of a Revit element. The rotation angle is based on the Location.Rotation property in the RevitAPI. If Location is not equal to a LocationPoint (ie. in case of slanted columns) then the Angle will be set to null.
flatten_6 = List.Flatten(list=rotationAngle)
rotate = Geometry.Rotate(geometry=scopeIf, basePlane=code_block_44, degrees=flatten_6)
code_block_45 = CodeBlock(x=rotate) { x; }
direction = Line.Direction(line=code_block_45)
code_block_46 = CodeBlock(x=direction) { x.X; }
code_block_47 = CodeBlock { 0; }
ge = code_block_46 >= code_block_47
reverse = Curve.Reverse(curve=code_block_45)
scopeIf_2 = Custom[ScopeIf+](test=ge, True=reverse, False=code_block_45, lacing=Shortest)
direction_2 = Line.Direction(line=scopeIf_2)
normalized = Vector.Normalized(vector=direction_2)
code_block_48 = CodeBlock(x=normalized) { x.X; }
code_block_49 = CodeBlock { 0; }
eq_7 = code_block_48 == code_block_49
code_block_50 = CodeBlock(x=normalized) { x.Y; }
code_block_51 = CodeBlock { 0; }
gt = code_block_50 > code_block_51
and_ = eq_7 && gt
reverse_2 = Curve.Reverse(curve=scopeIf_2)
scopeIf_3 = Custom[ScopeIf+](test=and_, True=reverse_2, False=scopeIf_2, lacing=Shortest)
code_block_52 = CodeBlock { "Levels"; }
byName_3 = Category.ByName(name=code_block_52)
all_elements_of_category_2 = ElementsOfCategory(Category=byName_3)
elevation = Level.Elevation(level=all_elements_of_category_2)
minimumItem = List.MinimumItem(list=elevation)
eq_8 = elevation == minimumItem
filterByBoolMask_6 = List.FilterByBoolMask(list=all_elements_of_category_2, mask=eq_8)
plane_2 = Custom[Level.Plane](level=filterByBoolMask_6.in)  # package Clockwork for Dynamo 2.x; Retrieves the plane of a given level
pullOntoPlane = Curve.PullOntoPlane(curve=scopeIf_3, plane=plane_2)
ZAxis = Vector.ZAxis()
code_block_53 = CodeBlock { -3000; }
translate = Geometry.Translate(geometry=pullOntoPlane, direction=ZAxis, distance=code_block_53, lacing=Longest)
code_block_54 = CodeBlock { "Building Section (04_CH)"; }
byName_4 = Orchid.RevitProject.Views.ViewType.ByName(name=code_block_54)
code_block_55 = CodeBlock { 0.5; }
pointAtParameter_4 = Curve.PointAtParameter(curve=translate, param=code_block_55)
code_block_56 = CodeBlock { "Levels"; }
byName_5 = Category.ByName(name=code_block_56)
all_elements_of_category_3 = ElementsOfCategory(Category=byName_5)
elevation_2 = Level.Elevation(level=all_elements_of_category_3)
maximumItem = List.MaximumItem(list=elevation_2)
eq_9 = elevation_2 == maximumItem
filterByBoolMask_7 = List.FilterByBoolMask(list=all_elements_of_category_3, mask=eq_9)
plane_3 = Custom[Level.Plane](level=filterByBoolMask_7.in)
pullOntoPlane_2 = Curve.PullOntoPlane(curve=scopeIf_3, plane=plane_3)
ZAxis_2 = Vector.ZAxis()
code_block_57 = CodeBlock { 3000; }
translate_2 = Geometry.Translate(geometry=pullOntoPlane_2, direction=ZAxis_2, distance=code_block_57, lacing=Longest)
code_block_58 = CodeBlock { 0.5; }
pointAtParameter_5 = Curve.PointAtParameter(curve=translate_2, param=code_block_58)
distanceTo = Geometry.DistanceTo(geometry=pointAtParameter_4, other=pointAtParameter_5)
code_block_59 = CodeBlock { null; }
replaceEmptyLists_3 = Custom[List.ReplaceEmptyLists](seq=distanceTo, Replacement=code_block_59)
code_block_60 = CodeBlock(x=replaceEmptyLists_3)
# ---------- code_block_60.designscript (12 lines) ----------
x;
[Imperative]
{
	if(x == null)
	{
		return = [[]];
	}
	else
	{
		return = x;
	}
};
# ----------------------------------------
code_block_61 = CodeBlock(h=code_block_60.out1)
# ---------- code_block_61.designscript (6 lines) ----------
//height
h[0];
//offset
300;
//depth
300;
# ----------------------------------------
byLine = Custom[ViewSection.ByLine](Curves=translate, ViewFamilyType=byName_4, ViewSectionHeight=code_block_61.out0, OffsetFromLine=code_block_61.out1, Depth=code_block_61.out2)  # package Data-Shapes; Create ViewSections in current document from DS Lines.
code_block_62 = CodeBlock(x=code_block_19.out1) { x[2]; }
setScale = View.SetScale(view=byLine, scale=code_block_62)
code_block_63 = CodeBlock()
# ---------- code_block_63.designscript (4 lines) ----------
[
"View Name",
"Title on Sheet"
];
# ----------------------------------------
code_block_64 = CodeBlock(x=code_block_19.out1) { x[0]; }
code_block_65 = CodeBlock { "Numeracion Columna"; }
getParameterValueByName_5 = Element.GetParameterValueByName(element=code_block_64, parameterName=code_block_65)
code_block_66 = CodeBlock(num=getParameterValueByName_5) { DSCore.List.Flatten(["CH_COLUMNA P"+num,"ELEV. PILAR P"+num],1); }
setParameterByName_3 = Element.SetParameterByName(element=setScale@L1, parameterName=code_block_63@L2, value=code_block_66@L2, lacing=Longest)
flatten_7 = List.Flatten(list=setParameterByName_3)
uniqueItems = List.UniqueItems(list=flatten_7)
all_elements_in_view_s = Custom[All Elements In View(s)](Views=uniqueItems)  # package Data-Shapes; Retrieves all visible element in a view or a set of views
code_block_67 = CodeBlock { "View Name"; }
exists_2 = Orchid.RevitProject.Parameters.Parameter.Exists(parameterName=code_block_67, element=all_elements_in_view_s)
filterByBoolMask_8 = List.FilterByBoolMask(list=all_elements_in_view_s, mask=exists_2)
code_block_68 = CodeBlock { "Type"; }
getParameterValueByName_6 = Element.GetParameterValueByName(element=filterByBoolMask_8.in, parameterName=code_block_68)
name = Orchid.RevitProject.Elements.ElementType.Name(elementType=getParameterValueByName_6)
code_block_69 = CodeBlock { "Building Section (04_CH)"; }
eq_10 = name == code_block_69
filterByBoolMask_9 = List.FilterByBoolMask(list=filterByBoolMask_8.in, mask=eq_10)
hideElements = archilab.Revit.Views.Views.HideElements(view=uniqueItems, elements=filterByBoolMask_9.in)
code_block_70 = CodeBlock { null; }
replaceEmptyLists_4 = Custom[List.ReplaceEmptyLists](seq=hideElements, Replacement=code_block_70)
end = Revit.Transaction.Transaction.End(input=replaceEmptyLists_4)
code_block_71 = CodeBlock(x=end)
# ---------- code_block_71.designscript (13 lines) ----------
x;

[Imperative]
{
	if(x == null)
	{
		return = [];
	}
	else
	{
		return = "Section";
	}
};
# ----------------------------------------
getByType = archilab.Revit.Views.Views.GetByType(viewType=code_block_71.out1)
all_elements_in_view_s_2 = Custom[All Elements In View(s)](Views=getByType)
code_block_72 = CodeBlock { "View Name"; }
exists_3 = Orchid.RevitProject.Parameters.Parameter.Exists(parameterName=code_block_72, element=all_elements_in_view_s_2)
filterByBoolMask_10 = List.FilterByBoolMask(list=all_elements_in_view_s_2, mask=exists_3)
hideElements_2 = archilab.Revit.Views.Views.HideElements(view=getByType, elements=filterByBoolMask_10.in)
end_2 = Revit.Transaction.Transaction.End(input=setParameterByName_3)
flatten_8 = List.Flatten(list=end_2)
uniqueItems_2 = List.UniqueItems(list=flatten_8)
openView = Orchid.RevitProject.Common.Document.OpenView(view=uniqueItems_2)
code_block_73 = CodeBlock { null; }
replaceEmptyLists_5 = Custom[List.ReplaceEmptyLists](seq=openView, Replacement=code_block_73)
code_block_74 = CodeBlock(x=replaceEmptyLists_5)
# ---------- code_block_74.designscript (13 lines) ----------
x;

[Imperative]
{
	if(x == null)
	{
		return = [];
	}
	else
	{
		return = x;
	}
};
# ----------------------------------------

# group: Override Losas
code_block_75 = CodeBlock(x=code_block_74.out1) { x; }
code_block_76 = CodeBlock(x=code_block_75) { x; }
code_block_77 = CodeBlock { "Floors"; }
byName_6 = Category.ByName(name=code_block_77)
all_elements_of_category_in_view = ElementsOfCategoryInView(Category=byName_6, View=code_block_76)
name_2 = Material.Name()  # unwired: material
getMaterials = Element.GetMaterials(element=all_elements_of_category_in_view)
flatten_9 = List.Flatten(list=getMaterials)
function_apply_4 = ApplyFunction(func=name_2, arg1=flatten_9)
code_block_78 = CodeBlock { "Concrete, Cast-in-Place gray"; }
eq_11 = function_apply_4 == code_block_78
filterByBoolMask_11 = List.FilterByBoolMask(list=all_elements_of_category_in_view, mask=eq_11)
code_block_79 = CodeBlock(x=code_block_75) { x; }
code_block_80 = CodeBlock { null; }
replaceEmptyLists_6 = Custom[List.ReplaceEmptyLists](seq=code_block_79, Replacement=code_block_80)
code_block_81 = CodeBlock(x=replaceEmptyLists_6)
# ---------- code_block_81.designscript (12 lines) ----------
x;
[Imperative]
{
	if(x == null)
	{
		return = [];
	}
	else
	{
		return = "Hidden";
	}
};
# ----------------------------------------
getByName = LinePatternElement.GetByName(name=code_block_81.out1)
color_palette_2 = ColorPalette({R: 0, G: 0, B: 0, A: 255})
code_block_82 = CodeBlock { 1; }
create_overridegraphicsettings_2 = Custom[Create OverrideGraphicSettings](ProjectionLinePattern=getByName, ProjectionLineColor=color_palette_2, ProjectionLineWeight=code_block_82, CutLinePattern=getByName, CutLineColor=color_palette_2, CutLineWeight=code_block_82)
view_setelementoverrides_2 = Custom[View SetElementOverrides](view=code_block_76, elements=filterByBoolMask_11.in, overrides=create_overridegraphicsettings_2)

# group: Override Muro en Corte
code_block_83 = CodeBlock(x=code_block_74.out1) { x; }
code_block_84 = CodeBlock(x=code_block_83) { x; }
code_block_85 = CodeBlock { "Walls"; }
byName_7 = Category.ByName(name=code_block_85)
all_elements_of_category_in_view_2 = ElementsOfCategoryInView(Category=byName_7, View=code_block_84)
wallType = archilab.Revit.Elements.Walls.WallType(wall=all_elements_of_category_in_view_2)
kind = Orchid.RevitProject.Elements.WallType.Kind(wallType=wallType)
code_block_86 = CodeBlock { "Basic"; }
eq_12 = kind == code_block_86
filterByBoolMask_12 = List.FilterByBoolMask(list=all_elements_of_category_in_view_2, mask=eq_12)
name_3 = Material.Name()  # unwired: material
getMaterials_2 = Element.GetMaterials(element=filterByBoolMask_12.in)
flatten_10 = List.Flatten(list=getMaterials_2)
function_apply_5 = ApplyFunction(func=name_3, arg1=flatten_10)
code_block_87 = CodeBlock { "Concrete, Cast-in-Place gray"; }
eq_13 = function_apply_5 == code_block_87
filterByBoolMask_13 = List.FilterByBoolMask(list=filterByBoolMask_12.in, mask=eq_13)
code_block_88 = CodeBlock(x=code_block_83) { x; }
code_block_89 = CodeBlock { null; }
replaceEmptyLists_7 = Custom[List.ReplaceEmptyLists](seq=code_block_88, Replacement=code_block_89)
code_block_90 = CodeBlock(x=replaceEmptyLists_7)  # same code as code_block_81
getByName_2 = LinePatternElement.GetByName(name=code_block_90.out1)
color_palette_3 = ColorPalette({R: 0, G: 0, B: 0, A: 255})
code_block_91 = CodeBlock { 1; }
create_overridegraphicsettings_3 = Custom[Create OverrideGraphicSettings](ProjectionLinePattern=getByName_2, ProjectionLineColor=color_palette_3, ProjectionLineWeight=code_block_91, CutLinePattern=getByName_2, CutLineColor=color_palette_3, CutLineWeight=code_block_91)
view_setelementoverrides_3 = Custom[View SetElementOverrides](view=code_block_84, elements=filterByBoolMask_13.in, overrides=create_overridegraphicsettings_3)

# group: Overrides Emplantillado
code_block_92 = CodeBlock(x=code_block_74.out1) { x; }
code_block_93 = CodeBlock { "Structural Foundations"; }
byName_8 = Category.ByName(name=code_block_93)
all_elements_of_category_in_view_3 = ElementsOfCategoryInView(Category=byName_8, View=code_block_92)
name_4 = Element.Name(element=all_elements_of_category_in_view_3)
code_block_94 = CodeBlock { "EMPLANTILLADO"; }
contains = String.Contains(str=name_4, searchFor=code_block_94)
filterByBoolMask_14 = List.FilterByBoolMask(list=all_elements_of_category_in_view_3, mask=contains)
code_block_95 = CodeBlock { null; }
replaceEmptyLists_8 = Custom[List.ReplaceEmptyLists](seq=filterByBoolMask_14.in, Replacement=code_block_95)
code_block_96 = CodeBlock(x=replaceEmptyLists_8)
# ---------- code_block_96.designscript (12 lines) ----------
x;
[Imperative]
{
	if(x == null)
	{
		return = [];
	}
	else
	{
		return = x[0];
	}
};
# ----------------------------------------
code_block_97 = CodeBlock(x=replaceEmptyLists_8)
# ---------- code_block_97.designscript (12 lines) ----------
x;
[Imperative]
{
	if(x == null)
	{
		return = [];
	}
	else
	{
		return = "Diagonal up 1.5mm";
	}
};
# ----------------------------------------
getByName_3 = FillPatternElement.GetByName(name=code_block_97.out1)
color_palette_4 = ColorPalette({R: 0, G: 0, B: 0, A: 255})
create_overridegraphicsettings_4 = Custom[Create OverrideGraphicSettings](SurfaceForegroundPattern=getByName_3, SurfaceForegroundPatternColor=color_palette_4, CutForegroundPattern=getByName_3, CutForegroundPatternColor=color_palette_4)
view_setelementoverrides_4 = Custom[View SetElementOverrides](view=code_block_92, elements=code_block_96.out1, overrides=create_overridegraphicsettings_4)

# group: Overrides Vigas Hormigon en Corte
activeView_2 = Orchid.RevitProject.Common.Document.ActiveView()
code_block_98 = CodeBlock(x=code_block_74.out1) { x; }
code_block_99 = CodeBlock(x=code_block_98) { x; }
code_block_100 = CodeBlock { "Structural Framing"; }
byName_9 = Category.ByName(name=code_block_100)
all_elements_of_category_in_view_4 = ElementsOfCategoryInView(Category=byName_9, View=code_block_99)
familyName = Orchid.RevitProject.Elements.Element.FamilyName(element=all_elements_of_category_in_view_4)
code_block_101 = CodeBlock()
# ---------- code_block_101.designscript (6 lines) ----------
[
"EST_M_STRUCTURAL FRAMING_VIGA INVERTIDA",
"EST_M_STRUCTURAL FRAMING_VIGA SEMI INVERTIDA",
"EST_M_STRUCTURAL FRAMING_VIGA TRADICIONAL",
"EST_M_STRUCTURAL FRAMING_VIGA FUNDACION"
];
# ----------------------------------------
eq_14 = familyName@L1 == code_block_101
anyTrue_3 = Orchid.Common.List.AnyTrue(list=eq_14)
filterByBoolMask_15 = List.FilterByBoolMask(list=all_elements_of_category_in_view_4, mask=anyTrue_3)
location_2 = Custom[Element.Location+](element=filterByBoolMask_15.in)
code_block_102 = CodeBlock(x=location_2.curves)  # same code as code_block_22
direction_3 = Line.Direction(line=code_block_102.out1)
code_block_103 = CodeBlock(x=code_block_98) { x; }
plane_4 = Custom[View.Plane](view=code_block_103)
isParallelToPlane = Custom[Vector.IsParallelToPlane](vector=direction_3, plane=plane_4)  # package Clockwork for Dynamo 2.x; Checks if a given vector is parallel to a given plane
filterByBoolMask_16 = List.FilterByBoolMask(list=filterByBoolMask_15.in, mask=isParallelToPlane)
code_block_104 = CodeBlock { null; }
replaceEmptyLists_9 = Custom[List.ReplaceEmptyLists](seq=code_block_103, Replacement=code_block_104)
code_block_105 = CodeBlock(x=replaceEmptyLists_9)  # same code as code_block_81
getByName_4 = LinePatternElement.GetByName(name=code_block_105.out1)
color_palette_5 = ColorPalette({R: 0, G: 0, B: 0, A: 255})
code_block_106 = CodeBlock { 1; }
create_overridegraphicsettings_5 = Custom[Create OverrideGraphicSettings](ProjectionLinePattern=getByName_4, ProjectionLineColor=color_palette_5, ProjectionLineWeight=code_block_106, CutLinePattern=getByName_4, CutLineColor=color_palette_5, CutLineWeight=code_block_106)
view_setelementoverrides_5 = Custom[View SetElementOverrides](view=code_block_99, elements=filterByBoolMask_16.out, overrides=create_overridegraphicsettings_5)

# group: Overrides Fundaciones (Hidden)
code_block_107 = CodeBlock(x=code_block_74.out1) { x; }
code_block_108 = CodeBlock(x=code_block_107) { x; }
code_block_109 = CodeBlock { "Structural Foundations"; }
byName_10 = Category.ByName(name=code_block_109)
all_elements_of_category_in_view_5 = ElementsOfCategoryInView(Category=byName_10, View=code_block_108)
kind_2 = Custom[StructuralFoundation.Kind](structuralFoundation=all_elements_of_category_in_view_5)  # package Clockwork for Dynamo 2.x; Retrieves the kind of a given structural foundation (isolated, wall, slab).
code_block_110 = CodeBlock { "Slab"; }
eq_15 = kind_2 == code_block_110
filterByBoolMask_17 = List.FilterByBoolMask(list=all_elements_of_category_in_view_5, mask=eq_15)
code_block_111 = CodeBlock(x=code_block_107) { x; }
code_block_112 = CodeBlock { null; }
replaceEmptyLists_10 = Custom[List.ReplaceEmptyLists](seq=code_block_111, Replacement=code_block_112)
code_block_113 = CodeBlock(x=replaceEmptyLists_10)  # same code as code_block_81
getByName_5 = LinePatternElement.GetByName(name=code_block_113.out1)
color_palette_6 = ColorPalette({R: 0, G: 0, B: 0, A: 255})
code_block_114 = CodeBlock { 1; }
create_overridegraphicsettings_6 = Custom[Create OverrideGraphicSettings](ProjectionLinePattern=getByName_5, ProjectionLineColor=color_palette_6, ProjectionLineWeight=code_block_114, CutLinePattern=getByName_5, CutLineColor=color_palette_6, CutLineWeight=code_block_114)
view_setelementoverrides_6 = Custom[View SetElementOverrides](view=code_block_108, elements=filterByBoolMask_17.out, overrides=create_overridegraphicsettings_6)

# group: Sobrescribir Columnas de Hormigon
code_block_115 = CodeBlock(x=code_block_74.out1) { x; }
code_block_116 = CodeBlock { "Structural Columns"; }
byName_11 = Category.ByName(name=code_block_116)
all_elements_of_category_in_view_6 = ElementsOfCategoryInView(Category=byName_11, View=code_block_115)
familyName_2 = Orchid.RevitProject.Elements.Element.FamilyName(element=all_elements_of_category_in_view_6)
code_block_117 = CodeBlock { "EST_M_STRUCTURAL COLUMN_RECTANGULAR"; }
eq_16 = familyName_2 == code_block_117
filterByBoolMask_18 = List.FilterByBoolMask(list=all_elements_of_category_in_view_6, mask=eq_16)
code_block_118 = CodeBlock { "Hidden"; }
getByName_6 = LinePatternElement.GetByName(name=code_block_118)
code_block_119 = CodeBlock { 1; }
create_overridegraphicsettings_7 = Custom[Create OverrideGraphicSettings](ProjectionLinePattern=getByName_6, ProjectionLineWeight=code_block_119, CutLinePattern=getByName_6, CutLineWeight=code_block_119)
code_block_120 = CodeBlock { false; }
view_setelementoverrides_7 = Custom[View SetElementOverrides](view=code_block_115, elements=filterByBoolMask_18.in, overrides=create_overridegraphicsettings_7, hide=code_block_120)

# group: Redibujar Contorno
code_block_121 = CodeBlock(x=code_block_74.out1) { x; }
plane_5 = Custom[View.Plane](view=code_block_121)
normal_2 = Plane.Normal(plane=plane_5)
code_block_122 = CodeBlock(t2=code_block_121) { t1 = Revit.Elements.Element.GetParameterValueByName(t2, "Far Clip Offset"); t3 = t1 / 2; t4 = t3 * -1; }
translate_3 = Geometry.Translate(geometry=plane_5, direction=normal_2, distance=code_block_122.t4)
byUnion = Solid.ByUnion()  # unwired: solids
code_block_123 = CodeBlock()
# ---------- code_block_123.designscript (6 lines) ----------
["Floors",
"Structural Framing",
"Walls",
"Structural Foundations",
"Structural Columns"
];
# ----------------------------------------
byName_12 = Category.ByName(name=code_block_123)
all_elements_of_category_in_view_7 = ElementsOfCategoryInView(Category=byName_12, View=code_block_121)
flatten_11 = List.Flatten(list=all_elements_of_category_in_view_7)
solids = Element.Solids(element=flatten_11)
flatten_12 = List.Flatten(list=solids)
function_apply_6 = ApplyFunction(func=byUnion, arg1=flatten_12)
intersect_2 = Geometry.Intersect(geometry=translate_3, other=function_apply_6)
perimeterCurves_2 = Surface.PerimeterCurves(surface=intersect_2)
flatten_13 = List.Flatten(list=perimeterCurves_2)
byCurve = Custom[DetailCurve.ByCurve+](curve=flatten_13, view=code_block_121)  # package Clockwork for Dynamo 2.x; Creates a detail line based on a given curve. Unlike the OOTB node it can also draw circles.
code_block_124 = CodeBlock { "Line Style"; }
code_block_125 = CodeBlock { "Wide Lines"; }
get_line_style_by_name = Custom[Get Line Style by Name](name=code_block_125)  # package archi-lab.net; This node will return a line style object by its name. Line styles can be either Drafting or Model Line Property.
setParameterByName_4 = Element.SetParameterByName(element=byCurve, parameterName=code_block_124, value=get_line_style_by_name, lacing=Longest)

# group: Overrides Vigas Hormigon en Corte
code_block_126 = CodeBlock(x=code_block_74.out1) { x; }
code_block_127 = CodeBlock(x=code_block_126) { x; }
code_block_128 = CodeBlock { "Structural Framing"; }
byName_13 = Category.ByName(name=code_block_128)
all_elements_of_category_in_view_8 = ElementsOfCategoryInView(Category=byName_13, View=code_block_127)
familyName_3 = Orchid.RevitProject.Elements.Element.FamilyName(element=all_elements_of_category_in_view_8)
code_block_129 = CodeBlock()  # same code as code_block_101
eq_17 = familyName_3@L1 == code_block_129
anyTrue_4 = Orchid.Common.List.AnyTrue(list=eq_17)
filterByBoolMask_19 = List.FilterByBoolMask(list=all_elements_of_category_in_view_8, mask=anyTrue_4)
code_block_130 = CodeBlock(x=code_block_126) { x; }
code_block_131 = CodeBlock { null; }
replaceEmptyLists_11 = Custom[List.ReplaceEmptyLists](seq=code_block_130, Replacement=code_block_131)
code_block_132 = CodeBlock(x=replaceEmptyLists_11)  # same code as code_block_81
getByName_7 = LinePatternElement.GetByName(name=code_block_132.out1)
color_palette_7 = ColorPalette({R: 0, G: 0, B: 0, A: 255})
code_block_133 = CodeBlock { 1; }
create_overridegraphicsettings_8 = Custom[Create OverrideGraphicSettings](ProjectionLinePattern=getByName_7, ProjectionLineColor=color_palette_7, ProjectionLineWeight=code_block_133, CutLinePattern=getByName_7, CutLineColor=color_palette_7, CutLineWeight=code_block_133)
view_setelementoverrides_8 = Custom[View SetElementOverrides](view=code_block_127, elements=filterByBoolMask_19.in, overrides=create_overridegraphicsettings_8)

# group: Breaklines
byLoft = Surface.ByLoft()  # unwired: crossSections
translate_4 = Geometry.Translate(lacing=Longest)  # unwired: geometry, direction, distance
byJoinedCurves_2 = PolyCurve.ByJoinedCurves()  # unwired: curves
code_block_134 = CodeBlock(x=code_block_74.out1) { x; }
code_block_135 = CodeBlock(x=code_block_134) { x; }
getCropBox = Orchid.RevitProject.Views.View.GetCropBox(view=code_block_135)
function_apply_7 = ApplyFunction(func=byJoinedCurves_2, arg1=getCropBox.Curve)
code_block_136 = CodeBlock(x=function_apply_7)  # same code as code_block_74
code_block_137 = CodeBlock { -290; false; }
offset_2 = PolyCurve.Offset(polyCurve=code_block_136.out1, signedDistance=code_block_137.out0, extendCircular=code_block_137.out1)
plane_6 = Custom[View.Plane](view=code_block_135)
normal_3 = Plane.Normal(plane=plane_6)
reverse_3 = Vector.Reverse(vector=normal_3)
list_create_2 = List.Create(item0=normal_3, item1=reverse_3)
code_block_138 = CodeBlock { 1000; }
function_apply_8 = ApplyFunction(func=translate_4, arg1=offset_2, arg2=list_create_2, arg3=code_block_138)
function_apply_9 = ApplyFunction(func=byLoft, arg1=function_apply_8)
byUnion_2 = Solid.ByUnion()  # unwired: solids
code_block_139 = CodeBlock()
# ---------- code_block_139.designscript (6 lines) ----------
[
"Walls",
"Structural Columns",
"Structural Framing",
"Floors"
];
# ----------------------------------------
byName_14 = Category.ByName(name=code_block_139)
all_elements_of_category_in_view_9 = ElementsOfCategoryInView(Category=byName_14, View=code_block_135)
geometry_2 = Element.Geometry(element=all_elements_of_category_in_view_9)
flatten_14 = List.Flatten(list=geometry_2)
function_apply_10 = ApplyFunction(func=byUnion_2, arg1=flatten_14)
code_block_140 = CodeBlock(x=function_apply_10)  # same code as code_block_74
intersect_3 = Geometry.Intersect(geometry=function_apply_9, other=code_block_140.out1)
code_block_141 = CodeBlock { [0.5,0.5]; [0,1]; }
pointAtParameter_6 = Surface.PointAtParameter(surface=intersect_3@L1, u=code_block_141.out1@L2, v=code_block_141.out0@L2, lacing=Longest)
transpose = List.Transpose(lists=pointAtParameter_6)
code_block_142 = CodeBlock { null; }
replaceEmptyLists_12 = Custom[List.ReplaceEmptyLists](seq=transpose, Replacement=code_block_142)
code_block_143 = CodeBlock(x=replaceEmptyLists_12)
# ---------- code_block_143.designscript (13 lines) ----------
x;

[Imperative]
{
	if(x == null)
	{
		return = [[],[]];
	}
	else
	{
		return = x;
	}
};
# ----------------------------------------
code_block_144 = CodeBlock(x=code_block_143.out1) { x[0]; x[1]; }
byStartPointEndPoint = Line.ByStartPointEndPoint(startPoint=code_block_144.out0, endPoint=code_block_144.out1)
reverse_4 = Curve.Reverse(curve=byStartPointEndPoint)
code_block_145 = CodeBlock(x=code_block_134) { x; }
plane_7 = Custom[View.Plane](view=code_block_145)
pullOntoPlane_3 = Curve.PullOntoPlane(curve=reverse_4, plane=plane_7)
code_block_146 = CodeBlock { "EST_D_BREAKLINE"; }
byName_15 = FamilyType.ByName(name=code_block_146)
byCurve_2 = Custom[DetailComponent.ByCurve](curve=pullOntoPlane_3, familyType=byName_15, view=code_block_145, lacing=Longest)  # package Clockwork for Dynamo 2.x; Places a line-based detail component in a given view
code_block_147 = CodeBlock { "Length of masking region"; 900; }
setParameterByName_5 = Element.SetParameterByName(element=byCurve_2, parameterName=code_block_147.out0, value=code_block_147.out1)
code_block_148 = CodeBlock(x=code_block_134) { x; }
plane_8 = Custom[View.Plane](view=code_block_148)
normal_4 = Plane.Normal(plane=plane_8)
X = Vector.X(vector=normal_4)
byPatch_2 = Surface.ByPatch(closedCurve=offset_2)
code_block_149 = CodeBlock { 0.5; }
normalAtParameter = Surface.NormalAtParameter(surface=byPatch_2, u=code_block_149, v=code_block_149)
X_2 = Vector.X(vector=normalAtParameter)
eq_18 = X == X_2

# group: Cota Losas, Radier y Sello de Fundacion
code_block_150 = CodeBlock(x=replaceEmptyLists_5)  # same code as code_block_22
code_block_151 = CodeBlock(x=code_block_150.out1) { x; }
code_block_152 = CodeBlock(x=code_block_150.out1) { x; }
getCropBox_2 = Orchid.RevitProject.Views.View.GetCropBox(view=code_block_152)
code_block_153 = CodeBlock { null; }
replaceEmptyLists_13 = Custom[List.ReplaceEmptyLists](seq=getCropBox_2.Curve, Replacement=code_block_153)
code_block_154 = CodeBlock(x=replaceEmptyLists_13)  # same code as code_block_96
code_block_155 = CodeBlock(x=code_block_154.out1) { x; }
code_block_156 = CodeBlock { 0.5; }
planeAtParameter = Curve.PlaneAtParameter(curve=code_block_155, param=code_block_156)
pointAtParameter_7 = Curve.PointAtParameter(curve=code_block_155, param=code_block_156)
plane_9 = Custom[View.Plane](view=code_block_152)
normal_5 = Plane.Normal(plane=plane_9)
byOriginNormal_2 = Plane.ByOriginNormal(origin=pointAtParameter_7, normal=normal_5)
normal_6 = Plane.Normal(plane=byOriginNormal_2)
code_block_157 = CodeBlock { 90; }
rotate_2 = Geometry.Rotate(geometry=planeAtParameter, origin=pointAtParameter_7, axis=normal_6, degrees=code_block_157)
normal_7 = Plane.Normal(plane=rotate_2)
code_block_158 = CodeBlock { 350; }
translate_5 = Geometry.Translate(geometry=code_block_154.out1, direction=normal_7, distance=code_block_158)
code_block_159 = CodeBlock { "Floors"; }
byName_16 = Category.ByName(name=code_block_159)
all_elements_of_category_in_view_10 = ElementsOfCategoryInView(Category=byName_16, View=code_block_152)
code_block_160 = CodeBlock { "Slope"; }
getParameterValueByName_7 = Element.GetParameterValueByName(element=all_elements_of_category_in_view_10, parameterName=code_block_160)
code_block_161 = CodeBlock { ""; }
eq_19 = getParameterValueByName_7 == code_block_161
filterByBoolMask_20 = List.FilterByBoolMask(list=all_elements_of_category_in_view_10, mask=eq_19)
level = Custom[Element.Level]()  # package Clockwork for Dynamo 2.x; Gets an element's level; unwired: element
groupByFunction = List.GroupByFunction(list=filterByBoolMask_20.in, func=level)
code_block_162 = CodeBlock { "Height Offset From Level"; }
getParameterValueByName_8 = Element.GetParameterValueByName(element=groupByFunction, parameterName=code_block_162)
minimumItem_2 = List.MinimumItem(list=getParameterValueByName_8@L2)
code_block_163 = CodeBlock(x=minimumItem_2)
# ---------- code_block_163.designscript (12 lines) ----------
x;
[Imperative]
{
	if(x[0] == null)
	{
		return = [];
	}
	else
	{
		return = x;
	}
};
# ----------------------------------------
eq_20 = getParameterValueByName_8@L2 == code_block_163.out1@L1
filterByBoolMask_21 = List.FilterByBoolMask(list=groupByFunction, mask=eq_20)
flatten_15 = List.Flatten(list=filterByBoolMask_21.in)
element_surfaces_references = Custom[Element Surfaces References](element=flatten_15@L1)  # package Genius Loci; Retrieve the top, bottom, side surfaces and their associated references of the system family. This doesn't work with cylindrical system families (pipe...)
code_block_164 = CodeBlock(x=element_surfaces_references.Top_Reference) { DSCore.List.Flatten(x,2); }
code_block_165 = CodeBlock { "Structural Foundations"; }
byName_17 = Category.ByName(name=code_block_165)
all_elements_of_category_in_view_11 = ElementsOfCategoryInView(Category=byName_17, View=code_block_152)
familyName_4 = Orchid.RevitProject.Elements.Element.FamilyName(element=all_elements_of_category_in_view_11)
code_block_166 = CodeBlock { "EST_M_STRUCTURAL FOUNDATION_FUNDACION AISLADA"; }
eq_21 = familyName_4 == code_block_166
code_block_167 = CodeBlock { "Wall Foundation"; }
eq_22 = familyName_4 == code_block_167
or_ = eq_21 || eq_22
filterByBoolMask_22 = List.FilterByBoolMask(list=all_elements_of_category_in_view_11, mask=or_)
code_block_168 = CodeBlock { null; }
replaceEmptyLists_14 = Custom[List.ReplaceEmptyLists](seq=filterByBoolMask_22.in, Replacement=code_block_168)
code_block_169 = CodeBlock(x=replaceEmptyLists_14)  # same code as code_block_96
element_surfaces_references_2 = Custom[Element Surfaces References](element=code_block_169.out1)
code_block_170 = CodeBlock { null; }
replaceEmptyLists_15 = Custom[List.ReplaceEmptyLists](seq=element_surfaces_references_2.Bottom_Reference, Replacement=code_block_170)
code_block_171 = CodeBlock(x=replaceEmptyLists_15)  # same code as code_block_96
code_block_172 = CodeBlock(refLosas=code_block_164, refrFunAis=code_block_171.out1) { DSCore.List.Flatten(([refLosas,refrFunAis]),2); }
all_2 = Orchid.RevitProject.Annotations.DimensionType.All()
name_5 = Element.Name(element=all_2)
code_block_173 = CodeBlock { "Linear - 2.5mm Arial"; }
eq_23 = name_5 == code_block_173
filterByBoolMask_23 = List.FilterByBoolMask(list=all_2, mask=eq_23)
code_block_174 = CodeBlock(x=filterByBoolMask_23.in) { x[0]; }
dimension_byreferences = Custom[Dimension ByReferences](view=code_block_151, line=translate_5, references=code_block_172, dimensionType=code_block_174)  # package Genius Loci; Creates a new linear dimension from at least two geometric references of an object.

code_block_175 = CodeBlock(x=code_block_151) { x; }

# group: Niveles en Elevacion
setParameterByName_6 = Element.SetParameterByName()  # unwired: element, parameterName, value
code_block_176 = CodeBlock { null; }
replaceEmptyLists_16 = Custom[List.ReplaceEmptyLists](seq=dimension_byreferences, Replacement=code_block_176)
code_block_177 = CodeBlock(x=replaceEmptyLists_16)  # same code as code_block_22
ʳʰʸᵗʰᵐ_dimensions = Rhythm.Revit.Elements.Dimensions.GetReferenceElements(dimension=code_block_177.out1)
ʳʰʸᵗʰᵐ_dimensions_getcurve = Rhythm.Revit.Elements.Dimensions.GetCurve(dimension=code_block_177.out1)
code_block_178 = CodeBlock(line1=ʳʰʸᵗʰᵐ_dimensions_getcurve)
# ---------- code_block_178.designscript (5 lines) ----------
point1 = Autodesk.Curve.StartPoint(line1);
point2 = Autodesk.Curve.EndPoint(line1);
t1 = [point1, point2];
t2 = DSCore.List.Flatten(t1, -1);
t3 = DSCore.List.UniqueItems(t2);
# ----------------------------------------
byElementAndLocation = Tag.ByElementAndLocation(view=code_block_175, element=ʳʰʸᵗʰᵐ_dimensions, location=code_block_178.t3)
code_block_179 = CodeBlock { "Type"; }
getCategory = Element.GetCategory(element=ʳʰʸᵗʰᵐ_dimensions)
string_from_object = FromObject(obj=getCategory)
code_block_180 = CodeBlock { "Structural Foundations"; }
eq_24 = string_from_object == code_block_180  # lacing=Longest
tag_sello_fundacion = CodeBlock()
# ---------- tag_sello_fundacion.designscript (2 lines) ----------
family1 = Revit.Family.ByName("EST_A_FOUNDATION TAG_ELEVACION");
familytype1 = Revit.FamilyType.ByFamilyAndName(family1, "Orientación Izquierda");
# ----------------------------------------
tag_tope_losa = CodeBlock()
# ---------- tag_tope_losa.designscript (2 lines) ----------
family1 = Revit.Family.ByName("EST_A_FLOOR TAG_ELEVACION_TOPE LOSA");
familytype1 = Revit.FamilyType.ByFamilyAndName(family1, "Orientación Izquierda");
# ----------------------------------------
scopeIf_4 = Custom[ScopeIf+](test=eq_24, True=tag_sello_fundacion.familytype1, False=tag_tope_losa.familytype1)
setParameterByName_7 = Element.SetParameterByName(element=byElementAndLocation, parameterName=code_block_179, value=scopeIf_4, lacing=Longest)
code_block_181 = CodeBlock { "Type"; }
taggedElement = Tag.TaggedElement(tag=setParameterByName_7)
name_6 = Element.Name(element=taggedElement)
code_block_182 = CodeBlock { "RADIER e="; }
contains_2 = String.Contains(str=name_6, searchFor=code_block_182)
tag_tope_radier = CodeBlock()
# ---------- tag_tope_radier.designscript (2 lines) ----------
family1 = Revit.Family.ByName("EST_A_FLOOR TAG_ELEVACION_TOPE RADIER");
familytype1 = Revit.FamilyType.ByFamilyAndName(family1, "Orientación Izquierda");
# ----------------------------------------
code_block_183 = CodeBlock { []; }
scopeIf_5 = Custom[ScopeIf+](test=contains_2, True=tag_tope_radier.familytype1, False=code_block_183)
function_apply_11 = ApplyFunction(func=setParameterByName_6, arg1=setParameterByName_7, arg2=code_block_181, arg3=scopeIf_5)
