# Dynamo graph elevacionVigaNum_script.dyn (Dynamo 2.3.1.11775)
# packages: Clockwork for Dynamo 2.x 2.4.0, Orchid 200.4.0.7938, Data-Shapes 2021.2.94, archi-lab.net 2022.210.2419, Crumple 2022.2.13, Genius Loci 2020.8.3

code_block = CodeBlock { "Elevación Viga Numerada"; }
code_block_2 = CodeBlock()
# ---------- code_block_2.designscript (10 lines) ----------
//buttonText
"INICIAR";
//buttonCancel
"CANCELAR";
//maxHeight

//width
440;
//label
180;
# ----------------------------------------
code_block_3 = CodeBlock { "Seleccionar Vigas:"; }
code_block_4 = CodeBlock { "SELECCIONAR"; }
code_block_5 = CodeBlock { "Structural Framing"; }
byName = Category.ByName(name=code_block_5)
selectmodelelements_data_ordered = Custom[SelectModelElements Data (ordered)](InputName=code_block_3, ButtonText=code_block_4, CategoryFilter=byName)  # package Data-Shapes; Creates a Revit element selection input for UI.MultipleInputForm++ . Check out www.data-shapes.net for more infos!
code_block_6 = CodeBlock { "Escala:"; }
code_block_7 = CodeBlock()
# ---------- code_block_7.designscript (6 lines) ----------
[
"1:50",
"1:75",
"1:100",
"1:125"
];
# ----------------------------------------
code_block_8 = CodeBlock { ":"; }
split = String.Split(str=code_block_7, separator0=code_block_8)
code_block_9 = CodeBlock { 1; }
getItemAtIndex = List.GetItemAtIndex(list=split@L2, index=code_block_9)
toNumber = String.ToNumber(str=getItemAtIndex)
code_block_10 = CodeBlock { 0; false; }
dropdown_data = Custom[DropDown Data](InputName=code_block_6, Keys=code_block_7, Values=toNumber, DefaultValueIndex=code_block_10.out0, Sorted_optional=code_block_10.out1)  # package Data-Shapes; Create data for DropDown input in UI.MultiInputForm ++ . Check out www.data-shapes.net for more infos.
list_create = List.Create(item0=selectmodelelements_data_ordered, item1=dropdown_data)
inputgroup_data = Custom[InputGroup Data](Inputs=list_create)  # package Data-Shapes; Creates a group of inputs for UI.MultipleInputForm ++ . Check out www.data-shapes.net for more infos !
boolean = BoolSelector(true)
multipleinputform = Custom[MultipleInputForm ++](Description_optional=code_block, ButtonText_optional=code_block_2.out0, Inputs=inputgroup_data, Toggle=boolean, CancelButtonText_optional=code_block_2.out1, Width_optional=code_block_2.out2, LabelWidth_optional=code_block_2.out3)  # package Data-Shapes; Create a form with multiple inputs. see www.data-shapes.net for tutorials and infos!
code_block_11 = CodeBlock(x=multipleinputform.User_Inputs)
# ---------- code_block_11.designscript (13 lines) ----------
x;

[Imperative]
{
	if(x == null)
	{
		return = [[],[]];
	}
	else
	{
		return = x;
	}
};
# ----------------------------------------
code_block_12 = CodeBlock(x=code_block_11.out1) { x[0]; }
code_block_13 = CodeBlock { "Numeracion Viga"; }
getParameterValueByName = Element.GetParameterValueByName(element=code_block_12, parameterName=code_block_13)
code_block_14 = CodeBlock { ""; }
eq = getParameterValueByName == code_block_14
anyTrue = Orchid.Common.List.AnyTrue(list=eq)
code_block_15 = CodeBlock(x=anyTrue, y=code_block_11.out1)
# ---------- code_block_15.designscript (14 lines) ----------
x;
y;

[Imperative]
{
	if(x == true)
	{
		return = null;
	}
	else
	{
		return = y;
	}
};
# ----------------------------------------
code_block_16 = CodeBlock(x=code_block_15.out2)  # same code as code_block_11
code_block_17 = CodeBlock(x=code_block_16.out1) { x[0]; }
color_palette = ColorPalette({R: 255, G: 215, B: 0, A: 255})
overrideColorInView = Element.OverrideColorInView(element=code_block_17, color=color_palette)
code_block_18 = CodeBlock { "Info."; }
code_block_19 = CodeBlock(x=code_block_15.out2)
# ---------- code_block_19.designscript (12 lines) ----------
x;
[Imperative]
{
	if (x == null)
	{
		return = "Algunas de las vigas seleccionadas no tienen Numeracion.\nTodas las vigas deben tener su numeración correspondiente antes de ser elevadas.";
	}
	else
	{
		return = [];
	}
};
# ----------------------------------------
uimessenger = Custom[© UIMessenger](title=code_block_18, body=code_block_19.out1)  # package Crumple; Displays a message box with a title/body and OK/cancel button. If OK is selected, the third input's data will be passed through.
byBestFitThroughPoints = Line.ByBestFitThroughPoints()  # unwired: bestFitPoints
code_block_20 = CodeBlock(x=code_block_16.out1) { x[0]; }
location = Custom[Element.Location+](element=code_block_20)  # package Clockwork for Dynamo 2.x; Returns the location of an element as point, curve or curve loop, along with some booleans to help filtering the results. Unlike the OOTB Element.GetLocation node, it also retunrs sketch lines of sketch-based elements like floor slabs as well as the element's rotation property.
code_block_21 = CodeBlock(x=location.curveEndpoints)  # same code as code_block_11
flatten = List.Flatten(list=code_block_21.out1)
function_apply = ApplyFunction(func=byBestFitThroughPoints, arg1=flatten)
code_block_22 = CodeBlock(x=function_apply)
# ---------- code_block_22.designscript (13 lines) ----------
x;

[Imperative]
{
	if(x == null)
	{
		return = [];
	}
	else
	{
		return = x;
	}
};
# ----------------------------------------
direction = Line.Direction(line=code_block_22.out1)
code_block_23 = CodeBlock(x=direction) { x.X; }
code_block_24 = CodeBlock { 0; }
ge = code_block_23 >= code_block_24
reverse = Curve.Reverse(curve=code_block_22.out1)
scopeIf = Custom[ScopeIf+](test=ge, True=reverse, False=code_block_22.out1, lacing=Shortest)  # package Clockwork for Dynamo 2.x; A (hopefully) more robust implementation of ScopeIf. Tests a single boolean and returns a value accordingly.
direction_2 = Line.Direction(line=scopeIf)
normalized = Vector.Normalized(vector=direction_2)
code_block_25 = CodeBlock(x=normalized) { x.X; }
code_block_26 = CodeBlock { 0; }
eq_2 = code_block_25 == code_block_26
code_block_27 = CodeBlock(x=normalized) { x.Y; }
code_block_28 = CodeBlock { 0; }
gt = code_block_27 > code_block_28
and_ = eq_2 && gt
reverse_2 = Curve.Reverse(curve=scopeIf)
scopeIf_2 = Custom[ScopeIf+](test=and_, True=reverse_2, False=scopeIf, lacing=Shortest)
code_block_29 = CodeBlock { "Building Section (03_VH)"; }
byName_2 = Orchid.RevitProject.Views.ViewType.ByName(name=code_block_29)
code_block_30 = CodeBlock()
# ---------- code_block_30.designscript (6 lines) ----------
//height
500;
//offset
300;
//depth
300;
# ----------------------------------------
byLine = Custom[ViewSection.ByLine](Curves=scopeIf_2, ViewFamilyType=byName_2, ViewSectionHeight=code_block_30.out0, OffsetFromLine=code_block_30.out1, Depth=code_block_30.out2)  # package Data-Shapes; Create ViewSections in current document from DS Lines.
byJoinedCurves = PolyCurve.ByJoinedCurves()  # unwired: curves
byLoft = Surface.ByLoft()  # unwired: crossSections
ZAxis = Vector.ZAxis()
code_block_31 = CodeBlock { [500,-500]; }
translate = Geometry.Translate(geometry=scopeIf_2, direction=ZAxis, distance=code_block_31)
function_apply_2 = ApplyFunction(func=byLoft, arg1=translate)
code_block_32 = CodeBlock(x=function_apply_2)  # same code as code_block_22
perimeterCurves = Surface.PerimeterCurves(surface=code_block_32.out1)
function_apply_3 = ApplyFunction(func=byJoinedCurves, arg1=perimeterCurves)
code_block_33 = CodeBlock(x=function_apply_3)  # same code as code_block_22
code_block_34 = CodeBlock { 1000; false; }
offset = PolyCurve.Offset(polyCurve=code_block_33.out1, signedDistance=code_block_34.out0, extendCircular=code_block_34.out1)
explode = Geometry.Explode(geometry=offset)
setCropBox = Orchid.RevitProject.Views.View.SetCropBox(view=byLine, curve=explode)
code_block_35 = CodeBlock(x=code_block_16.out1) { x[1]; }
setScale = View.SetScale(view=setCropBox, scale=code_block_35)
code_block_36 = CodeBlock { ["View Name","Title on Sheet"]; }
name = Level.Name()  # unwired: level
activeView = Orchid.RevitProject.Common.Document.ActiveView()
viewlevel = Custom[© ViewLevel](views=activeView)  # package Crumple; Returns the associated level of a view (if it has one), as well as a boolean mask to remove views without levels after.
function_apply_4 = ApplyFunction(func=name, arg1=viewlevel.lvls)
code_block_37 = CodeBlock(x=code_block_16.out1) { x[0]; }
code_block_38 = CodeBlock { "Numeracion Viga"; }
getParameterValueByName_2 = Element.GetParameterValueByName(element=code_block_37, parameterName=code_block_38)
uniqueItems = List.UniqueItems(list=getParameterValueByName_2)
code_block_39 = CodeBlock(lvl=function_apply_4, num=uniqueItems)
# ---------- code_block_39.designscript (2 lines) ----------
["VH_CIELO "+lvl+"_EJE "+num,
"ELEV. VIGA CIELO "+lvl+",NUM. "+num];
# ----------------------------------------
setParameterByName = Element.SetParameterByName(element=setScale, parameterName=code_block_36, value=code_block_39, lacing=Longest)
flatten_2 = List.Flatten(list=setParameterByName)
uniqueItems_2 = List.UniqueItems(list=flatten_2)
end = Revit.Transaction.Transaction.End(input=uniqueItems_2)
code_block_40 = CodeBlock(x=end) { x; }

# group: Etiqueta Vigas Hormigon
code_block_41 = CodeBlock(x=code_block_40) { x; }
code_block_42 = CodeBlock { null; }
replaceEmptyLists = Custom[List.ReplaceEmptyLists](seq=code_block_41, Replacement=code_block_42)  # package Clockwork for Dynamo 2.x; Replaces all empty lists within a given list with a substitute
code_block_43 = CodeBlock(x=replaceEmptyLists)  # same code as code_block_11
code_block_44 = CodeBlock(x=code_block_43.out1) { x[0]; }
code_block_45 = CodeBlock { "Structural Framing"; }
byName_3 = Category.ByName(name=code_block_45)
all_elements_of_category_in_view = ElementsOfCategoryInView(Category=byName_3, View=code_block_44)
familyName = Orchid.RevitProject.Elements.Element.FamilyName(element=all_elements_of_category_in_view)
code_block_46 = CodeBlock()
# ---------- code_block_46.designscript (6 lines) ----------
[
"EST_M_STRUCTURAL FRAMING_VIGA INVERTIDA",
"EST_M_STRUCTURAL FRAMING_VIGA SEMI INVERTIDA",
"EST_M_STRUCTURAL FRAMING_VIGA TRADICIONAL",
"EST_M_STRUCTURAL FRAMING_VIGA FUNDACION"
];
# ----------------------------------------
eq_3 = familyName@L1 == code_block_46
anyTrue_2 = Orchid.Common.List.AnyTrue(list=eq_3)
filterByBoolMask = List.FilterByBoolMask(list=all_elements_of_category_in_view, mask=anyTrue_2)
location_2 = Custom[Element.Location+](element=filterByBoolMask.in)
code_block_47 = CodeBlock(x=location_2.curves)
# ---------- code_block_47.designscript (12 lines) ----------
x;
[Imperative]
{
	if(x == null)
	{
		return = [];
	}
	else
	{
		return = x;
	}
};
# ----------------------------------------
direction_3 = Line.Direction(line=code_block_47.out1)
code_block_48 = CodeBlock(x=code_block_43.out1) { x[0]; }
plane = Custom[View.Plane](view=code_block_48)  # package Clockwork for Dynamo 2.x; Retrieves the plane of a given view
isParallelToPlane = Custom[Vector.IsParallelToPlane](vector=direction_3, plane=plane)  # package Clockwork for Dynamo 2.x; Checks if a given vector is parallel to a given plane
filterByBoolMask_2 = List.FilterByBoolMask(list=filterByBoolMask.in, mask=isParallelToPlane)
element_taggedstatus = Custom[Element TaggedStatus](element=filterByBoolMask_2.in)  # package Genius Loci; Identify the tagged and untagged elements. Please note : This doesn't work with areas and spaces.
elementcentroid = Custom[© ElementCentroid](element=element_taggedstatus.NotTagged)  # package Crumple; Returns the centroid of the element's axis-aligned bounding box.
location_3 = Custom[Element.Location+](element=element_taggedstatus.NotTagged)
code_block_49 = CodeBlock(x=location_3.curves)  # same code as code_block_47
code_block_50 = CodeBlock { 0.5; }
planeAtParameter = Curve.PlaneAtParameter(curve=code_block_49.out1, param=code_block_50)
code_block_51 = CodeBlock { 0.5; }
pointAtParameter = Curve.PointAtParameter(curve=code_block_49.out1, param=code_block_51)
plane_2 = Custom[View.Plane](view=code_block_48)
normal = Plane.Normal(plane=plane_2)
code_block_52 = CodeBlock { 90; }
rotate = Geometry.Rotate(geometry=planeAtParameter, origin=pointAtParameter, axis=normal, degrees=code_block_52)
normal_2 = Plane.Normal(plane=rotate)
code_block_53 = CodeBlock(z=normal_2) { z.Z; }
code_block_54 = CodeBlock { 0; }
gt_2 = code_block_53 > code_block_54
code_block_55 = CodeBlock { -1; }
ne = code_block_53 != code_block_55
and_2 = gt_2 && ne
reverse_3 = Vector.Reverse(vector=normal_2)
scopeIf_3 = Custom[ScopeIf+](test=and_2, True=normal_2, False=reverse_3, lacing=Shortest)
code_block_56 = CodeBlock(x=element_taggedstatus.NotTagged) { Revit.Elements.Element.GetParameterValueByName(Revit.Elements.Element.GetParameterValueByName(x,"Type"),"Height")/2; }
translate_2 = Geometry.Translate(geometry=elementcentroid, direction=scopeIf_3, distance=code_block_56)
list_create_2 = List.Create(item0=elementcentroid, item1=translate_2)
transpose = List.Transpose(lists=list_create_2)
byElementAndLocation = Tag.ByElementAndLocation(view=code_block_44@L1, element=element_taggedstatus.NotTagged@L1, location=transpose@L2, lacing=Longest)
transpose_2 = List.Transpose(lists=byElementAndLocation)
code_block_57 = CodeBlock { null; }
replaceEmptyLists_2 = Custom[List.ReplaceEmptyLists](seq=transpose_2, Replacement=code_block_57)
code_block_58 = CodeBlock(x=replaceEmptyLists_2)
# ---------- code_block_58.designscript (12 lines) ----------
x;
[Imperative]
{
	if(x == null)
	{
		return = [[],[]];
	}
	else
	{
		return = x;
	}
};
# ----------------------------------------
code_block_59 = CodeBlock(x=code_block_58.out1) { x[1]; }
code_block_60 = CodeBlock { "Type"; }
code_block_61 = CodeBlock { "EST_A_STRUCTURAL FRAMING TAG_ELEVACION"; }
byName_4 = Orchid.RevitProject.Elements.Family.ByName(name=code_block_61)
code_block_62 = CodeBlock { "Tag Viga"; }
byFamilyAndName = FamilyType.ByFamilyAndName(family=byName_4, name=code_block_62)
setParameterByName_2 = Element.SetParameterByName(element=code_block_59, parameterName=code_block_60, value=byFamilyAndName)
code_block_63 = CodeBlock(x=code_block_58.out1) { x[0]; }
code_block_64 = CodeBlock { "Type"; }
code_block_65 = CodeBlock { "EST_A_STRUCTURAL FRAMING TAG_ELEVACION_ESTRIBO Y LATERAL"; }
byName_5 = Orchid.RevitProject.Elements.Family.ByName(name=code_block_65)
code_block_66 = CodeBlock { "Estribo Simple y Laterales"; }
byFamilyAndName_2 = FamilyType.ByFamilyAndName(family=byName_5, name=code_block_66)
setParameterByName_3 = Element.SetParameterByName(element=code_block_63, parameterName=code_block_64, value=byFamilyAndName_2)

flatten_3 = List.Flatten(list=setParameterByName)
uniqueItems_3 = List.UniqueItems(list=flatten_3)
all_elements_in_view_s = Custom[All Elements In View(s)](Views=uniqueItems_3)  # package Data-Shapes; Retrieves all visible element in a view or a set of views
code_block_67 = CodeBlock { "View Name"; }
exists = Orchid.RevitProject.Parameters.Parameter.Exists(parameterName=code_block_67, element=all_elements_in_view_s)
filterByBoolMask_3 = List.FilterByBoolMask(list=all_elements_in_view_s, mask=exists)
code_block_68 = CodeBlock { "Type"; }
getParameterValueByName_3 = Element.GetParameterValueByName(element=filterByBoolMask_3.in, parameterName=code_block_68)
name_2 = Orchid.RevitProject.Elements.ElementType.Name(elementType=getParameterValueByName_3)
code_block_69 = CodeBlock { "Building Section (03_VH)"; }
eq_4 = name_2 == code_block_69
filterByBoolMask_4 = List.FilterByBoolMask(list=filterByBoolMask_3.in, mask=eq_4)
hideElements = archilab.Revit.Views.Views.HideElements(view=uniqueItems_3, elements=filterByBoolMask_4.in)
code_block_70 = CodeBlock { null; }
replaceEmptyLists_3 = Custom[List.ReplaceEmptyLists](seq=hideElements, Replacement=code_block_70)
end_2 = Revit.Transaction.Transaction.End(input=replaceEmptyLists_3)
code_block_71 = CodeBlock(x=end_2)
# ---------- code_block_71.designscript (13 lines) ----------
x;

[Imperative]
{
	if(x == null)
	{
		return = [];
	}
	else
	{
		return = "Section";
	}
};
# ----------------------------------------
getByType = archilab.Revit.Views.Views.GetByType(viewType=code_block_71.out1)
all_elements_in_view_s_2 = Custom[All Elements In View(s)](Views=getByType)
code_block_72 = CodeBlock { "View Name"; }
exists_2 = Orchid.RevitProject.Parameters.Parameter.Exists(parameterName=code_block_72, element=all_elements_in_view_s_2)
filterByBoolMask_5 = List.FilterByBoolMask(list=all_elements_in_view_s_2, mask=exists_2)
hideElements_2 = archilab.Revit.Views.Views.HideElements(view=getByType, elements=filterByBoolMask_5.in)

# group: Cota Parcial entre EJes
code_block_73 = CodeBlock { null; }
replaceEmptyLists_4 = Custom[List.ReplaceEmptyLists](seq=code_block_40, Replacement=code_block_73)
code_block_74 = CodeBlock(x=replaceEmptyLists_4)  # same code as code_block_11
code_block_75 = CodeBlock(x=code_block_74.out1) { x[0]; }
code_block_76 = CodeBlock { "Grids"; }
byName_6 = Category.ByName(name=code_block_76)
code_block_77 = CodeBlock(x=code_block_74.out1) { x[0]; }
all_elements_of_category_in_view_2 = ElementsOfCategoryInView(Category=byName_6, View=code_block_77)
getCropBox = Orchid.RevitProject.Views.View.GetCropBox(view=code_block_77)
code_block_78 = CodeBlock { null; }
replaceEmptyLists_5 = Custom[List.ReplaceEmptyLists](seq=getCropBox.Curve, Replacement=code_block_78)
code_block_79 = CodeBlock(x=replaceEmptyLists_5)
# ---------- code_block_79.designscript (13 lines) ----------
x;

[Imperative]
{
	if(x == null)
	{
		return = [[],[],[],[]];
	}
	else
	{
		return = x;
	}
};
# ----------------------------------------
code_block_80 = CodeBlock(x=code_block_79.out1) { x[3]; }
ZAxis_2 = Vector.ZAxis()
code_block_81 = CodeBlock { ["50","75"]; [700,1050]; }
byKeysValues = DesignScript.Builtin.Dictionary.ByKeysValues(keys=code_block_81.out0, values=code_block_81.out1)
code_block_82 = CodeBlock(x=code_block_74.out1) { x[0]; }
scale = Custom[View.Scale](view=code_block_82)  # package Clockwork for Dynamo 2.x; Returns the scale of a given view
string_from_object = FromObject(obj=scale)
valueAtKey = DesignScript.Builtin.Dictionary.ValueAtKey(dictionary=byKeysValues, key=string_from_object)
translate_3 = Geometry.Translate(geometry=code_block_80, direction=ZAxis_2, distance=valueAtKey)
byElements = Dimension.ByElements(view=code_block_75, referenceElements=all_elements_of_category_in_view_2, line=translate_3)

# group: Breaklines
code_block_83 = CodeBlock { null; }
replaceEmptyLists_6 = Custom[List.ReplaceEmptyLists](seq=code_block_40, Replacement=code_block_83)
code_block_84 = CodeBlock(x=replaceEmptyLists_6)  # same code as code_block_11
code_block_85 = CodeBlock(x=code_block_84.out1) { x[0]; }
plane_3 = Custom[View.Plane](view=code_block_85)
normal_3 = Plane.Normal(plane=plane_3)
X = Vector.X(vector=normal_3)
byJoinedCurves_2 = PolyCurve.ByJoinedCurves()  # unwired: curves
code_block_86 = CodeBlock(x=code_block_84.out1) { x[0]; }
getCropBox_2 = Orchid.RevitProject.Views.View.GetCropBox(view=code_block_86)
function_apply_5 = ApplyFunction(func=byJoinedCurves_2, arg1=getCropBox_2.Curve)
code_block_87 = CodeBlock(x=function_apply_5)  # same code as code_block_22
code_block_88 = CodeBlock { -290; false; }
offset_2 = PolyCurve.Offset(polyCurve=code_block_87.out1, signedDistance=code_block_88.out0, extendCircular=code_block_88.out1)
byPatch = Surface.ByPatch(closedCurve=offset_2)
code_block_89 = CodeBlock { 0.5; }
normalAtParameter = Surface.NormalAtParameter(surface=byPatch, u=code_block_89, v=code_block_89)
X_2 = Vector.X(vector=normalAtParameter)
eq_5 = X == X_2
byLoft_2 = Surface.ByLoft()  # unwired: crossSections
translate_4 = Geometry.Translate(lacing=Longest)  # unwired: geometry, direction, distance
plane_4 = Custom[View.Plane](view=code_block_86)
normal_4 = Plane.Normal(plane=plane_4)
reverse_4 = Vector.Reverse(vector=normal_4)
list_create_3 = List.Create(item0=normal_4, item1=reverse_4)
code_block_90 = CodeBlock { 1000; }
function_apply_6 = ApplyFunction(func=translate_4, arg1=offset_2, arg2=list_create_3, arg3=code_block_90)
function_apply_7 = ApplyFunction(func=byLoft_2, arg1=function_apply_6)
byUnion = Solid.ByUnion()  # unwired: solids
code_block_91 = CodeBlock()
# ---------- code_block_91.designscript (6 lines) ----------
[
"Walls",
"Structural Columns",
"Structural Framing",
"Floors"
];
# ----------------------------------------
byName_7 = Category.ByName(name=code_block_91)
all_elements_of_category_in_view_3 = ElementsOfCategoryInView(Category=byName_7, View=code_block_86)
geometry = Element.Geometry(element=all_elements_of_category_in_view_3)
flatten_4 = List.Flatten(list=geometry)
function_apply_8 = ApplyFunction(func=byUnion, arg1=flatten_4)
code_block_92 = CodeBlock(x=function_apply_8)  # same code as code_block_22
intersect = Geometry.Intersect(geometry=function_apply_7, other=code_block_92.out1)
code_block_93 = CodeBlock { [0.5,0.5]; [0,1]; }
pointAtParameter_2 = Surface.PointAtParameter(surface=intersect@L1, u=code_block_93.out1@L2, v=code_block_93.out0@L2, lacing=Longest)
transpose_3 = List.Transpose(lists=pointAtParameter_2)
code_block_94 = CodeBlock { null; }
replaceEmptyLists_7 = Custom[List.ReplaceEmptyLists](seq=transpose_3, Replacement=code_block_94)
code_block_95 = CodeBlock(x=replaceEmptyLists_7)  # same code as code_block_11
code_block_96 = CodeBlock(x=code_block_95.out1) { x[0]; x[1]; }
byStartPointEndPoint = Line.ByStartPointEndPoint(startPoint=code_block_96.out0, endPoint=code_block_96.out1)
reverse_5 = Curve.Reverse(curve=byStartPointEndPoint)
scopeIf_4 = Custom[ScopeIf+](test=eq_5, True=byStartPointEndPoint, False=reverse_5)
code_block_97 = CodeBlock(x=code_block_84.out1) { x[0]; }
plane_5 = Custom[View.Plane](view=code_block_97)
pullOntoPlane = Curve.PullOntoPlane(curve=scopeIf_4, plane=plane_5)
code_block_98 = CodeBlock { "EST_D_BREAKLINE"; }
byName_8 = FamilyType.ByName(name=code_block_98)
byCurve = Custom[DetailComponent.ByCurve](curve=pullOntoPlane, familyType=byName_8, view=code_block_97, lacing=Longest)  # package Clockwork for Dynamo 2.x; Places a line-based detail component in a given view
code_block_99 = CodeBlock { "Length of masking region"; 900; }
setParameterByName_4 = Element.SetParameterByName(element=byCurve, parameterName=code_block_99.out0, value=code_block_99.out1)
