# Dynamo graph elevacionEje_script.dyn (Dynamo 2.3.2.15696)
# packages: Data-Shapes 2021.2.94, Orchid 200.4.0.7938, Clockwork for Dynamo 2.x 2.4.0, archi-lab.net 2022.210.2419, Genius Loci 2021.11.10, Crumple 2022.2.13, Rhythm 2020.7.25

hideElements = archilab.Revit.Views.Views.HideElements()  # unwired: view, elements
code_block = CodeBlock { "Elevación por Eje"; }
code_block_2 = CodeBlock()
# ---------- code_block_2.designscript (9 lines) ----------
//buttonText
"INICIAR";
//buttonCancel
"CANCELAR";
//maxHeight
850;
//width
440;
//label
# ----------------------------------------
code_block_3 = CodeBlock { "(Categoria MA)"; }
code_block_4 = CodeBlock { "Escala:"; }
code_block_5 = CodeBlock()
# ---------- code_block_5.designscript (6 lines) ----------
[
"1:50",
"1:75",
"1:100",
"1:125"
];
# ----------------------------------------
code_block_6 = CodeBlock { ":"; }
split = String.Split(str=code_block_5, separator0=code_block_6)
code_block_7 = CodeBlock { 1; }
getItemAtIndex = List.GetItemAtIndex(list=split@L2, index=code_block_7)
toNumber = String.ToNumber(str=getItemAtIndex)
code_block_8 = CodeBlock { 0; false; }
dropdown_data = Custom[DropDown Data](InputName=code_block_4, Keys=code_block_5, Values=toNumber, DefaultValueIndex=code_block_8.out0, Sorted_optional=code_block_8.out1)  # package Data-Shapes; Create data for DropDown input in UI.MultiInputForm ++ . Check out www.data-shapes.net for more infos.
code_block_9 = CodeBlock { "Grids"; }
byName = Category.ByName(name=code_block_9)
all_elements_of_category = ElementsOfCategory(Category=byName)
code_block_10 = CodeBlock(g=all_elements_of_category) { "ELEVACIÓN EJE "+Revit.Elements.Element.Name(g); }
code_block_11 = CodeBlock { "Building Section (02_MA)"; }
byName_2 = Orchid.RevitProject.Views.ViewType.ByName(name=code_block_11)
byType = Orchid.RevitProject.Views.View.ByType(viewType=byName_2)
code_block_12 = CodeBlock { "Subclasificacion"; }
getParameterValueByName = Element.GetParameterValueByName(element=byType, parameterName=code_block_12)
code_block_13 = CodeBlock { "02_MA"; }
eq = getParameterValueByName == code_block_13
filterByBoolMask = List.FilterByBoolMask(list=byType, mask=eq)
code_block_14 = CodeBlock { "Title on Sheet"; }
getParameterValueByName_2 = Element.GetParameterValueByName(element=filterByBoolMask.in, parameterName=code_block_14)
code_block_15 = CodeBlock { null; }
replaceEmptyLists = Custom[List.ReplaceEmptyLists](seq=getParameterValueByName_2, Replacement=code_block_15)  # package Clockwork for Dynamo 2.x; Replaces all empty lists within a given list with a substitute
eq_2 = code_block_10@L1 == replaceEmptyLists@L2  # lacing=Longest
anyTrue = Orchid.Common.List.AnyTrue(list=eq_2)
filterByBoolMask_2 = List.FilterByBoolMask(list=all_elements_of_category, mask=anyTrue)
code_block_16 = CodeBlock(g=filterByBoolMask_2.out) { "ELEVACIÓN EJE "+Revit.Elements.Element.Name(g); }
radiobuttons_data = Custom[RadioButtons Data](Keys=code_block_16, Values=filterByBoolMask_2.out)  # package Data-Shapes; Create radio buttons input for UI.MultipleInputForm ++ .
list_create = List.Create(item0=dropdown_data, item1=radiobuttons_data)
inputgroup_data = Custom[InputGroup Data](GroupTitle=code_block_3, Inputs=list_create)  # package Data-Shapes; Creates a group of inputs for UI.MultipleInputForm ++ . Check out www.data-shapes.net for more infos !
boolean = BoolSelector(true)
multipleinputform = Custom[MultipleInputForm ++](Description_optional=code_block, ButtonText_optional=code_block_2.out0, Inputs=inputgroup_data, Toggle=boolean, CancelButtonText_optional=code_block_2.out1, MaxHeight_optional=code_block_2.out2, Width_optional=code_block_2.out3)  # package Data-Shapes; Create a form with multiple inputs. see www.data-shapes.net for tutorials and infos!
code_block_17 = CodeBlock(x=multipleinputform.User_Inputs)
# ---------- code_block_17.designscript (13 lines) ----------
x;

[Imperative]
{
	if(x == null)
	{
		return = [[],[]];
	}
	else
	{
		return = x;
	}
};
# ----------------------------------------
code_block_18 = CodeBlock(l=code_block_17.out1) { l[1]; }
curve = Grid.Curve(grid=code_block_18)
direction = Line.Direction(line=curve)
normalized = Vector.Normalized(vector=direction)
code_block_19 = CodeBlock(p=normalized) { p.X; }
code_block_20 = CodeBlock { 2; }
round = Math.Round(number=code_block_19, digits=code_block_20)
code_block_21 = CodeBlock { 0; }
le = round <= code_block_21
reverse = Curve.Reverse(curve=curve)
scopeIf = Custom[ScopeIf+](test=le, True=reverse, False=curve, lacing=Shortest)  # package Clockwork for Dynamo 2.x; A (hopefully) more robust implementation of ScopeIf. Tests a single boolean and returns a value accordingly.
code_block_22 = CodeBlock(x=scopeIf) { x; }
direction_2 = Line.Direction(line=code_block_22)
code_block_23 = CodeBlock(x=direction_2) { x.X; }
code_block_24 = CodeBlock { 0; }
ge = code_block_23 >= code_block_24
reverse_2 = Curve.Reverse(curve=code_block_22)
scopeIf_2 = Custom[ScopeIf+](test=ge, True=reverse_2, False=code_block_22, lacing=Shortest)
direction_3 = Line.Direction(line=scopeIf_2)
normalized_2 = Vector.Normalized(vector=direction_3)
code_block_25 = CodeBlock(x=normalized_2) { x.X; }
code_block_26 = CodeBlock { 0; }
eq_3 = code_block_25 == code_block_26
code_block_27 = CodeBlock(x=normalized_2) { x.Y; }
code_block_28 = CodeBlock { 0; }
gt = code_block_27 > code_block_28
and_ = eq_3 && gt
reverse_3 = Curve.Reverse(curve=scopeIf_2)
scopeIf_3 = Custom[ScopeIf+](test=and_, True=reverse_3, False=scopeIf_2, lacing=Shortest)
code_block_29 = CodeBlock { "Levels"; }
byName_3 = Category.ByName(name=code_block_29)
all_elements_of_category_2 = ElementsOfCategory(Category=byName_3)
elevation = Level.Elevation(level=all_elements_of_category_2)
minimumItem = List.MinimumItem(list=elevation)
eq_4 = elevation == minimumItem
filterByBoolMask_3 = List.FilterByBoolMask(list=all_elements_of_category_2, mask=eq_4)
plane = Custom[Level.Plane](level=filterByBoolMask_3.in)  # package Clockwork for Dynamo 2.x; Retrieves the plane of a given level
pullOntoPlane = Curve.PullOntoPlane(curve=scopeIf_3, plane=plane, lacing=Longest)
ZAxis = Vector.ZAxis()
code_block_30 = CodeBlock { -3000; }
translate = Geometry.Translate(geometry=pullOntoPlane, direction=ZAxis, distance=code_block_30, lacing=Longest)
code_block_31 = CodeBlock { "Building Section (02_MA)"; }
byName_4 = Orchid.RevitProject.Views.ViewType.ByName(name=code_block_31)
code_block_32 = CodeBlock { 0.5; }
pointAtParameter = Curve.PointAtParameter(curve=translate, param=code_block_32)
code_block_33 = CodeBlock { "Levels"; }
byName_5 = Category.ByName(name=code_block_33)
all_elements_of_category_3 = ElementsOfCategory(Category=byName_5)
elevation_2 = Level.Elevation(level=all_elements_of_category_3)
maximumItem = List.MaximumItem(list=elevation_2)
eq_5 = elevation_2 == maximumItem
filterByBoolMask_4 = List.FilterByBoolMask(list=all_elements_of_category_3, mask=eq_5)
plane_2 = Custom[Level.Plane](level=filterByBoolMask_4.in)
pullOntoPlane_2 = Curve.PullOntoPlane(curve=scopeIf_3, plane=plane_2, lacing=Longest)
ZAxis_2 = Vector.ZAxis()
code_block_34 = CodeBlock { 3000; }
translate_2 = Geometry.Translate(geometry=pullOntoPlane_2, direction=ZAxis_2, distance=code_block_34, lacing=Longest)
code_block_35 = CodeBlock { 0.5; }
pointAtParameter_2 = Curve.PointAtParameter(curve=translate_2, param=code_block_35)
distanceTo = Geometry.DistanceTo(geometry=pointAtParameter, other=pointAtParameter_2)
code_block_36 = CodeBlock { null; }
replaceEmptyLists_2 = Custom[List.ReplaceEmptyLists](seq=distanceTo, Replacement=code_block_36)
code_block_37 = CodeBlock(x=replaceEmptyLists_2)
# ---------- code_block_37.designscript (12 lines) ----------
x;
[Imperative]
{
	if(x == null)
	{
		return = [[]];
	}
	else
	{
		return = x;
	}
};
# ----------------------------------------
code_block_38 = CodeBlock(h=code_block_37.out1)
# ---------- code_block_38.designscript (6 lines) ----------
//height
h[0];
//offset
300;
//depth
300;
# ----------------------------------------
byLine = Custom[ViewSection.ByLine](Curves=translate, ViewFamilyType=byName_4, ViewSectionHeight=code_block_38.out0, OffsetFromLine=code_block_38.out1, Depth=code_block_38.out2)  # package Data-Shapes; Create ViewSections in current document from DS Lines.
code_block_39 = CodeBlock(g=code_block_18) { "View Name"; "MA_ELEVACION EJE "+Revit.Elements.Element.Name(g); }
setParameterByName = Element.SetParameterByName(element=byLine, parameterName=code_block_39.out0, value=code_block_39.out1, lacing=Longest)
code_block_40 = CodeBlock(g=code_block_18) { "Title on Sheet"; "ELEVACIÓN EJE "+Revit.Elements.Element.Name(g); }
setParameterByName_2 = Element.SetParameterByName(element=setParameterByName, parameterName=code_block_40.out0, value=code_block_40.out1, lacing=Longest)
code_block_41 = CodeBlock(l=code_block_17.out1) { l[0]; }
setScale = View.SetScale(view=setParameterByName_2, scale=code_block_41, lacing=Longest)
code_block_42 = CodeBlock()
# ---------- code_block_42.designscript (5 lines) ----------
[
"Crop View",
"Crop Region Visible"
];
[1,0];
# ----------------------------------------
setParameterByName_3 = Element.SetParameterByName(element=setScale@L1, parameterName=code_block_42.out0@L2, value=code_block_42.out1@L2, lacing=Longest)
flatten = List.Flatten(list=setParameterByName_3)
uniqueItems = List.UniqueItems(list=flatten)
all_elements_in_view_s = Custom[All Elements In View(s)](Views=uniqueItems)  # package Data-Shapes; Retrieves all visible element in a view or a set of views
code_block_43 = CodeBlock { "View Name"; }
exists = Orchid.RevitProject.Parameters.Parameter.Exists(parameterName=code_block_43, element=all_elements_in_view_s)
filterByBoolMask_5 = List.FilterByBoolMask(list=all_elements_in_view_s, mask=exists)
code_block_44 = CodeBlock { "Type"; }
getParameterValueByName_3 = Element.GetParameterValueByName(element=filterByBoolMask_5.in, parameterName=code_block_44)
name = Orchid.RevitProject.Elements.ElementType.Name(elementType=getParameterValueByName_3)
code_block_45 = CodeBlock { "Building Section (02_MA)"; }
eq_6 = name == code_block_45
filterByBoolMask_6 = List.FilterByBoolMask(list=filterByBoolMask_5.in, mask=eq_6)
function_apply = ApplyFunction(func=hideElements, arg1=uniqueItems, arg2=filterByBoolMask_6.in)
code_block_46 = CodeBlock { null; }
replaceEmptyLists_3 = Custom[List.ReplaceEmptyLists](seq=function_apply, Replacement=code_block_46)
end = Revit.Transaction.Transaction.End(input=replaceEmptyLists_3)
code_block_47 = CodeBlock(x=end)
# ---------- code_block_47.designscript (13 lines) ----------
x;

[Imperative]
{
	if(x == null)
	{
		return = [];
	}
	else
	{
		return = "Section";
	}
};
# ----------------------------------------
getByType = archilab.Revit.Views.Views.GetByType(viewType=code_block_47.out1)
all_elements_in_view_s_2 = Custom[All Elements In View(s)](Views=getByType)
code_block_48 = CodeBlock { "View Name"; }
exists_2 = Orchid.RevitProject.Parameters.Parameter.Exists(parameterName=code_block_48, element=all_elements_in_view_s_2)
filterByBoolMask_7 = List.FilterByBoolMask(list=all_elements_in_view_s_2, mask=exists_2)
hideElements_2 = archilab.Revit.Views.Views.HideElements(view=getByType, elements=filterByBoolMask_7.in)
end_2 = Revit.Transaction.Transaction.End(input=uniqueItems)
start = Revit.Transaction.Transaction.Start(input=end_2)
code_block_49 = CodeBlock { null; }
replaceEmptyLists_4 = Custom[List.ReplaceEmptyLists](seq=start, Replacement=code_block_49)
code_block_50 = CodeBlock(x=replaceEmptyLists_4)
# ---------- code_block_50.designscript (12 lines) ----------
x;
[Imperative]
{
	if(x == null)
	{
		return = [];
	}
	else
	{
		return = x[0];
	}
};
# ----------------------------------------
code_block_51 = CodeBlock(x=code_block_50.out1) { x; }
byLoft = Surface.ByLoft()  # unwired: crossSections
getCropBox = Orchid.RevitProject.Views.View.GetCropBox(view=code_block_50.out1)
code_block_52 = CodeBlock { null; }
replaceEmptyLists_5 = Custom[List.ReplaceEmptyLists](seq=getCropBox.Curve, Replacement=code_block_52)
code_block_53 = CodeBlock(x=replaceEmptyLists_5)
# ---------- code_block_53.designscript (12 lines) ----------
x;
[Imperative]
{
	if(x == null)
	{
		return = [];
	}
	else
	{
		return = x[1];
	}
};
# ----------------------------------------
code_block_54 = CodeBlock()
# ---------- code_block_54.designscript (6 lines) ----------
[
"Structural Columns",
"Structural Framing",
"Floors",
"Walls"
];
# ----------------------------------------
byName_6 = Category.ByName(name=code_block_54)
all_elements_of_category_in_view = ElementsOfCategoryInView(Category=byName_6, View=code_block_50.out1)
flatten_2 = List.Flatten(list=all_elements_of_category_in_view)
element_level = Custom[Element Level](element=flatten_2)  # package Genius Loci; Gets an element's level. Based on a Clockwork's node
uniqueItems_2 = List.UniqueItems(list=element_level)
elevation_3 = Level.Elevation(level=uniqueItems_2)
maximumItem_2 = List.MaximumItem(list=elevation_3)
eq_7 = elevation_3 == maximumItem_2
filterByBoolMask_8 = List.FilterByBoolMask(list=uniqueItems_2, mask=eq_7)
plane_bylevel = Custom[Plane ByLevel](level=filterByBoolMask_8.in)  # package Genius Loci; Constructs a Plane from a level.
pullOntoPlane_3 = Curve.PullOntoPlane(curve=code_block_53.out1, plane=plane_bylevel)
ZAxis_3 = Vector.ZAxis()
code_block_55 = CodeBlock { 3000; }
translate_3 = Geometry.Translate(geometry=pullOntoPlane_3, direction=ZAxis_3, distance=code_block_55)
code_block_56 = CodeBlock(x=replaceEmptyLists_5)
# ---------- code_block_56.designscript (12 lines) ----------
x;
[Imperative]
{
	if(x == null)
	{
		return = [];
	}
	else
	{
		return = x[3];
	}
};
# ----------------------------------------
list_create_2 = List.Create(item0=translate_3, item1=code_block_56.out1)
flatten_3 = List.Flatten(list=list_create_2)
function_apply_2 = ApplyFunction(func=byLoft, arg1=flatten_3)
code_block_57 = CodeBlock(x=function_apply_2)
# ---------- code_block_57.designscript (12 lines) ----------
x;
[Imperative]
{
	if(x == null)
	{
		return = [];
	}
	else
	{
		return = x;
	}
};
# ----------------------------------------
perimeterCurves = Surface.PerimeterCurves(surface=code_block_57.out1)
setCropBox = Orchid.RevitProject.Views.View.SetCropBox(view=code_block_51, curve=perimeterCurves)
code_block_58 = CodeBlock { null; }
replaceEmptyLists_6 = Custom[List.ReplaceEmptyLists](seq=setCropBox, Replacement=code_block_58)
code_block_59 = CodeBlock(x=replaceEmptyLists_6)  # same code as code_block_57
code_block_60 = CodeBlock(x=code_block_59.out1) { x; x; }

# group: Etiqueta Vigas Hormigon
code_block_61 = CodeBlock(x=code_block_60.out1) { x; }
code_block_62 = CodeBlock(x=code_block_61) { x; }
code_block_63 = CodeBlock { "Structural Framing"; }
byName_7 = Category.ByName(name=code_block_63)
all_elements_of_category_in_view_2 = ElementsOfCategoryInView(Category=byName_7, View=code_block_62)
familyName = Orchid.RevitProject.Elements.Element.FamilyName(element=all_elements_of_category_in_view_2)
code_block_64 = CodeBlock()
# ---------- code_block_64.designscript (6 lines) ----------
[
"EST_M_STRUCTURAL FRAMING_VIGA INVERTIDA",
"EST_M_STRUCTURAL FRAMING_VIGA SEMI INVERTIDA",
"EST_M_STRUCTURAL FRAMING_VIGA TRADICIONAL",
"EST_M_STRUCTURAL FRAMING_VIGA FUNDACION"
];
# ----------------------------------------
eq_8 = familyName@L1 == code_block_64
anyTrue_2 = Orchid.Common.List.AnyTrue(list=eq_8)
filterByBoolMask_9 = List.FilterByBoolMask(list=all_elements_of_category_in_view_2, mask=anyTrue_2)
location = Custom[Element.Location+](element=filterByBoolMask_9.in)  # package Clockwork for Dynamo 2.x; Returns the location of an element as point, curve or curve loop, along with some booleans to help filtering the results. Unlike the OOTB Element.GetLocation node, it also retunrs sketch lines of sketch-based elements like floor slabs as well as the element's rotation property.
code_block_65 = CodeBlock(x=location.curves)  # same code as code_block_57
direction_4 = Line.Direction(line=code_block_65.out1)
code_block_66 = CodeBlock(x=code_block_61) { x; }
plane_3 = Custom[View.Plane](view=code_block_66)  # package Clockwork for Dynamo 2.x; Retrieves the plane of a given view
isParallelToPlane = Custom[Vector.IsParallelToPlane](vector=direction_4, plane=plane_3)  # package Clockwork for Dynamo 2.x; Checks if a given vector is parallel to a given plane
filterByBoolMask_10 = List.FilterByBoolMask(list=filterByBoolMask_9.in, mask=isParallelToPlane)
element_taggedstatus = Custom[Element TaggedStatus](element=filterByBoolMask_10.in)  # package Genius Loci; Identify the tagged and untagged elements. Please note : This doesn't work with areas and spaces.
elementcentroid = Custom[© ElementCentroid](element=element_taggedstatus.NotTagged)  # package Crumple; Returns the centroid of the element's axis-aligned bounding box.
location_2 = Custom[Element.Location+](element=element_taggedstatus.NotTagged)
code_block_67 = CodeBlock(x=location_2.curves)  # same code as code_block_57
code_block_68 = CodeBlock { 0.5; }
planeAtParameter = Curve.PlaneAtParameter(curve=code_block_67.out1, param=code_block_68)
code_block_69 = CodeBlock { 0.5; }
pointAtParameter_3 = Curve.PointAtParameter(curve=code_block_67.out1, param=code_block_69)
plane_4 = Custom[View.Plane](view=code_block_66)
normal = Plane.Normal(plane=plane_4)
code_block_70 = CodeBlock { 90; }
rotate = Geometry.Rotate(geometry=planeAtParameter, origin=pointAtParameter_3, axis=normal, degrees=code_block_70)
normal_2 = Plane.Normal(plane=rotate)
code_block_71 = CodeBlock(z=normal_2) { z.Z; }
code_block_72 = CodeBlock { 0; }
gt_2 = code_block_71 > code_block_72
code_block_73 = CodeBlock { -1; }
ne = code_block_71 != code_block_73
and_2 = gt_2 && ne
reverse_4 = Vector.Reverse(vector=normal_2)
scopeIf_4 = Custom[ScopeIf+](test=and_2, True=normal_2, False=reverse_4, lacing=Shortest)
code_block_74 = CodeBlock(x=element_taggedstatus.NotTagged) { Revit.Elements.Element.GetParameterValueByName(Revit.Elements.Element.GetParameterValueByName(x,"Type"),"Height")/2; }
translate_4 = Geometry.Translate(geometry=elementcentroid, direction=scopeIf_4, distance=code_block_74)
list_create_3 = List.Create(item0=elementcentroid, item1=translate_4)
transpose = List.Transpose(lists=list_create_3)
byElementAndLocation = Tag.ByElementAndLocation(view=code_block_62@L1, element=element_taggedstatus.NotTagged@L1, location=transpose@L2, lacing=Longest)
transpose_2 = List.Transpose(lists=byElementAndLocation)
code_block_75 = CodeBlock { null; }
replaceEmptyLists_7 = Custom[List.ReplaceEmptyLists](seq=transpose_2, Replacement=code_block_75)
code_block_76 = CodeBlock(x=replaceEmptyLists_7)
# ---------- code_block_76.designscript (12 lines) ----------
x;
[Imperative]
{
	if(x == null)
	{
		return = [[],[]];
	}
	else
	{
		return = x;
	}
};
# ----------------------------------------
code_block_77 = CodeBlock(x=code_block_76.out1) { x[1]; }
code_block_78 = CodeBlock { "Type"; }
code_block_79 = CodeBlock { "EST_A_STRUCTURAL FRAMING TAG_ELEVACION"; }
byName_8 = Orchid.RevitProject.Elements.Family.ByName(name=code_block_79)
code_block_80 = CodeBlock { "Tag Viga"; }
byFamilyAndName = FamilyType.ByFamilyAndName(family=byName_8, name=code_block_80)
setParameterByName_4 = Element.SetParameterByName(element=code_block_77, parameterName=code_block_78, value=byFamilyAndName)
code_block_81 = CodeBlock(x=code_block_76.out1) { x[0]; }
code_block_82 = CodeBlock { "Type"; }
code_block_83 = CodeBlock { "EST_A_STRUCTURAL FRAMING TAG_ELEVACION_ESTRIBO Y LATERAL"; }
byName_9 = Orchid.RevitProject.Elements.Family.ByName(name=code_block_83)
code_block_84 = CodeBlock { "Estribo Simple y Laterales"; }
byFamilyAndName_2 = FamilyType.ByFamilyAndName(family=byName_9, name=code_block_84)
setParameterByName_5 = Element.SetParameterByName(element=code_block_81, parameterName=code_block_82, value=byFamilyAndName_2)

# group: Etiqueta Muros
code_block_85 = CodeBlock(x=code_block_60.out1) { x; }
code_block_86 = CodeBlock(x=code_block_85) { x; }
code_block_87 = CodeBlock { "Walls"; }
byName_10 = Category.ByName(name=code_block_87)
all_elements_of_category_in_view_3 = ElementsOfCategoryInView(Category=byName_10, View=code_block_86)
wallType = archilab.Revit.Elements.Walls.WallType(wall=all_elements_of_category_in_view_3)
kind = Orchid.RevitProject.Elements.WallType.Kind(wallType=wallType)
code_block_88 = CodeBlock { "Basic"; }
eq_9 = kind == code_block_88
filterByBoolMask_11 = List.FilterByBoolMask(list=all_elements_of_category_in_view_3, mask=eq_9)
name_2 = Material.Name()  # unwired: material
getMaterials = Element.GetMaterials(element=filterByBoolMask_11.in)
flatten_4 = List.Flatten(list=getMaterials)
function_apply_3 = ApplyFunction(func=name_2, arg1=flatten_4)
code_block_89 = CodeBlock { "Concrete, Cast-in-Place gray"; }
eq_10 = function_apply_3 == code_block_89
filterByBoolMask_12 = List.FilterByBoolMask(list=filterByBoolMask_11.in, mask=eq_10)
location_3 = Custom[Element.Location+](element=filterByBoolMask_12.in)
code_block_90 = CodeBlock(x=location_3.curves)  # same code as code_block_57
direction_5 = Line.Direction(line=code_block_90.out1)
code_block_91 = CodeBlock(x=code_block_85) { x; }
plane_5 = Custom[View.Plane](view=code_block_91)
isParallelToPlane_2 = Custom[Vector.IsParallelToPlane](vector=direction_5, plane=plane_5)
filterByBoolMask_13 = List.FilterByBoolMask(list=filterByBoolMask_12.in, mask=isParallelToPlane_2)
element_taggedstatus_2 = Custom[Element TaggedStatus](element=filterByBoolMask_13.in)
elementcentroid_2 = Custom[© ElementCentroid](element=element_taggedstatus_2.NotTagged)
byElementAndLocation_2 = Tag.ByElementAndLocation(view=code_block_86, element=element_taggedstatus_2.NotTagged, location=elementcentroid_2)
code_block_92 = CodeBlock { "Type"; }
code_block_93 = CodeBlock { "EST_A_WALL TAG_ELEVACION_MHA"; }
byName_11 = Orchid.RevitProject.Elements.Family.ByName(name=code_block_93)
code_block_94 = CodeBlock { "Doble Malla"; }
byFamilyAndName_3 = FamilyType.ByFamilyAndName(family=byName_11, name=code_block_94)
setParameterByName_6 = Element.SetParameterByName(element=byElementAndLocation_2, parameterName=code_block_92, value=byFamilyAndName_3)

# group: Columnas Metalicas Rectangulares
code_block_95 = CodeBlock(x=code_block_60.out1) { x; }
code_block_96 = CodeBlock(x=code_block_95) { x; }
code_block_97 = CodeBlock { "Structural Columns"; }
byName_12 = Category.ByName(name=code_block_97)
all_elements_of_category_in_view_4 = ElementsOfCategoryInView(Category=byName_12, View=code_block_96)
familyName_2 = Orchid.RevitProject.Elements.Element.FamilyName(element=all_elements_of_category_in_view_4)
code_block_98 = CodeBlock()
# ---------- code_block_98.designscript (11 lines) ----------
[
"EST_M_STRUCTURAL COLUMN_SOLDADA_IN",
"EST_M_STRUCTURAL COLUMN_LAMINADA_L",
"EST_M_STRUCTURAL COLUMN_PLEGADA_C",
"EST_M_STRUCTURAL COLUMN_PLEGADA_CA",
"EST_M_STRUCTURAL COLUMN_PLEGADA_HSS",
"EST_M_STRUCTURAL COLUMN_PLEGADA_IC",
"EST_M_STRUCTURAL COLUMN_PLEGADA_L",
"EST_M_STRUCTURAL COLUMN_SOLDADA_HN",
"EST_M_STRUCTURAL COLUMN_SOLDADA_T"
];
# ----------------------------------------
eq_11 = familyName_2@L1 == code_block_98
anyTrue_3 = Orchid.Common.List.AnyTrue(list=eq_11)
filterByBoolMask_14 = List.FilterByBoolMask(list=all_elements_of_category_in_view_4, mask=anyTrue_3)
name_3 = Material.Name()  # unwired: material
getMaterials_2 = Element.GetMaterials(element=filterByBoolMask_14.in)
flatten_5 = List.Flatten(list=getMaterials_2)
function_apply_4 = ApplyFunction(func=name_3, arg1=flatten_5)
code_block_99 = CodeBlock { "Steel"; }
eq_12 = function_apply_4 == code_block_99
filterByBoolMask_15 = List.FilterByBoolMask(list=filterByBoolMask_14.in, mask=eq_12)
element_taggedstatus_3 = Custom[Element TaggedStatus](element=filterByBoolMask_15.in)
code_block_100 = CodeBlock { "Column Style"; 1; }
setParameterByName_7 = Element.SetParameterByName(element=element_taggedstatus_3.NotTagged, parameterName=code_block_100.out0, value=code_block_100.out1)
location_4 = Custom[Element.Location+](element=setParameterByName_7)
code_block_101 = CodeBlock(x=location_4.curves)  # same code as code_block_57
await_ = Orchid.Common.DataStream.Await(pass=setParameterByName_7, waitFor=code_block_101.out1)
elementcentroid_3 = Custom[© ElementCentroid](element=await_)
code_block_102 = CodeBlock { 0.5; }
planeAtParameter_2 = Curve.PlaneAtParameter(curve=code_block_101.out1, param=code_block_102)
code_block_103 = CodeBlock { 0.5; }
pointAtParameter_4 = Curve.PointAtParameter(curve=code_block_101.out1, param=code_block_103)
code_block_104 = CodeBlock(x=code_block_95) { x; }
plane_6 = Custom[View.Plane](view=code_block_104)
normal_3 = Plane.Normal(plane=plane_6)
code_block_105 = CodeBlock { 90; }
rotate_2 = Geometry.Rotate(geometry=planeAtParameter_2, origin=pointAtParameter_4, axis=normal_3, degrees=code_block_105)
normal_4 = Plane.Normal(plane=rotate_2)
code_block_106 = CodeBlock(z=normal_4) { z.Z; }
code_block_107 = CodeBlock { 0; }
gt_3 = code_block_106 > code_block_107
code_block_108 = CodeBlock { -1; }
ne_2 = code_block_106 != code_block_108
and_3 = gt_3 && ne_2
reverse_5 = Vector.Reverse(vector=normal_4)
scopeIf_5 = Custom[ScopeIf+](test=and_3, True=normal_4, False=reverse_5, lacing=Shortest)
code_block_109 = CodeBlock(x=await_) { Revit.Elements.Element.GetParameterValueByName(Revit.Elements.Element.GetParameterValueByName(x,"Type"),"Width")/2; }
translate_5 = Geometry.Translate(geometry=elementcentroid_3, direction=scopeIf_5, distance=code_block_109)
code_block_110 = CodeBlock()
# ---------- code_block_110.designscript (2 lines) ----------
//horizontal
false;
# ----------------------------------------
byElementAndLocation_3 = Tag.ByElementAndLocation(view=code_block_96, element=await_, location=translate_5, horizontal=code_block_110)
code_block_111 = CodeBlock { "Type"; }
code_block_112 = CodeBlock { "EST_A_STRUCTURAL COLUMN TAG_ELEVACION_DIMENSIONES"; }
byName_13 = Orchid.RevitProject.Elements.Family.ByName(name=code_block_112)
code_block_113 = CodeBlock { "Pilar Hormigon"; }
byFamilyAndName_4 = FamilyType.ByFamilyAndName(family=byName_13, name=code_block_113)
setParameterByName_8 = Element.SetParameterByName(element=byElementAndLocation_3, parameterName=code_block_111, value=byFamilyAndName_4)
code_block_114 = CodeBlock { "Column Style"; 0; }
setParameterByName_9 = Element.SetParameterByName(element=await_, parameterName=code_block_114.out0, value=code_block_114.out1)

# group: Etiqueta Columna Rectangular hormigon
code_block_115 = CodeBlock { "Structural Columns"; }
byName_14 = Category.ByName(name=code_block_115)
code_block_116 = CodeBlock(x=code_block_60.out1) { x; }
code_block_117 = CodeBlock(x=code_block_116) { x; }
all_elements_of_category_in_view_5 = ElementsOfCategoryInView(Category=byName_14, View=code_block_117)
familyName_3 = Orchid.RevitProject.Elements.Element.FamilyName(element=all_elements_of_category_in_view_5)
code_block_118 = CodeBlock { "EST_M_STRUCTURAL COLUMN_RECTANGULAR"; }
eq_13 = familyName_3 == code_block_118
filterByBoolMask_16 = List.FilterByBoolMask(list=all_elements_of_category_in_view_5, mask=eq_13)
name_4 = Material.Name()  # unwired: material
getMaterials_3 = Element.GetMaterials(element=filterByBoolMask_16.in)
flatten_6 = List.Flatten(list=getMaterials_3)
function_apply_5 = ApplyFunction(func=name_4, arg1=flatten_6)
code_block_119 = CodeBlock { "Concrete, Cast-in-Place gray"; }
eq_14 = function_apply_5 == code_block_119
filterByBoolMask_17 = List.FilterByBoolMask(list=filterByBoolMask_16.in, mask=eq_14)
element_taggedstatus_4 = Custom[Element TaggedStatus](element=filterByBoolMask_17.in)
code_block_120 = CodeBlock { "Column Style"; 1; }
setParameterByName_10 = Element.SetParameterByName(element=element_taggedstatus_4.NotTagged, parameterName=code_block_120.out0, value=code_block_120.out1)
location_5 = Custom[Element.Location+](element=setParameterByName_10)
code_block_121 = CodeBlock(x=location_5.curves)  # same code as code_block_57
await_2 = Orchid.Common.DataStream.Await(pass=setParameterByName_10, waitFor=code_block_121.out1)
code_block_122 = CodeBlock { "Column Style"; 0; }
setParameterByName_11 = Element.SetParameterByName(element=await_2, parameterName=code_block_122.out0, value=code_block_122.out1)
elementcentroid_4 = Custom[© ElementCentroid](element=await_2)
code_block_123 = CodeBlock { 0.5; }
planeAtParameter_3 = Curve.PlaneAtParameter(curve=code_block_121.out1, param=code_block_123)
code_block_124 = CodeBlock { 0.5; }
pointAtParameter_5 = Curve.PointAtParameter(curve=code_block_121.out1, param=code_block_124)
code_block_125 = CodeBlock(x=code_block_116) { x; }
plane_7 = Custom[View.Plane](view=code_block_125)
normal_5 = Plane.Normal(plane=plane_7)
code_block_126 = CodeBlock { 90; }
rotate_3 = Geometry.Rotate(geometry=planeAtParameter_3, origin=pointAtParameter_5, axis=normal_5, degrees=code_block_126)
normal_6 = Plane.Normal(plane=rotate_3)
code_block_127 = CodeBlock(z=normal_6) { z.Z; }
code_block_128 = CodeBlock { 0; }
gt_4 = code_block_127 > code_block_128
code_block_129 = CodeBlock { -1; }
ne_3 = code_block_127 != code_block_129
and_4 = gt_4 && ne_3
reverse_6 = Vector.Reverse(vector=normal_6)
scopeIf_6 = Custom[ScopeIf+](test=and_4, True=normal_6, False=reverse_6, lacing=Shortest)
code_block_130 = CodeBlock(x=await_2) { Revit.Elements.Element.GetParameterValueByName(Revit.Elements.Element.GetParameterValueByName(x,"Type"),"Width")/2; }
translate_6 = Geometry.Translate(geometry=elementcentroid_4, direction=scopeIf_6, distance=code_block_130)
code_block_131 = CodeBlock()  # same code as code_block_110
byElementAndLocation_4 = Tag.ByElementAndLocation(view=code_block_117, element=await_2, location=translate_6, horizontal=code_block_131)
code_block_132 = CodeBlock { "Type"; }
code_block_133 = CodeBlock { "EST_A_STRUCTURAL COLUMN TAG_ELEVACION_DIMENSIONES"; }
byName_15 = Orchid.RevitProject.Elements.Family.ByName(name=code_block_133)
code_block_134 = CodeBlock { "Pilar Hormigon"; }
byFamilyAndName_5 = FamilyType.ByFamilyAndName(family=byName_15, name=code_block_134)
setParameterByName_12 = Element.SetParameterByName(element=byElementAndLocation_4, parameterName=code_block_132, value=byFamilyAndName_5)

# group: Etiqueta Columna Circular Hormigon
code_block_135 = CodeBlock { "Structural Columns"; }
byName_16 = Category.ByName(name=code_block_135)
code_block_136 = CodeBlock(x=code_block_60.out1) { x; }
code_block_137 = CodeBlock(x=code_block_136) { x; }
all_elements_of_category_in_view_6 = ElementsOfCategoryInView(Category=byName_16, View=code_block_137)
familyName_4 = Orchid.RevitProject.Elements.Element.FamilyName(element=all_elements_of_category_in_view_6)
code_block_138 = CodeBlock { "EST_M_STRUCTURAL COLUMN_CIRCULAR"; }
eq_15 = familyName_4 == code_block_138
filterByBoolMask_18 = List.FilterByBoolMask(list=all_elements_of_category_in_view_6, mask=eq_15)
name_5 = Material.Name()  # unwired: material
getMaterials_4 = Element.GetMaterials(element=filterByBoolMask_18.in)
flatten_7 = List.Flatten(list=getMaterials_4)
function_apply_6 = ApplyFunction(func=name_5, arg1=flatten_7)
code_block_139 = CodeBlock { "Concrete, Cast-in-Place gray"; }
eq_16 = function_apply_6 == code_block_139
filterByBoolMask_19 = List.FilterByBoolMask(list=filterByBoolMask_18.in, mask=eq_16)
element_taggedstatus_5 = Custom[Element TaggedStatus](element=filterByBoolMask_19.in)
code_block_140 = CodeBlock { "Column Style"; 1; }
setParameterByName_13 = Element.SetParameterByName(element=element_taggedstatus_5.NotTagged, parameterName=code_block_140.out0, value=code_block_140.out1)
location_6 = Custom[Element.Location+](element=setParameterByName_13)
code_block_141 = CodeBlock(x=location_6.curves)  # same code as code_block_57
await_3 = Orchid.Common.DataStream.Await(pass=setParameterByName_13, waitFor=code_block_141.out1)
code_block_142 = CodeBlock { "Column Style"; 0; }
setParameterByName_14 = Element.SetParameterByName(element=await_3, parameterName=code_block_142.out0, value=code_block_142.out1)
elementcentroid_5 = Custom[© ElementCentroid](element=await_3)
code_block_143 = CodeBlock { 0.5; }
planeAtParameter_4 = Curve.PlaneAtParameter(curve=code_block_141.out1, param=code_block_143)
code_block_144 = CodeBlock { 0.5; }
pointAtParameter_6 = Curve.PointAtParameter(curve=code_block_141.out1, param=code_block_144)
code_block_145 = CodeBlock(x=code_block_136) { x; }
plane_8 = Custom[View.Plane](view=code_block_145)
normal_7 = Plane.Normal(plane=plane_8)
code_block_146 = CodeBlock { 90; }
rotate_4 = Geometry.Rotate(geometry=planeAtParameter_4, origin=pointAtParameter_6, axis=normal_7, degrees=code_block_146)
normal_8 = Plane.Normal(plane=rotate_4)
code_block_147 = CodeBlock(z=normal_8) { z.Z; }
code_block_148 = CodeBlock { 0; }
gt_5 = code_block_147 > code_block_148
code_block_149 = CodeBlock { -1; }
ne_4 = code_block_147 != code_block_149
and_5 = gt_5 && ne_4
reverse_7 = Vector.Reverse(vector=normal_8)
scopeIf_7 = Custom[ScopeIf+](test=and_5, True=normal_8, False=reverse_7, lacing=Shortest)
code_block_150 = CodeBlock(x=await_3) { Revit.Elements.Element.GetParameterValueByName(Revit.Elements.Element.GetParameterValueByName(x,"Type"),"Diameter")/2; }
translate_7 = Geometry.Translate(geometry=elementcentroid_5, direction=scopeIf_7, distance=code_block_150)
code_block_151 = CodeBlock()  # same code as code_block_110
byElementAndLocation_5 = Tag.ByElementAndLocation(view=code_block_137, element=await_3, location=translate_7, horizontal=code_block_151)
code_block_152 = CodeBlock { "Type"; }
code_block_153 = CodeBlock { "EST_A_STRUCTURAL COLUMN TAG_ELEVACION_DIMENSIONES"; }
byName_17 = Orchid.RevitProject.Elements.Family.ByName(name=code_block_153)
code_block_154 = CodeBlock { "Pilar Hormigon"; }
byFamilyAndName_6 = FamilyType.ByFamilyAndName(family=byName_17, name=code_block_154)
setParameterByName_15 = Element.SetParameterByName(element=byElementAndLocation_5, parameterName=code_block_152, value=byFamilyAndName_6)

# group: Etiqueta Vigas Metalicas
code_block_155 = CodeBlock { "Structural Framing"; }
byName_18 = Category.ByName(name=code_block_155)
code_block_156 = CodeBlock(x=code_block_60.out1) { x; }
all_elements_of_category_in_view_7 = ElementsOfCategoryInView(Category=byName_18, View=code_block_156)
familyName_5 = Orchid.RevitProject.Elements.Element.FamilyName(element=all_elements_of_category_in_view_7)
code_block_157 = CodeBlock()
# ---------- code_block_157.designscript (12 lines) ----------
[
"EST_M_STRUCTURAL FRAMING_VIGA LAMINADA_L",
"EST_M_STRUCTURAL FRAMING_VIGA OHM",
"EST_M_STRUCTURAL FRAMING_VIGA PLEGADA_C",
"EST_M_STRUCTURAL FRAMING_VIGA PLEGADA_CA",
"EST_M_STRUCTURAL FRAMING_VIGA PLEGADA_HSS",
"EST_M_STRUCTURAL FRAMING_VIGA PLEGADA_HSSE",
"EST_M_STRUCTURAL FRAMING_VIGA PLEGADA_L",
"EST_M_STRUCTURAL FRAMING_VIGA SOLDADA_HN",
"EST_M_STRUCTURAL FRAMING_VIGA SOLDADA_IN",
"EST_M_STRUCTURAL FRAMING_VIGA SOLDADA_T"
];
# ----------------------------------------
eq_17 = familyName_5@L1 == code_block_157
anyTrue_4 = Orchid.Common.List.AnyTrue(list=eq_17)
filterByBoolMask_20 = List.FilterByBoolMask(list=all_elements_of_category_in_view_7, mask=anyTrue_4)
name_6 = Material.Name()  # unwired: material
getMaterials_5 = Element.GetMaterials(element=filterByBoolMask_20.in)
flatten_8 = List.Flatten(list=getMaterials_5)
function_apply_7 = ApplyFunction(func=name_6, arg1=flatten_8)
code_block_158 = CodeBlock { "Concrete, Cast-in-Place gray"; }
eq_18 = function_apply_7 == code_block_158
filterByBoolMask_21 = List.FilterByBoolMask(list=filterByBoolMask_20.in, mask=eq_18)
activeView = Orchid.RevitProject.Common.Document.ActiveView()
location_7 = Custom[Element.Location+](element=filterByBoolMask_20.in)
code_block_159 = CodeBlock(x=location_7.curves)  # same code as code_block_57
direction_6 = Line.Direction(line=code_block_159.out1)
activeView_2 = Orchid.RevitProject.Common.Document.ActiveView()
plane_9 = Custom[View.Plane](view=activeView_2)
isParallelToPlane_3 = Custom[Vector.IsParallelToPlane](vector=direction_6, plane=plane_9)
filterByBoolMask_22 = List.FilterByBoolMask(list=filterByBoolMask_20.in, mask=isParallelToPlane_3)
element_taggedstatus_6 = Custom[Element TaggedStatus](element=filterByBoolMask_22.in)
elementcentroid_6 = Custom[© ElementCentroid](element=element_taggedstatus_6.NotTagged)
location_8 = Custom[Element.Location+](element=element_taggedstatus_6.NotTagged)
code_block_160 = CodeBlock(x=location_8.curves)  # same code as code_block_57
code_block_161 = CodeBlock { 0.5; }
planeAtParameter_5 = Curve.PlaneAtParameter(curve=code_block_160.out1, param=code_block_161)
code_block_162 = CodeBlock { 0.5; }
pointAtParameter_7 = Curve.PointAtParameter(curve=code_block_160.out1, param=code_block_162)
activeView_3 = Orchid.RevitProject.Common.Document.ActiveView()
plane_10 = Custom[View.Plane](view=activeView_3)
normal_9 = Plane.Normal(plane=plane_10)
code_block_163 = CodeBlock { 90; }
rotate_5 = Geometry.Rotate(geometry=planeAtParameter_5, origin=pointAtParameter_7, axis=normal_9, degrees=code_block_163)
normal_10 = Plane.Normal(plane=rotate_5)
code_block_164 = CodeBlock(z=normal_10) { z.Z; }
code_block_165 = CodeBlock { 0; }
gt_6 = code_block_164 > code_block_165
code_block_166 = CodeBlock { -1; }
ne_5 = code_block_164 != code_block_166
and_6 = gt_6 && ne_5
reverse_8 = Vector.Reverse(vector=normal_10)
scopeIf_8 = Custom[ScopeIf+](test=and_6, True=normal_10, False=reverse_8, lacing=Shortest)
code_block_167 = CodeBlock(x=element_taggedstatus_6.NotTagged) { Revit.Elements.Element.GetParameterValueByName(Revit.Elements.Element.GetParameterValueByName(x,"Type"),"Height")/2; }
translate_8 = Geometry.Translate(geometry=elementcentroid_6, direction=scopeIf_8, distance=code_block_167)
byElementAndLocation_6 = Tag.ByElementAndLocation(view=activeView, element=element_taggedstatus_6.NotTagged, location=translate_8)
code_block_168 = CodeBlock { "Type"; }
code_block_169 = CodeBlock { "EST_A_STRUCTURAL FRAMING TAG_ELEVACION"; }
byName_19 = Orchid.RevitProject.Elements.Family.ByName(name=code_block_169)
code_block_170 = CodeBlock { "Tag Viga"; }
byFamilyAndName_7 = FamilyType.ByFamilyAndName(family=byName_19, name=code_block_170)
setParameterByName_16 = Element.SetParameterByName(element=byElementAndLocation_6, parameterName=code_block_168, value=byFamilyAndName_7)

# group: Etiqueta Emplantillado
ʳʰʸᵗʰᵐ_tags = Rhythm.Revit.Elements.Tags.SetLeaderElbowPosition()  # unwired: tag, location
code_block_171 = CodeBlock { "Type"; }
code_block_172 = CodeBlock { "EST_A_STRUCTURAL FOUNDATION TAG_ELEVACION_EMPLANTILLADO"; }
byName_20 = Orchid.RevitProject.Elements.Family.ByName(name=code_block_172)
code_block_173 = CodeBlock { "Emplantillado"; }
byFamilyAndName_8 = FamilyType.ByFamilyAndName(family=byName_20, name=code_block_173)
setParameterByName_17 = Element.SetParameterByName(parameterName=code_block_171, value=byFamilyAndName_8)  # unwired: element
code_block_174 = CodeBlock { "Leader Line"; 1; }
setParameterByName_18 = Element.SetParameterByName(parameterName=code_block_174.out0, value=code_block_174.out1)  # unwired: element
code_block_175 = CodeBlock(x=code_block_60.out1) { x; }
code_block_176 = CodeBlock(x=code_block_175) { x; }
code_block_177 = CodeBlock { "Structural Foundations"; }
byName_21 = Category.ByName(name=code_block_177)
all_elements_of_category_in_view_8 = ElementsOfCategoryInView(Category=byName_21, View=code_block_176)
kind_2 = Custom[StructuralFoundation.Kind](structuralFoundation=all_elements_of_category_in_view_8)  # package Clockwork for Dynamo 2.x; Retrieves the kind of a given structural foundation (isolated, wall, slab).
code_block_178 = CodeBlock { "Slab"; }
eq_19 = kind_2 == code_block_178
name_7 = Element.Name(element=all_elements_of_category_in_view_8)
code_block_179 = CodeBlock { "EMPLANTILLADO"; }
contains = String.Contains(str=name_7, searchFor=code_block_179)
and_7 = eq_19 && contains
filterByBoolMask_23 = List.FilterByBoolMask(list=all_elements_of_category_in_view_8, mask=and_7)
code_block_180 = CodeBlock { null; }
replaceEmptyLists_8 = Custom[List.ReplaceEmptyLists](seq=filterByBoolMask_23.in, Replacement=code_block_180)
code_block_181 = CodeBlock { 0; }
getItemAtIndex_2 = List.GetItemAtIndex(index=code_block_181)  # unwired: list
ZAxis_4 = Vector.ZAxis()
code_block_182 = CodeBlock { -300; }
translate_9 = Geometry.Translate(direction=ZAxis_4@L1, distance=code_block_182@L1, lacing=Longest)  # unwired: geometry
code_block_183 = CodeBlock { 0.5; }
pointAtParameter_8 = Surface.PointAtParameter(u=code_block_183, v=code_block_183)  # unwired: surface
element_surfaces_references = Custom[Element Surfaces References](element=replaceEmptyLists_8)  # package Genius Loci; Retrieve the top, bottom, side surfaces and their associated references of the system family. This doesn't work with cylindrical system families (pipe...)
code_block_184 = CodeBlock(x=element_surfaces_references.Bottom_Surface)
# ---------- code_block_184.designscript (12 lines) ----------
x;
[Imperative]
{
	if(x == null)
	{
		return = [];
	}
	else
	{
		return = DSCore.List.Flatten(x,1);
	}
};
# ----------------------------------------
function_apply_8 = ApplyFunction(func=pointAtParameter_8, arg1=code_block_184.out1)
function_apply_9 = ApplyFunction(func=translate_9, arg1=function_apply_8)
code_block_185 = CodeBlock { null; }
replaceEmptyLists_9 = Custom[List.ReplaceEmptyLists](seq=function_apply_9, Replacement=code_block_185)
code_block_186 = CodeBlock(x=code_block_175) { x; }
plane_11 = Custom[View.Plane](view=code_block_186)
byBestFitThroughPoints = Line.ByBestFitThroughPoints()  # unwired: bestFitPoints
code_block_187 = CodeBlock { 0.5; }
pointAtParameter_9 = Curve.PointAtParameter(param=code_block_187)  # unwired: curve
code_block_188 = CodeBlock { [1,3]; }
getItemAtIndex_3 = List.GetItemAtIndex(index=code_block_188@L2)  # unwired: list
getCropBox_2 = Orchid.RevitProject.Views.View.GetCropBox(view=code_block_186)
function_apply_10 = ApplyFunction(func=getItemAtIndex_3, arg1=getCropBox_2.Curve)
function_apply_11 = ApplyFunction(func=pointAtParameter_9, arg1=function_apply_10)
function_apply_12 = ApplyFunction(func=byBestFitThroughPoints, arg1=function_apply_11)
code_block_189 = CodeBlock(x=function_apply_12)  # same code as code_block_57
code_block_190 = CodeBlock { 0.5; }
pointAtParameter_10 = Curve.PointAtParameter(curve=code_block_189.out1, param=code_block_190)
direction_7 = Line.Direction(line=code_block_189.out1)
code_block_191 = CodeBlock { 90; }
rotate_6 = Geometry.Rotate(geometry=plane_11@L1, origin=pointAtParameter_10@L1, axis=direction_7@L1, degrees=code_block_191@L1)
normal_11 = Plane.Normal(plane=rotate_6)
code_block_192 = CodeBlock { 50; }
translate_10 = Geometry.Translate(geometry=replaceEmptyLists_9@L2, direction=normal_11@L1, distance=code_block_192@L1, lacing=Longest)
function_apply_13 = ApplyFunction(func=getItemAtIndex_2, arg1=translate_10)
byElementAndLocation_7 = Tag.ByElementAndLocation(view=code_block_176@L1, element=replaceEmptyLists_8@L2, location=function_apply_13@L2, lacing=Longest)
flatten_9 = List.Flatten(list=byElementAndLocation_7)
function_apply_14 = ApplyFunction(func=setParameterByName_18, arg1=flatten_9)
function_apply_15 = ApplyFunction(func=setParameterByName_17, arg1=function_apply_14)
function_apply_16 = ApplyFunction(func=ʳʰʸᵗʰᵐ_tags, arg1=function_apply_15, arg2=replaceEmptyLists_9)
code_block_193 = CodeBlock { true; }

code_block_194 = CodeBlock(x=code_block_59.out1) { x; }  # frozen

# group: Override Losas
code_block_195 = CodeBlock(x=code_block_194) { x; }
code_block_196 = CodeBlock(x=code_block_195) { x; }
code_block_197 = CodeBlock { "Floors"; }
byName_22 = Category.ByName(name=code_block_197)
all_elements_of_category_in_view_9 = ElementsOfCategoryInView(Category=byName_22, View=code_block_196)
name_8 = Material.Name()  # unwired: material
getMaterials_6 = Element.GetMaterials(element=all_elements_of_category_in_view_9)
flatten_10 = List.Flatten(list=getMaterials_6)
function_apply_17 = ApplyFunction(func=name_8, arg1=flatten_10)
code_block_198 = CodeBlock { "Concrete, Cast-in-Place gray"; }
eq_20 = function_apply_17 == code_block_198
filterByBoolMask_24 = List.FilterByBoolMask(list=all_elements_of_category_in_view_9, mask=eq_20)
code_block_199 = CodeBlock(x=code_block_195) { x; }
code_block_200 = CodeBlock { null; }
replaceEmptyLists_10 = Custom[List.ReplaceEmptyLists](seq=code_block_199, Replacement=code_block_200)
code_block_201 = CodeBlock(x=replaceEmptyLists_10)
# ---------- code_block_201.designscript (12 lines) ----------
x;
[Imperative]
{
	if(x == null)
	{
		return = [];
	}
	else
	{
		return = "Hidden";
	}
};
# ----------------------------------------
getByName = LinePatternElement.GetByName(name=code_block_201.out1)
color_palette = ColorPalette({R: 0, G: 0, B: 0, A: 255})
code_block_202 = CodeBlock { 1; }
create_overridegraphicsettings = Custom[Create OverrideGraphicSettings](ProjectionLinePattern=getByName, ProjectionLineColor=color_palette, ProjectionLineWeight=code_block_202, CutLinePattern=getByName, CutLineColor=color_palette, CutLineWeight=code_block_202)  # package Genius Loci; Create a OverrideGraphicSettings (All graphic inputs are optional). Unlike the OOTB OverrideGraphicSettings.ByProperties node, the Foreground and background patterns are available. Note : Prior to Revit 2019, the materials have only one surface pattern and one cut pattern.
view_setelementoverrides = Custom[View SetElementOverrides](view=code_block_196, elements=filterByBoolMask_24.in, overrides=create_overridegraphicsettings)  # package Genius Loci; Overrides element graphics settings in the given view. For use with the Create OverrideGraphicSettings node. Can also be used to hide or unhide elements.

# group: Override Muro en Corte
code_block_203 = CodeBlock(x=code_block_194) { x; }
code_block_204 = CodeBlock(x=code_block_203) { x; }
code_block_205 = CodeBlock { "Walls"; }
byName_23 = Category.ByName(name=code_block_205)
all_elements_of_category_in_view_10 = ElementsOfCategoryInView(Category=byName_23, View=code_block_204)
wallType_2 = archilab.Revit.Elements.Walls.WallType(wall=all_elements_of_category_in_view_10)
kind_3 = Orchid.RevitProject.Elements.WallType.Kind(wallType=wallType_2)
code_block_206 = CodeBlock { "Basic"; }
eq_21 = kind_3 == code_block_206
filterByBoolMask_25 = List.FilterByBoolMask(list=all_elements_of_category_in_view_10, mask=eq_21)
name_9 = Material.Name()  # unwired: material
getMaterials_7 = Element.GetMaterials(element=filterByBoolMask_25.in)
flatten_11 = List.Flatten(list=getMaterials_7)
function_apply_18 = ApplyFunction(func=name_9, arg1=flatten_11)
code_block_207 = CodeBlock { "Concrete, Cast-in-Place gray"; }
eq_22 = function_apply_18 == code_block_207
filterByBoolMask_26 = List.FilterByBoolMask(list=filterByBoolMask_25.in, mask=eq_22)
code_block_208 = CodeBlock(x=code_block_203) { x; }
code_block_209 = CodeBlock { null; }
replaceEmptyLists_11 = Custom[List.ReplaceEmptyLists](seq=code_block_208, Replacement=code_block_209)
code_block_210 = CodeBlock(x=replaceEmptyLists_11)  # same code as code_block_201
getByName_2 = LinePatternElement.GetByName(name=code_block_210.out1)
color_palette_2 = ColorPalette({R: 0, G: 0, B: 0, A: 255})
code_block_211 = CodeBlock { 1; }
create_overridegraphicsettings_2 = Custom[Create OverrideGraphicSettings](ProjectionLinePattern=getByName_2, ProjectionLineColor=color_palette_2, ProjectionLineWeight=code_block_211, CutLinePattern=getByName_2, CutLineColor=color_palette_2, CutLineWeight=code_block_211)
view_setelementoverrides_2 = Custom[View SetElementOverrides](view=code_block_204, elements=filterByBoolMask_26.in, overrides=create_overridegraphicsettings_2)

# group: Overrides Emplantillado
code_block_212 = CodeBlock(x=code_block_194) { x; }
code_block_213 = CodeBlock { "Structural Foundations"; }
byName_24 = Category.ByName(name=code_block_213)
all_elements_of_category_in_view_11 = ElementsOfCategoryInView(Category=byName_24, View=code_block_212)
name_10 = Element.Name(element=all_elements_of_category_in_view_11)
code_block_214 = CodeBlock { "EMPLANTILLADO"; }
contains_2 = String.Contains(str=name_10, searchFor=code_block_214)
filterByBoolMask_27 = List.FilterByBoolMask(list=all_elements_of_category_in_view_11, mask=contains_2)
code_block_215 = CodeBlock { null; }
replaceEmptyLists_12 = Custom[List.ReplaceEmptyLists](seq=filterByBoolMask_27.in, Replacement=code_block_215)
code_block_216 = CodeBlock(x=replaceEmptyLists_12)  # same code as code_block_57
code_block_217 = CodeBlock(x=replaceEmptyLists_12)
# ---------- code_block_217.designscript (12 lines) ----------
x;
[Imperative]
{
	if(x == null)
	{
		return = [];
	}
	else
	{
		return = "Diagonal up 1.5mm";
	}
};
# ----------------------------------------
getByName_3 = FillPatternElement.GetByName(name=code_block_217.out1)
color_palette_3 = ColorPalette({R: 0, G: 0, B: 0, A: 255})
create_overridegraphicsettings_3 = Custom[Create OverrideGraphicSettings](SurfaceForegroundPattern=getByName_3, SurfaceForegroundPatternColor=color_palette_3, CutForegroundPattern=getByName_3, CutForegroundPatternColor=color_palette_3)
view_setelementoverrides_3 = Custom[View SetElementOverrides](view=code_block_212, elements=code_block_216.out1, overrides=create_overridegraphicsettings_3, lacing=Longest)

# group: Overrides Vigas Hormigon en Corte
activeView_4 = Orchid.RevitProject.Common.Document.ActiveView()
code_block_218 = CodeBlock(x=code_block_194) { x; }
code_block_219 = CodeBlock(x=code_block_218) { x; }
code_block_220 = CodeBlock { "Structural Framing"; }
byName_25 = Category.ByName(name=code_block_220)
all_elements_of_category_in_view_12 = ElementsOfCategoryInView(Category=byName_25, View=code_block_219)
familyName_6 = Orchid.RevitProject.Elements.Element.FamilyName(element=all_elements_of_category_in_view_12)
code_block_221 = CodeBlock()  # same code as code_block_64
eq_23 = familyName_6@L1 == code_block_221
anyTrue_5 = Orchid.Common.List.AnyTrue(list=eq_23)
filterByBoolMask_28 = List.FilterByBoolMask(list=all_elements_of_category_in_view_12, mask=anyTrue_5)
location_9 = Custom[Element.Location+](element=filterByBoolMask_28.in)
code_block_222 = CodeBlock(x=location_9.curves)  # same code as code_block_57
direction_8 = Line.Direction(line=code_block_222.out1)
code_block_223 = CodeBlock(x=code_block_218) { x; }
plane_12 = Custom[View.Plane](view=code_block_223)
isParallelToPlane_4 = Custom[Vector.IsParallelToPlane](vector=direction_8, plane=plane_12)
filterByBoolMask_29 = List.FilterByBoolMask(list=filterByBoolMask_28.in, mask=isParallelToPlane_4)
code_block_224 = CodeBlock { null; }
replaceEmptyLists_13 = Custom[List.ReplaceEmptyLists](seq=code_block_223, Replacement=code_block_224)
code_block_225 = CodeBlock(x=replaceEmptyLists_13)  # same code as code_block_201
getByName_4 = LinePatternElement.GetByName(name=code_block_225.out1)
color_palette_4 = ColorPalette({R: 0, G: 0, B: 0, A: 255})
code_block_226 = CodeBlock { 1; }
create_overridegraphicsettings_4 = Custom[Create OverrideGraphicSettings](ProjectionLinePattern=getByName_4, ProjectionLineColor=color_palette_4, ProjectionLineWeight=code_block_226, CutLinePattern=getByName_4, CutLineColor=color_palette_4, CutLineWeight=code_block_226)
view_setelementoverrides_4 = Custom[View SetElementOverrides](view=code_block_219, elements=filterByBoolMask_29.out, overrides=create_overridegraphicsettings_4)

# group: Overrides Fundaciones (Hidden)
code_block_227 = CodeBlock(x=code_block_194) { x; }
code_block_228 = CodeBlock(x=code_block_227) { x; }
code_block_229 = CodeBlock { "Structural Foundations"; }
byName_26 = Category.ByName(name=code_block_229)
all_elements_of_category_in_view_13 = ElementsOfCategoryInView(Category=byName_26, View=code_block_228)
kind_4 = Custom[StructuralFoundation.Kind](structuralFoundation=all_elements_of_category_in_view_13)
code_block_230 = CodeBlock { "Slab"; }
eq_24 = kind_4 == code_block_230
filterByBoolMask_30 = List.FilterByBoolMask(list=all_elements_of_category_in_view_13, mask=eq_24)
code_block_231 = CodeBlock(x=code_block_227) { x; }
code_block_232 = CodeBlock { null; }
replaceEmptyLists_14 = Custom[List.ReplaceEmptyLists](seq=code_block_231, Replacement=code_block_232)
code_block_233 = CodeBlock(x=replaceEmptyLists_14)  # same code as code_block_201
getByName_5 = LinePatternElement.GetByName(name=code_block_233.out1)
color_palette_5 = ColorPalette({R: 0, G: 0, B: 0, A: 255})
code_block_234 = CodeBlock { 1; }
create_overridegraphicsettings_5 = Custom[Create OverrideGraphicSettings](ProjectionLinePattern=getByName_5, ProjectionLineColor=color_palette_5, ProjectionLineWeight=code_block_234, CutLinePattern=getByName_5, CutLineColor=color_palette_5, CutLineWeight=code_block_234)
view_setelementoverrides_5 = Custom[View SetElementOverrides](view=code_block_228, elements=filterByBoolMask_30.out, overrides=create_overridegraphicsettings_5)

# group: Overrides Vigas Hormigon en Corte
code_block_235 = CodeBlock(x=code_block_194) { x; }
code_block_236 = CodeBlock(x=code_block_235) { x; }
code_block_237 = CodeBlock { "Structural Framing"; }
byName_27 = Category.ByName(name=code_block_237)
all_elements_of_category_in_view_14 = ElementsOfCategoryInView(Category=byName_27, View=code_block_236)
familyName_7 = Orchid.RevitProject.Elements.Element.FamilyName(element=all_elements_of_category_in_view_14)
code_block_238 = CodeBlock()  # same code as code_block_64
eq_25 = familyName_7@L1 == code_block_238
anyTrue_6 = Orchid.Common.List.AnyTrue(list=eq_25)
filterByBoolMask_31 = List.FilterByBoolMask(list=all_elements_of_category_in_view_14, mask=anyTrue_6)
code_block_239 = CodeBlock(x=code_block_235) { x; }
code_block_240 = CodeBlock { null; }
replaceEmptyLists_15 = Custom[List.ReplaceEmptyLists](seq=code_block_239, Replacement=code_block_240)
code_block_241 = CodeBlock(x=replaceEmptyLists_15)  # same code as code_block_201
getByName_6 = LinePatternElement.GetByName(name=code_block_241.out1)
color_palette_6 = ColorPalette({R: 0, G: 0, B: 0, A: 255})
code_block_242 = CodeBlock { 1; }
create_overridegraphicsettings_6 = Custom[Create OverrideGraphicSettings](ProjectionLinePattern=getByName_6, ProjectionLineColor=color_palette_6, ProjectionLineWeight=code_block_242, CutLinePattern=getByName_6, CutLineColor=color_palette_6, CutLineWeight=code_block_242)
view_setelementoverrides_6 = Custom[View SetElementOverrides](view=code_block_236, elements=filterByBoolMask_31.in, overrides=create_overridegraphicsettings_6)

# group: Redibujar Contorno
code_block_243 = CodeBlock(x=code_block_194) { x; }
plane_13 = Custom[View.Plane](view=code_block_243)
normal_12 = Plane.Normal(plane=plane_13)
code_block_244 = CodeBlock(t2=code_block_243) { t1 = Revit.Elements.Element.GetParameterValueByName(t2, "Far Clip Offset"); t3 = t1 / 2; t4 = t3 * -1; }
translate_11 = Geometry.Translate(geometry=plane_13, direction=normal_12, distance=code_block_244.t4)
byUnion = Solid.ByUnion()  # unwired: solids
code_block_245 = CodeBlock()
# ---------- code_block_245.designscript (6 lines) ----------
["Floors",
"Structural Framing",
"Walls",
"Structural Foundations",
"Structural Columns"
];
# ----------------------------------------
byName_28 = Category.ByName(name=code_block_245)
all_elements_of_category_in_view_15 = ElementsOfCategoryInView(Category=byName_28, View=code_block_243)
flatten_12 = List.Flatten(list=all_elements_of_category_in_view_15)
solids = Element.Solids(element=flatten_12)
flatten_13 = List.Flatten(list=solids)
function_apply_19 = ApplyFunction(func=byUnion, arg1=flatten_13)
intersect = Geometry.Intersect(geometry=translate_11, other=function_apply_19)
perimeterCurves_2 = Surface.PerimeterCurves(surface=intersect)
flatten_14 = List.Flatten(list=perimeterCurves_2)
byCurve = Custom[DetailCurve.ByCurve+](curve=flatten_14, view=code_block_243)  # package Clockwork for Dynamo 2.x; Creates a detail line based on a given curve. Unlike the OOTB node it can also draw circles.
code_block_246 = CodeBlock { "Line Style"; }
code_block_247 = CodeBlock { "Wide Lines"; }
get_line_style_by_name = Custom[Get Line Style by Name](name=code_block_247)  # package archi-lab.net; This node will return a line style object by its name. Line styles can be either Drafting or Model Line Property.
setParameterByName_19 = Element.SetParameterByName(element=byCurve, parameterName=code_block_246, value=get_line_style_by_name, lacing=Longest)

# group: Sobrescribir Columnas de Hormigon
code_block_248 = CodeBlock(x=code_block_194) { x; }
code_block_249 = CodeBlock { "Structural Columns"; }
byName_29 = Category.ByName(name=code_block_249)
all_elements_of_category_in_view_16 = ElementsOfCategoryInView(Category=byName_29, View=code_block_248)
familyName_8 = Orchid.RevitProject.Elements.Element.FamilyName(element=all_elements_of_category_in_view_16)
code_block_250 = CodeBlock { "EST_M_STRUCTURAL COLUMN_RECTANGULAR"; }
eq_26 = familyName_8 == code_block_250
filterByBoolMask_32 = List.FilterByBoolMask(list=all_elements_of_category_in_view_16, mask=eq_26)
code_block_251 = CodeBlock(x=code_block_194) { x; }
code_block_252 = CodeBlock { null; }
replaceEmptyLists_16 = Custom[List.ReplaceEmptyLists](seq=code_block_251, Replacement=code_block_252)
code_block_253 = CodeBlock(x=replaceEmptyLists_16)  # same code as code_block_201
getByName_7 = LinePatternElement.GetByName(name=code_block_253.out1)
code_block_254 = CodeBlock { 1; }
create_overridegraphicsettings_7 = Custom[Create OverrideGraphicSettings](ProjectionLinePattern=getByName_7, ProjectionLineWeight=code_block_254, CutLinePattern=getByName_7, CutLineWeight=code_block_254)
code_block_255 = CodeBlock { false; }
view_setelementoverrides_7 = Custom[View SetElementOverrides](view=code_block_248, elements=filterByBoolMask_32.in, overrides=create_overridegraphicsettings_7, hide=code_block_255)

# group: Breaklines
byLoft_2 = Surface.ByLoft()  # unwired: crossSections
translate_12 = Geometry.Translate(lacing=Longest)  # unwired: geometry, direction, distance
byJoinedCurves = PolyCurve.ByJoinedCurves()  # unwired: curves
code_block_256 = CodeBlock(x=code_block_194) { x; }
code_block_257 = CodeBlock(x=code_block_256) { x; }
getCropBox_3 = Orchid.RevitProject.Views.View.GetCropBox(view=code_block_257)
function_apply_20 = ApplyFunction(func=byJoinedCurves, arg1=getCropBox_3.Curve)
code_block_258 = CodeBlock(x=function_apply_20)
# ---------- code_block_258.designscript (13 lines) ----------
x;

[Imperative]
{
	if(x == null)
	{
		return = [];
	}
	else
	{
		return = x;
	}
};
# ----------------------------------------
code_block_259 = CodeBlock { -290; false; }
offset = PolyCurve.Offset(polyCurve=code_block_258.out1, signedDistance=code_block_259.out0, extendCircular=code_block_259.out1)
plane_14 = Custom[View.Plane](view=code_block_257)
normal_13 = Plane.Normal(plane=plane_14)
reverse_9 = Vector.Reverse(vector=normal_13)
list_create_4 = List.Create(item0=normal_13, item1=reverse_9)
code_block_260 = CodeBlock { 1000; }
function_apply_21 = ApplyFunction(func=translate_12, arg1=offset, arg2=list_create_4, arg3=code_block_260)
function_apply_22 = ApplyFunction(func=byLoft_2, arg1=function_apply_21)
byUnion_2 = Solid.ByUnion()  # unwired: solids
code_block_261 = CodeBlock()
# ---------- code_block_261.designscript (6 lines) ----------
[
"Walls",
"Structural Columns",
"Structural Framing",
"Floors"
];
# ----------------------------------------
byName_30 = Category.ByName(name=code_block_261)
all_elements_of_category_in_view_17 = ElementsOfCategoryInView(Category=byName_30, View=code_block_257)
geometry = Element.Geometry(element=all_elements_of_category_in_view_17)
flatten_15 = List.Flatten(list=geometry)
function_apply_23 = ApplyFunction(func=byUnion_2, arg1=flatten_15)
code_block_262 = CodeBlock(x=function_apply_23)  # same code as code_block_258
intersect_2 = Geometry.Intersect(geometry=function_apply_22, other=code_block_262.out1)
code_block_263 = CodeBlock { [0.5,0.5]; [0,1]; }
pointAtParameter_11 = Surface.PointAtParameter(surface=intersect_2@L1, u=code_block_263.out1@L2, v=code_block_263.out0@L2, lacing=Longest)
transpose_3 = List.Transpose(lists=pointAtParameter_11)
code_block_264 = CodeBlock { null; }
replaceEmptyLists_17 = Custom[List.ReplaceEmptyLists](seq=transpose_3, Replacement=code_block_264)
code_block_265 = CodeBlock(x=replaceEmptyLists_17)  # same code as code_block_17
code_block_266 = CodeBlock(x=code_block_265.out1) { x[0]; x[1]; }
byStartPointEndPoint = Line.ByStartPointEndPoint(startPoint=code_block_266.out0, endPoint=code_block_266.out1)
reverse_10 = Curve.Reverse(curve=byStartPointEndPoint)
code_block_267 = CodeBlock(x=code_block_256) { x; }
plane_15 = Custom[View.Plane](view=code_block_267)
pullOntoPlane_4 = Curve.PullOntoPlane(curve=reverse_10, plane=plane_15)
code_block_268 = CodeBlock { "EST_D_BREAKLINE"; }
byName_31 = FamilyType.ByName(name=code_block_268)
byCurve_2 = Custom[DetailComponent.ByCurve](curve=pullOntoPlane_4, familyType=byName_31, view=code_block_267, lacing=Longest)  # package Clockwork for Dynamo 2.x; Places a line-based detail component in a given view
code_block_269 = CodeBlock { "Length of masking region"; 900; }
setParameterByName_20 = Element.SetParameterByName(element=byCurve_2, parameterName=code_block_269.out0, value=code_block_269.out1)
code_block_270 = CodeBlock(x=code_block_256) { x; }
plane_16 = Custom[View.Plane](view=code_block_270)
normal_14 = Plane.Normal(plane=plane_16)
X = Vector.X(vector=normal_14)
byPatch = Surface.ByPatch(closedCurve=offset)
code_block_271 = CodeBlock { 0.5; }
normalAtParameter = Surface.NormalAtParameter(surface=byPatch, u=code_block_271, v=code_block_271)
X_2 = Vector.X(vector=normalAtParameter)
eq_27 = X == X_2

# group: Cota Losas, Radier y Sello de Fundacion
code_block_272 = CodeBlock(x=code_block_59.out1) { x; }  # frozen
code_block_273 = CodeBlock(x=code_block_272) { x; }
code_block_274 = CodeBlock(x=code_block_272) { x; }
getCropBox_4 = Orchid.RevitProject.Views.View.GetCropBox(view=code_block_274)
code_block_275 = CodeBlock { null; }
replaceEmptyLists_18 = Custom[List.ReplaceEmptyLists](seq=getCropBox_4.Curve, Replacement=code_block_275)
code_block_276 = CodeBlock(x=replaceEmptyLists_18)
# ---------- code_block_276.designscript (12 lines) ----------
x;
[Imperative]
{
	if(x == null)
	{
		return = [];
	}
	else
	{
		return = x[2];
	}
};
# ----------------------------------------
code_block_277 = CodeBlock(x=code_block_276.out1) { x; }
code_block_278 = CodeBlock { 0.5; }
planeAtParameter_6 = Curve.PlaneAtParameter(curve=code_block_277, param=code_block_278)
pointAtParameter_12 = Curve.PointAtParameter(curve=code_block_277, param=code_block_278)
plane_17 = Custom[View.Plane](view=code_block_274)
normal_15 = Plane.Normal(plane=plane_17)
byOriginNormal = Plane.ByOriginNormal(origin=pointAtParameter_12, normal=normal_15)
normal_16 = Plane.Normal(plane=byOriginNormal)
code_block_279 = CodeBlock { 90; }
rotate_7 = Geometry.Rotate(geometry=planeAtParameter_6, origin=pointAtParameter_12, axis=normal_16, degrees=code_block_279)
normal_17 = Plane.Normal(plane=rotate_7)
code_block_280 = CodeBlock { 350; }
translate_13 = Geometry.Translate(geometry=code_block_276.out1, direction=normal_17, distance=code_block_280)
code_block_281 = CodeBlock { "Floors"; }
byName_32 = Category.ByName(name=code_block_281)
all_elements_of_category_in_view_18 = ElementsOfCategoryInView(Category=byName_32, View=code_block_274)
code_block_282 = CodeBlock { "Slope"; }
getParameterValueByName_4 = Element.GetParameterValueByName(element=all_elements_of_category_in_view_18, parameterName=code_block_282)
code_block_283 = CodeBlock { ""; }
eq_28 = getParameterValueByName_4 == code_block_283
filterByBoolMask_33 = List.FilterByBoolMask(list=all_elements_of_category_in_view_18, mask=eq_28)
level = Custom[Element.Level]()  # package Clockwork for Dynamo 2.x; Gets an element's level; unwired: element
groupByFunction = List.GroupByFunction(list=filterByBoolMask_33.in, func=level)
code_block_284 = CodeBlock { "Height Offset From Level"; }
getParameterValueByName_5 = Element.GetParameterValueByName(element=groupByFunction, parameterName=code_block_284)
minimumItem_2 = List.MinimumItem(list=getParameterValueByName_5@L2)
code_block_285 = CodeBlock(x=minimumItem_2)
# ---------- code_block_285.designscript (12 lines) ----------
x;
[Imperative]
{
	if(x[0] == null)
	{
		return = [];
	}
	else
	{
		return = x;
	}
};
# ----------------------------------------
eq_29 = getParameterValueByName_5@L2 == code_block_285.out1@L1
filterByBoolMask_34 = List.FilterByBoolMask(list=groupByFunction, mask=eq_29)
code_block_286 = CodeBlock { "Structural Foundations"; }
byName_33 = Category.ByName(name=code_block_286)
all_elements_of_category_in_view_19 = ElementsOfCategoryInView(Category=byName_33, View=code_block_274)
familyName_9 = Orchid.RevitProject.Elements.Element.FamilyName(element=all_elements_of_category_in_view_19)
code_block_287 = CodeBlock { "EST_M_STRUCTURAL FOUNDATION_FUNDACION AISLADA"; }
eq_30 = familyName_9 == code_block_287
code_block_288 = CodeBlock { "Wall Foundation"; }
eq_31 = familyName_9 == code_block_288
or_ = eq_30 || eq_31
filterByBoolMask_35 = List.FilterByBoolMask(list=all_elements_of_category_in_view_19, mask=or_)
code_block_289 = CodeBlock { null; }
replaceEmptyLists_19 = Custom[List.ReplaceEmptyLists](seq=filterByBoolMask_35.in, Replacement=code_block_289)
code_block_290 = CodeBlock(x=replaceEmptyLists_19)  # same code as code_block_50
element_surfaces_references_2 = Custom[Element Surfaces References](element=code_block_290.out1)
code_block_291 = CodeBlock { null; }
replaceEmptyLists_20 = Custom[List.ReplaceEmptyLists](seq=element_surfaces_references_2.Bottom_Reference, Replacement=code_block_291)
code_block_292 = CodeBlock(x=replaceEmptyLists_20)  # same code as code_block_50
all = Orchid.RevitProject.Annotations.DimensionType.All()
name_11 = Element.Name(element=all)
code_block_293 = CodeBlock { "Linear - 2.5mm Arial"; }
eq_32 = name_11 == code_block_293
filterByBoolMask_36 = List.FilterByBoolMask(list=all, mask=eq_32)
code_block_294 = CodeBlock(x=filterByBoolMask_36.in) { x[0]; }

code_block_295 = CodeBlock(x=code_block_273) { x; }
flatten_16 = List.Flatten(list=filterByBoolMask_34.in)

# group (continued): Cota Losas, Radier y Sello de Fundacion
element_surfaces_references_3 = Custom[Element Surfaces References](element=flatten_16@L1)
code_block_296 = CodeBlock(x=element_surfaces_references_3.Top_Reference) { DSCore.List.Flatten(x,2); }
code_block_297 = CodeBlock(refLosas=code_block_296, refrFunAis=code_block_292.out1) { DSCore.List.Flatten(([refLosas,refrFunAis]),2); }
dimension_byreferences = Custom[Dimension ByReferences](view=code_block_273, line=translate_13, references=code_block_297, dimensionType=code_block_294)  # package Genius Loci; Creates a new linear dimension from at least two geometric references of an object.

# group: Niveles en Elevacion
setParameterByName_21 = Element.SetParameterByName()  # unwired: element, parameterName, value
code_block_298 = CodeBlock { null; }
replaceEmptyLists_21 = Custom[List.ReplaceEmptyLists](seq=dimension_byreferences, Replacement=code_block_298)
code_block_299 = CodeBlock(x=replaceEmptyLists_21)  # same code as code_block_57
ʳʰʸᵗʰᵐ_dimensions = Rhythm.Revit.Elements.Dimensions.GetReferenceElements(dimension=code_block_299.out1)
ʳʰʸᵗʰᵐ_dimensions_getcurve = Rhythm.Revit.Elements.Dimensions.GetCurve(dimension=code_block_299.out1)
code_block_300 = CodeBlock(line1=ʳʰʸᵗʰᵐ_dimensions_getcurve)
# ---------- code_block_300.designscript (5 lines) ----------
point1 = Autodesk.Curve.StartPoint(line1);
point2 = Autodesk.Curve.EndPoint(line1);
t1 = [point1, point2];
t2 = DSCore.List.Flatten(t1, -1);
t3 = DSCore.List.UniqueItems(t2);
# ----------------------------------------
byElementAndLocation_8 = Tag.ByElementAndLocation(view=code_block_295, element=ʳʰʸᵗʰᵐ_dimensions, location=code_block_300.t3)
code_block_301 = CodeBlock { "Type"; }
getCategory = Element.GetCategory(element=ʳʰʸᵗʰᵐ_dimensions)
string_from_object = FromObject(obj=getCategory)
code_block_302 = CodeBlock { "Structural Foundations"; }
eq_33 = string_from_object == code_block_302  # lacing=Longest
tag_sello_fundacion = CodeBlock()
# ---------- tag_sello_fundacion.designscript (2 lines) ----------
family1 = Revit.Family.ByName("EST_A_FOUNDATION TAG_ELEVACION");
familytype1 = Revit.FamilyType.ByFamilyAndName(family1, "Orientación Izquierda");
# ----------------------------------------
tag_tope_losa = CodeBlock()
# ---------- tag_tope_losa.designscript (2 lines) ----------
family1 = Revit.Family.ByName("EST_A_FLOOR TAG_ELEVACION_TOPE LOSA");
familytype1 = Revit.FamilyType.ByFamilyAndName(family1, "Orientación Izquierda");
# ----------------------------------------
scopeIf_9 = Custom[ScopeIf+](test=eq_33, True=tag_sello_fundacion.familytype1, False=tag_tope_losa.familytype1)
setParameterByName_22 = Element.SetParameterByName(element=byElementAndLocation_8, parameterName=code_block_301, value=scopeIf_9, lacing=Longest)
code_block_303 = CodeBlock { "Type"; }
taggedElement = Tag.TaggedElement(tag=setParameterByName_22)
name_12 = Element.Name(element=taggedElement)
code_block_304 = CodeBlock { "RADIER e="; }
contains_3 = String.Contains(str=name_12, searchFor=code_block_304)
tag_tope_radier = CodeBlock()
# ---------- tag_tope_radier.designscript (2 lines) ----------
family1 = Revit.Family.ByName("EST_A_FLOOR TAG_ELEVACION_TOPE RADIER");
familytype1 = Revit.FamilyType.ByFamilyAndName(family1, "Orientación Izquierda");
# ----------------------------------------
code_block_305 = CodeBlock { []; }
scopeIf_10 = Custom[ScopeIf+](test=contains_3, True=tag_tope_radier.familytype1, False=code_block_305)
function_apply_24 = ApplyFunction(func=setParameterByName_21, arg1=setParameterByName_22, arg2=code_block_303, arg3=scopeIf_10)
