# Dynamo graph postproceso_script.dyn (Dynamo 2.3.2.15696)
# packages: Genius Loci 2021.11.10, archi-lab.net 2022.210.2419, Clockwork for Dynamo 2.x 2.4.0, Orchid 200.4.0.7938

activeView = Orchid.RevitProject.Common.Document.ActiveView()
code_block = CodeBlock(x=activeView)
# ---------- code_block.designscript (12 lines) ----------
x;
[Imperative]
{
	if(x == null)
	{
		return = [];
	}
	else
	{
		return = x;
	}
};
# ----------------------------------------

# group: Overrides Vigas Hormigon en Corte
code_block_2 = CodeBlock { null; }
replaceEmptyLists = Custom[List.ReplaceEmptyLists](seq=code_block.out1, Replacement=code_block_2)  # package Clockwork for Dynamo 2.x; Replaces all empty lists within a given list with a substitute
code_block_3 = CodeBlock(x=replaceEmptyLists)
# ---------- code_block_3.designscript (13 lines) ----------
x;

[Imperative]
{
	if(x == null)
	{
		return = [];
	}
	else
	{
		return = x;
	}
};
# ----------------------------------------
code_block_4 = CodeBlock(x=code_block_3.out1) { x; }
code_block_5 = CodeBlock { "Structural Framing"; }
byName = Category.ByName(name=code_block_5)
all_elements_of_category_in_view = ElementsOfCategoryInView(Category=byName, View=code_block_4)
familyName = Orchid.RevitProject.Elements.Element.FamilyName(element=all_elements_of_category_in_view)
code_block_6 = CodeBlock()
# ---------- code_block_6.designscript (6 lines) ----------
[
"EST_M_STRUCTURAL FRAMING_VIGA INVERTIDA",
"EST_M_STRUCTURAL FRAMING_VIGA SEMI INVERTIDA",
"EST_M_STRUCTURAL FRAMING_VIGA TRADICIONAL",
"EST_M_STRUCTURAL FRAMING_VIGA FUNDACION"
];
# ----------------------------------------
eq = familyName@L1 == code_block_6
anyTrue = Orchid.Common.List.AnyTrue(list=eq)
filterByBoolMask = List.FilterByBoolMask(list=all_elements_of_category_in_view, mask=anyTrue)
code_block_7 = CodeBlock(x=code_block_3.out1) { x; }
code_block_8 = CodeBlock { null; }
replaceEmptyLists_2 = Custom[List.ReplaceEmptyLists](seq=code_block_7, Replacement=code_block_8)
code_block_9 = CodeBlock(x=replaceEmptyLists_2)
# ---------- code_block_9.designscript (12 lines) ----------
x;
[Imperative]
{
	if(x == null)
	{
		return = [];
	}
	else
	{
		return = "Hidden";
	}
};
# ----------------------------------------
getByName = LinePatternElement.GetByName(name=code_block_9.out1)
color_palette = ColorPalette({R: 0, G: 0, B: 0, A: 255})
code_block_10 = CodeBlock { 1; }
create_overridegraphicsettings = Custom[Create OverrideGraphicSettings](ProjectionLinePattern=getByName, ProjectionLineColor=color_palette, ProjectionLineWeight=code_block_10, CutLinePattern=getByName, CutLineColor=color_palette, CutLineWeight=code_block_10)  # package Genius Loci; Create a OverrideGraphicSettings (All graphic inputs are optional). Unlike the OOTB OverrideGraphicSettings.ByProperties node, the Foreground and background patterns are available. Note : Prior to Revit 2019, the materials have only one surface pattern and one cut pattern.
view_setelementoverrides = Custom[View SetElementOverrides](view=code_block_4, elements=filterByBoolMask.in, overrides=create_overridegraphicsettings)  # package Genius Loci; Overrides element graphics settings in the given view. For use with the Create OverrideGraphicSettings node. Can also be used to hide or unhide elements.

# group: Redibujar Contorno
code_block_11 = CodeBlock { null; }
replaceEmptyLists_3 = Custom[List.ReplaceEmptyLists](seq=code_block.out1, Replacement=code_block_11)
code_block_12 = CodeBlock(x=replaceEmptyLists_3)  # same code as code_block_3
plane = Custom[View.Plane](view=code_block_12.out1)  # package Clockwork for Dynamo 2.x; Retrieves the plane of a given view
normal = Plane.Normal(plane=plane)
code_block_13 = CodeBlock(t2=code_block_12.out1) { t1 = Revit.Elements.Element.GetParameterValueByName(t2, "Far Clip Offset"); t3 = t1 / 2; t4 = t3 * -1; }
translate = Geometry.Translate(geometry=plane, direction=normal, distance=code_block_13.t4)
byUnion = Solid.ByUnion()  # unwired: solids
code_block_14 = CodeBlock()
# ---------- code_block_14.designscript (6 lines) ----------
["Floors",
"Structural Framing",
"Walls",
"Structural Foundations",
"Structural Columns"
];
# ----------------------------------------
byName_2 = Category.ByName(name=code_block_14)
all_elements_of_category_in_view_2 = ElementsOfCategoryInView(Category=byName_2, View=code_block_12.out1)
flatten = List.Flatten(list=all_elements_of_category_in_view_2)
solids = Element.Solids(element=flatten)
flatten_2 = List.Flatten(list=solids)
function_apply = ApplyFunction(func=byUnion, arg1=flatten_2)
intersect = Geometry.Intersect(geometry=translate, other=function_apply)
perimeterCurves = Surface.PerimeterCurves(surface=intersect)
flatten_3 = List.Flatten(list=perimeterCurves)
byCurve = Custom[DetailCurve.ByCurve+](curve=flatten_3, view=code_block_12.out1)  # package Clockwork for Dynamo 2.x; Creates a detail line based on a given curve. Unlike the OOTB node it can also draw circles.
code_block_15 = CodeBlock { "Line Style"; }
code_block_16 = CodeBlock { "Wide Lines"; }
get_line_style_by_name = Custom[Get Line Style by Name](name=code_block_16)  # package archi-lab.net; This node will return a line style object by its name. Line styles can be either Drafting or Model Line Property.
setParameterByName = Element.SetParameterByName(element=byCurve, parameterName=code_block_15, value=get_line_style_by_name, lacing=Longest)

code_block_17 = CodeBlock(x=code_block.out1) { x; }

# group: Breaklines
byLoft = Surface.ByLoft()  # unwired: crossSections
translate_2 = Geometry.Translate(lacing=Longest)  # unwired: geometry, direction, distance
byJoinedCurves = PolyCurve.ByJoinedCurves()  # unwired: curves
code_block_18 = CodeBlock { null; }
replaceEmptyLists_4 = Custom[List.ReplaceEmptyLists](seq=code_block_17, Replacement=code_block_18)
code_block_19 = CodeBlock(x=replaceEmptyLists_4)
# ---------- code_block_19.designscript (13 lines) ----------
x;

[Imperative]
{
	if(x == null)
	{
		return = [[],[]];
	}
	else
	{
		return = x;
	}
};
# ----------------------------------------
code_block_20 = CodeBlock(x=code_block_19.out1) { x; }
getCropBox = Orchid.RevitProject.Views.View.GetCropBox(view=code_block_20)
function_apply_2 = ApplyFunction(func=byJoinedCurves, arg1=getCropBox.Curve)
code_block_21 = CodeBlock(x=function_apply_2)  # same code as code_block_3
code_block_22 = CodeBlock { -290; false; }
offset = PolyCurve.Offset(polyCurve=code_block_21.out1, signedDistance=code_block_22.out0, extendCircular=code_block_22.out1)
plane_2 = Custom[View.Plane](view=code_block_20)
normal_2 = Plane.Normal(plane=plane_2)
reverse = Vector.Reverse(vector=normal_2)
list_create = List.Create(item0=normal_2, item1=reverse)
code_block_23 = CodeBlock { 1000; }
function_apply_3 = ApplyFunction(func=translate_2, arg1=offset, arg2=list_create, arg3=code_block_23)
function_apply_4 = ApplyFunction(func=byLoft, arg1=function_apply_3)
byUnion_2 = Solid.ByUnion()  # unwired: solids
code_block_24 = CodeBlock()
# ---------- code_block_24.designscript (6 lines) ----------
[
"Walls",
"Structural Columns",
"Structural Framing",
"Floors"
];
# ----------------------------------------
byName_3 = Category.ByName(name=code_block_24)
all_elements_of_category_in_view_3 = ElementsOfCategoryInView(Category=byName_3, View=code_block_20)
geometry = Element.Geometry(element=all_elements_of_category_in_view_3)
flatten_4 = List.Flatten(list=geometry)
function_apply_5 = ApplyFunction(func=byUnion_2, arg1=flatten_4)
code_block_25 = CodeBlock(x=function_apply_5)  # same code as code_block_3
intersect_2 = Geometry.Intersect(geometry=function_apply_4, other=code_block_25.out1)
code_block_26 = CodeBlock { [0.5,0.5]; [0,1]; }
pointAtParameter = Surface.PointAtParameter(surface=intersect_2@L1, u=code_block_26.out1@L2, v=code_block_26.out0@L2, lacing=Longest)
transpose = List.Transpose(lists=pointAtParameter)
code_block_27 = CodeBlock { null; }
replaceEmptyLists_5 = Custom[List.ReplaceEmptyLists](seq=transpose, Replacement=code_block_27)
code_block_28 = CodeBlock(x=replaceEmptyLists_5)  # same code as code_block_19
code_block_29 = CodeBlock(x=code_block_28.out1) { x[0]; x[1]; }
byStartPointEndPoint = Line.ByStartPointEndPoint(startPoint=code_block_29.out0, endPoint=code_block_29.out1)
reverse_2 = Curve.Reverse(curve=byStartPointEndPoint)
code_block_30 = CodeBlock(x=code_block_19.out1) { x; }
plane_3 = Custom[View.Plane](view=code_block_30)
pullOntoPlane = Curve.PullOntoPlane(curve=reverse_2, plane=plane_3)
code_block_31 = CodeBlock { "EST_D_BREAKLINE"; }
byName_4 = FamilyType.ByName(name=code_block_31)
byCurve_2 = Custom[DetailComponent.ByCurve](curve=pullOntoPlane, familyType=byName_4, view=code_block_30, lacing=Longest)  # package Clockwork for Dynamo 2.x; Places a line-based detail component in a given view
code_block_32 = CodeBlock { "Length of masking region"; 900; }
setParameterByName_2 = Element.SetParameterByName(element=byCurve_2, parameterName=code_block_32.out0, value=code_block_32.out1)
code_block_33 = CodeBlock(x=code_block_19.out1) { x; }
plane_4 = Custom[View.Plane](view=code_block_33)
normal_3 = Plane.Normal(plane=plane_4)
X = Vector.X(vector=normal_3)
byPatch = Surface.ByPatch(closedCurve=offset)
code_block_34 = CodeBlock { 0.5; }
normalAtParameter = Surface.NormalAtParameter(surface=byPatch, u=code_block_34, v=code_block_34)
X_2 = Vector.X(vector=normalAtParameter)
eq_2 = X == X_2

# group: Sobrescribir Columnas de Hormigon
code_block_35 = CodeBlock { null; }
replaceEmptyLists_6 = Custom[List.ReplaceEmptyLists](seq=code_block.out1, Replacement=code_block_35)
code_block_36 = CodeBlock(x=replaceEmptyLists_6)  # same code as code_block_3
code_block_37 = CodeBlock { "Structural Columns"; }
byName_5 = Category.ByName(name=code_block_37)
all_elements_of_category_in_view_4 = ElementsOfCategoryInView(Category=byName_5, View=code_block_36.out1)
familyName_2 = Orchid.RevitProject.Elements.Element.FamilyName(element=all_elements_of_category_in_view_4)
code_block_38 = CodeBlock { "EST_M_STRUCTURAL COLUMN_RECTANGULAR"; }
eq_3 = familyName_2 == code_block_38
filterByBoolMask_2 = List.FilterByBoolMask(list=all_elements_of_category_in_view_4, mask=eq_3)
code_block_39 = CodeBlock { "Hidden"; }
getByName_2 = LinePatternElement.GetByName(name=code_block_39)
code_block_40 = CodeBlock { 1; }
create_overridegraphicsettings_2 = Custom[Create OverrideGraphicSettings](ProjectionLinePattern=getByName_2, ProjectionLineWeight=code_block_40, CutLinePattern=getByName_2, CutLineWeight=code_block_40)
code_block_41 = CodeBlock { false; }
view_setelementoverrides_2 = Custom[View SetElementOverrides](view=code_block_36.out1, elements=filterByBoolMask_2.in, overrides=create_overridegraphicsettings_2, hide=code_block_41)

code_block_42 = CodeBlock { null; }
replaceEmptyLists_7 = Custom[List.ReplaceEmptyLists](seq=code_block.out1, Replacement=code_block_42)
code_block_43 = CodeBlock(x=replaceEmptyLists_7)  # same code as code_block_3

# group: Overrides Vigas Hormigon en Corte
activeView_2 = Orchid.RevitProject.Common.Document.ActiveView()
code_block_44 = CodeBlock(x=code_block_43.out1) { x; }
code_block_45 = CodeBlock(x=code_block_44) { x; }
code_block_46 = CodeBlock { "Structural Framing"; }
byName_6 = Category.ByName(name=code_block_46)
all_elements_of_category_in_view_5 = ElementsOfCategoryInView(Category=byName_6, View=code_block_45)
familyName_3 = Orchid.RevitProject.Elements.Element.FamilyName(element=all_elements_of_category_in_view_5)
code_block_47 = CodeBlock()  # same code as code_block_6
eq_4 = familyName_3@L1 == code_block_47
anyTrue_2 = Orchid.Common.List.AnyTrue(list=eq_4)
filterByBoolMask_3 = List.FilterByBoolMask(list=all_elements_of_category_in_view_5, mask=anyTrue_2)
location = Custom[Element.Location+](element=filterByBoolMask_3.in)  # package Clockwork for Dynamo 2.x; Returns the location of an element as point, curve or curve loop, along with some booleans to help filtering the results. Unlike the OOTB Element.GetLocation node, it also retunrs sketch lines of sketch-based elements like floor slabs as well as the element's rotation property.
code_block_48 = CodeBlock(x=location.curves)  # same code as code_block
direction = Line.Direction(line=code_block_48.out1)
code_block_49 = CodeBlock(x=code_block_44) { x; }
plane_5 = Custom[View.Plane](view=code_block_49)
isParallelToPlane = Custom[Vector.IsParallelToPlane](vector=direction, plane=plane_5)  # package Clockwork for Dynamo 2.x; Checks if a given vector is parallel to a given plane
filterByBoolMask_4 = List.FilterByBoolMask(list=filterByBoolMask_3.in, mask=isParallelToPlane)
code_block_50 = CodeBlock { null; }
replaceEmptyLists_8 = Custom[List.ReplaceEmptyLists](seq=code_block_49, Replacement=code_block_50)
code_block_51 = CodeBlock(x=replaceEmptyLists_8)  # same code as code_block_9
getByName_3 = LinePatternElement.GetByName(name=code_block_51.out1)
color_palette_2 = ColorPalette({R: 0, G: 0, B: 0, A: 255})
code_block_52 = CodeBlock { 1; }
create_overridegraphicsettings_3 = Custom[Create OverrideGraphicSettings](ProjectionLinePattern=getByName_3, ProjectionLineColor=color_palette_2, ProjectionLineWeight=code_block_52, CutLinePattern=getByName_3, CutLineColor=color_palette_2, CutLineWeight=code_block_52)
view_setelementoverrides_3 = Custom[View SetElementOverrides](view=code_block_45, elements=filterByBoolMask_4.out, overrides=create_overridegraphicsettings_3)

# group: Overrides Emplantillado
code_block_53 = CodeBlock(x=code_block_43.out1) { x; }
code_block_54 = CodeBlock { "Structural Foundations"; }
byName_7 = Category.ByName(name=code_block_54)
all_elements_of_category_in_view_6 = ElementsOfCategoryInView(Category=byName_7, View=code_block_53)
name = Element.Name(element=all_elements_of_category_in_view_6)
code_block_55 = CodeBlock { "EMPLANTILLADO"; }
contains = String.Contains(str=name, searchFor=code_block_55)
filterByBoolMask_5 = List.FilterByBoolMask(list=all_elements_of_category_in_view_6, mask=contains)
code_block_56 = CodeBlock { null; }
replaceEmptyLists_9 = Custom[List.ReplaceEmptyLists](seq=filterByBoolMask_5.in, Replacement=code_block_56)
code_block_57 = CodeBlock(x=replaceEmptyLists_9)
# ---------- code_block_57.designscript (12 lines) ----------
x;
[Imperative]
{
	if(x == null)
	{
		return = [];
	}
	else
	{
		return = x[0];
	}
};
# ----------------------------------------
code_block_58 = CodeBlock(x=replaceEmptyLists_9)
# ---------- code_block_58.designscript (12 lines) ----------
x;
[Imperative]
{
	if(x == null)
	{
		return = [];
	}
	else
	{
		return = "Diagonal up 1.5mm";
	}
};
# ----------------------------------------
getByName_4 = FillPatternElement.GetByName(name=code_block_58.out1)
color_palette_3 = ColorPalette({R: 0, G: 0, B: 0, A: 255})
create_overridegraphicsettings_4 = Custom[Create OverrideGraphicSettings](SurfaceForegroundPattern=getByName_4, SurfaceForegroundPatternColor=color_palette_3, CutForegroundPattern=getByName_4, CutForegroundPatternColor=color_palette_3)
view_setelementoverrides_4 = Custom[View SetElementOverrides](view=code_block_53, elements=code_block_57.out1, overrides=create_overridegraphicsettings_4)

# group: Override Muro en Corte
code_block_59 = CodeBlock(x=code_block_43.out1) { x; }
code_block_60 = CodeBlock(x=code_block_59) { x; }
code_block_61 = CodeBlock { "Walls"; }
byName_8 = Category.ByName(name=code_block_61)
all_elements_of_category_in_view_7 = ElementsOfCategoryInView(Category=byName_8, View=code_block_60)
wallType = archilab.Revit.Elements.Walls.WallType(wall=all_elements_of_category_in_view_7)
kind = Orchid.RevitProject.Elements.WallType.Kind(wallType=wallType)
code_block_62 = CodeBlock { "Basic"; }
eq_5 = kind == code_block_62
filterByBoolMask_6 = List.FilterByBoolMask(list=all_elements_of_category_in_view_7, mask=eq_5)
name_2 = Material.Name()  # unwired: material
getMaterials = Element.GetMaterials(element=filterByBoolMask_6.in)
flatten_5 = List.Flatten(list=getMaterials)
function_apply_6 = ApplyFunction(func=name_2, arg1=flatten_5)
code_block_63 = CodeBlock { "Concrete, Cast-in-Place gray"; }
eq_6 = function_apply_6 == code_block_63
filterByBoolMask_7 = List.FilterByBoolMask(list=filterByBoolMask_6.in, mask=eq_6)
code_block_64 = CodeBlock(x=code_block_59) { x; }
code_block_65 = CodeBlock { null; }
replaceEmptyLists_10 = Custom[List.ReplaceEmptyLists](seq=code_block_64, Replacement=code_block_65)
code_block_66 = CodeBlock(x=replaceEmptyLists_10)  # same code as code_block_9
getByName_5 = LinePatternElement.GetByName(name=code_block_66.out1)
color_palette_4 = ColorPalette({R: 0, G: 0, B: 0, A: 255})
code_block_67 = CodeBlock { 1; }
create_overridegraphicsettings_5 = Custom[Create OverrideGraphicSettings](ProjectionLinePattern=getByName_5, ProjectionLineColor=color_palette_4, ProjectionLineWeight=code_block_67, CutLinePattern=getByName_5, CutLineColor=color_palette_4, CutLineWeight=code_block_67)
view_setelementoverrides_5 = Custom[View SetElementOverrides](view=code_block_60, elements=filterByBoolMask_7.in, overrides=create_overridegraphicsettings_5)

# group: Overrides Fundaciones (Hidden)
code_block_68 = CodeBlock(x=code_block_43.out1) { x; }
code_block_69 = CodeBlock(x=code_block_68) { x; }
code_block_70 = CodeBlock { "Structural Foundations"; }
byName_9 = Category.ByName(name=code_block_70)
all_elements_of_category_in_view_8 = ElementsOfCategoryInView(Category=byName_9, View=code_block_69)
kind_2 = Custom[StructuralFoundation.Kind](structuralFoundation=all_elements_of_category_in_view_8)  # package Clockwork for Dynamo 2.x; Retrieves the kind of a given structural foundation (isolated, wall, slab).
code_block_71 = CodeBlock { "Slab"; }
eq_7 = kind_2 == code_block_71
filterByBoolMask_8 = List.FilterByBoolMask(list=all_elements_of_category_in_view_8, mask=eq_7)
code_block_72 = CodeBlock(x=code_block_68) { x; }
code_block_73 = CodeBlock { null; }
replaceEmptyLists_11 = Custom[List.ReplaceEmptyLists](seq=code_block_72, Replacement=code_block_73)
code_block_74 = CodeBlock(x=replaceEmptyLists_11)  # same code as code_block_9
getByName_6 = LinePatternElement.GetByName(name=code_block_74.out1)
color_palette_5 = ColorPalette({R: 0, G: 0, B: 0, A: 255})
code_block_75 = CodeBlock { 1; }
create_overridegraphicsettings_6 = Custom[Create OverrideGraphicSettings](ProjectionLinePattern=getByName_6, ProjectionLineColor=color_palette_5, ProjectionLineWeight=code_block_75, CutLinePattern=getByName_6, CutLineColor=color_palette_5, CutLineWeight=code_block_75)
view_setelementoverrides_6 = Custom[View SetElementOverrides](view=code_block_69, elements=filterByBoolMask_8.out, overrides=create_overridegraphicsettings_6)

# group: Override Losas
code_block_76 = CodeBlock(x=code_block_43.out1) { x; }
code_block_77 = CodeBlock(x=code_block_76) { x; }
code_block_78 = CodeBlock { "Floors"; }
byName_10 = Category.ByName(name=code_block_78)
all_elements_of_category_in_view_9 = ElementsOfCategoryInView(Category=byName_10, View=code_block_77)
name_3 = Material.Name()  # unwired: material
getMaterials_2 = Element.GetMaterials(element=all_elements_of_category_in_view_9)
flatten_6 = List.Flatten(list=getMaterials_2)
function_apply_7 = ApplyFunction(func=name_3, arg1=flatten_6)
code_block_79 = CodeBlock { "Concrete, Cast-in-Place gray"; }
eq_8 = function_apply_7 == code_block_79
filterByBoolMask_9 = List.FilterByBoolMask(list=all_elements_of_category_in_view_9, mask=eq_8)
code_block_80 = CodeBlock(x=code_block_76) { x; }
code_block_81 = CodeBlock { null; }
replaceEmptyLists_12 = Custom[List.ReplaceEmptyLists](seq=code_block_80, Replacement=code_block_81)
code_block_82 = CodeBlock(x=replaceEmptyLists_12)  # same code as code_block_9
getByName_7 = LinePatternElement.GetByName(name=code_block_82.out1)
color_palette_6 = ColorPalette({R: 0, G: 0, B: 0, A: 255})
code_block_83 = CodeBlock { 1; }
create_overridegraphicsettings_7 = Custom[Create OverrideGraphicSettings](ProjectionLinePattern=getByName_7, ProjectionLineColor=color_palette_6, ProjectionLineWeight=code_block_83, CutLinePattern=getByName_7, CutLineColor=color_palette_6, CutLineWeight=code_block_83)
view_setelementoverrides_7 = Custom[View SetElementOverrides](view=code_block_77, elements=filterByBoolMask_9.in, overrides=create_overridegraphicsettings_7)
