# Dynamo graph siguienteRevision_script.dyn (Dynamo 2.3.2.15696)
# packages: Data-Shapes 2022.2.96, Genius Loci 2021.11.10, Data-Shapes 2021.2.94, Crumple 2022.2.13, Modelical 2.2.19, archi-lab.net 2022.210.2419

select_revision_numbering = RevisionNumbering()  # nothing selected
code_block = CodeBlock { "Siguiente Revision"; }
code_block_2 = CodeBlock()
# ---------- code_block_2.designscript (13 lines) ----------
//buttonText
"INICIAR";

//cancelButton
"CANCELAR";

//maxHeight
860;

//width
600;

//labelWidth
# ----------------------------------------
code_block_3 = CodeBlock()
# ---------- code_block_3.designscript (20 lines) ----------
"Descripción";
[
"PRELIMINAR",
"PARA APROBACION",
"EMITIDO PARA APROBACION MUNICIPAL",
"MODIFICACION GENERAL",
"APROBADO PARA LICITACION",
"ACTUALIZACION APL",
"MODIFICA LO INDICADO",
"APROBADO PARA CONSTRUCCION",
"PARA MUNICIPALIDAD",
"APTO PARA LICITACION",
"PARA LICITACION",
"INGRESA UNA DESCRIPCION",
"PARA INGRESO MUNICIPAL",
"MODIFICA Y AGREGA LO INDICADO",
"INFORMATIVO"
];
0;
false;
# ----------------------------------------
dropdown_data = Custom[DropDown Data](InputName=code_block_3.out0, Keys=code_block_3.out1, Values=code_block_3.out1, DefaultValueIndex=code_block_3.out2, Sorted_optional=code_block_3.out3)  # package Data-Shapes; Create data for DropDown input in UI.MultiInputForm ++ . Check out www.data-shapes.net for more infos.
code_block_4 = CodeBlock()
# ---------- code_block_4.designscript (4 lines) ----------
"Dibujó";
["J.N.N.","P.C.C.","A.C.C.","A.S.A.","C.M.H.","C.S.R.","S.J.M.","R.P.C.","C.O.C.","M.F.S.","D.S.P.","H.C.P.","L.B.M.","Y.S.M.","X.X.X.","SELECCIONA QUIEN REALIZO LA MODIFICACION"];
true;
-1;
# ----------------------------------------
dropdown_data_2 = Custom[DropDown Data](InputName=code_block_4.out0, Keys=code_block_4.out1, Values=code_block_4.out1, DefaultValueIndex=code_block_4.out3, Sorted_optional=code_block_4.out2)
code_block_5 = CodeBlock { "Revisó"; ["N.V.G.","C.M.Q.","M.E.A","SELECCIONA QUIEN REVISO"]; true; -1; }
dropdown_data_3 = Custom[DropDown Data](InputName=code_block_5.out0, Keys=code_block_5.out1, Values=code_block_5.out1, DefaultValueIndex=code_block_5.out3, Sorted_optional=code_block_5.out2)
code_block_6 = CodeBlock { "Aprobó"; ["N.V.C.","C.M.Q.","P.A.V."]; true; -1; }
dropdown_data_4 = Custom[DropDown Data](InputName=code_block_6.out0, Keys=code_block_6.out1, Values=code_block_6.out1, DefaultValueIndex=code_block_6.out3, Sorted_optional=code_block_6.out2)
code_block_7 = CodeBlock { "Fecha"; }
now = DateTime.Now()
code_block_8 = CodeBlock { "dd.MM.yy"; }
format = DateTime.Format(dateTime=now, format=code_block_8)
code_block_9 = CodeBlock { "."; }
split = String.Split(str=format, separator0=code_block_9)
toNumber = String.ToNumber(str=split)
code_block_10 = CodeBlock { 2; }
getItemAtIndex = List.GetItemAtIndex(list=toNumber, index=code_block_10)
code_block_11 = CodeBlock { 1; }
getItemAtIndex_2 = List.GetItemAtIndex(list=toNumber, index=code_block_11)
code_block_12 = CodeBlock { 0; }
getItemAtIndex_3 = List.GetItemAtIndex(list=toNumber, index=code_block_12)
daysInMonth = DateTime.DaysInMonth(year=getItemAtIndex, month=getItemAtIndex_2)
code_block_13 = CodeBlock(ini=getItemAtIndex_3, mes=daysInMonth) { ini..mes..1; }
byDate = DateTime.ByDate(year=getItemAtIndex, month=getItemAtIndex_2, day=code_block_13)
code_block_14 = CodeBlock { "dd.MM.yy"; }
format_2 = DateTime.Format(dateTime=byDate, format=code_block_14)
code_block_15 = CodeBlock { 0; }
dropdown_data_5 = Custom[DropDown Data](InputName=code_block_7, Keys=format_2, Values=format_2, DefaultValueIndex=code_block_15)
code_block_16 = CodeBlock { "Sheets"; }
byName = Category.ByName(name=code_block_16)
all_elements_of_category = ElementsOfCategory(Category=byName)
code_block_17 = CodeBlock { "Clasificacion"; }
getParameterValueByName = Element.GetParameterValueByName(element=all_elements_of_category, parameterName=code_block_17)
code_block_18 = CodeBlock { "000"; }
ne = getParameterValueByName != code_block_18
filterByBoolMask = List.FilterByBoolMask(list=all_elements_of_category, mask=ne)
code_block_19 = CodeBlock { "Clasificacion"; }
getParameterValueByName_2 = Element.GetParameterValueByName(element=filterByBoolMask.in, parameterName=code_block_19)
groupByKey = List.GroupByKey(list=filterByBoolMask.in, keys=getParameterValueByName_2)
code_block_20 = CodeBlock(clasificacion=groupByKey.unique_keys) { "Laminas "+clasificacion; }
sheetNumber = Sheet.SheetNumber(sheet=groupByKey.groups@L2)
sheetName = Sheet.SheetName(sheet=groupByKey.groups@L2)
code_block_21 = CodeBlock(sheetNumber=sheetNumber, sheetName=sheetName) { sheetNumber+" - "+sheetName; }
code_block_22 = CodeBlock { 250; }
boolean = BoolSelector(false)
listview_data = Custom[Listview Data](InputName=code_block_20@L1, Keys=code_block_21@L2, Values=groupByKey.groups@L2, Height_optionnal=code_block_22, ShowId_optionnal=boolean)  # package Data-Shapes; Create data for ListView input in UI.MultiInputForm ++ . Check out www.data-shapes.net for more infos.
inputgroup_data = Custom[InputGroup Data](Inputs=listview_data)  # package Data-Shapes; Creates a group of inputs for UI.MultipleInputForm ++ . Check out www.data-shapes.net for more infos !
list_create = List.Create(item0=dropdown_data, item1=dropdown_data_2, item2=dropdown_data_3, item3=dropdown_data_4, item4=dropdown_data_5, item5=inputgroup_data)
boolean_2 = BoolSelector(true)
multipleinputform = Custom[MultipleInputForm ++](Description_optional=code_block, ButtonText_optional=code_block_2.out0, Inputs=list_create, Toggle=boolean_2, CancelButtonText_optional=code_block_2.out1, MaxHeight_optional=code_block_2.out2, Width_optional=code_block_2.out3)  # package Data-Shapes; Create a form with multiple inputs. see www.data-shapes.net for tutorials and infos!
code_block_23 = CodeBlock(x=multipleinputform.User_Inputs)
# ---------- code_block_23.designscript (12 lines) ----------
x;
[Imperative]
{
	if(x == null)
	{
		return = [];
	}
	else
	{
		return = x;
	}
};
# ----------------------------------------
list_clean = Custom[List Clean](list=code_block_23.out1)  # package Genius Loci; Removes all Null, Empty and Blank from a list or nested list of lists.
code_block_24 = CodeBlock { 5; }
listsplitatindex = Custom[© ListSplitAtIndex](list=list_clean, amount=code_block_24)  # package Crumple; Splits a list at a specific index, then returns the two lists. You may need to use levels in order for this to work properly.
flatten = List.Flatten(list=listsplitatindex.list2)
code_block_25 = CodeBlock { true; }
addNextRevision = Custom[Sheet.AddNextRevision](sheets=flatten, Toggle=code_block_25)  # package Modelical; Add the next revision to the selected sheets. Switch to manual run to use this node
name = Parameter.Name()  # unwired: parameter
parameters = Element.Parameters(element=addNextRevision.Sheets)
group = Parameter.Group(parameter=parameters)
code_block_26 = CodeBlock { "PG_DATA"; }
eq = group == code_block_26
filterByBoolMask_2 = List.FilterByBoolMask(list=parameters, mask=eq)
value = Parameter.Value(parameter=filterByBoolMask_2.in)
code_block_27 = CodeBlock { null; }
eq_2 = value == code_block_27
code_block_28 = CodeBlock { ""; }
eq_3 = value == code_block_28
xor = Math.Xor(a=eq_2, b=eq_3)
filterByBoolMask_3 = List.FilterByBoolMask(list=filterByBoolMask_2.in, mask=xor)
isEmpty = List.IsEmpty(list=filterByBoolMask_3.in)
code_block_29 = CodeBlock(x=isEmpty, y=filterByBoolMask_3.in)
# ---------- code_block_29.designscript (13 lines) ----------
x;
y;
res = [Imperative]
{
	if (x == false)
	{
		return = y;
	}
	else
	{
		return = null;
	}
};
# ----------------------------------------
code_block_30 = CodeBlock(x=isEmpty)
# ---------- code_block_30.designscript (13 lines) ----------
x;
lst = 1..5;
res = [Imperative]
{
	if (x == false)
	{
		return = 1..5;
	}
	else
	{
		return = [];
	}
};
# ----------------------------------------
getItemAtIndex_4 = List.GetItemAtIndex(list=code_block_29.out2@L2, index=code_block_30.out2)
function_apply = ApplyFunction(func=name, arg1=getItemAtIndex_4)
code_block_31 = CodeBlock(x=listsplitatindex.list1) { x; }
setParameterByName = Element.SetParameterByName(element=addNextRevision.Sheets@L1, parameterName=function_apply@L2, value=code_block_31@L2, lacing=Longest)
flatten_2 = List.Flatten(list=setParameterByName)
uniqueItems = List.UniqueItems(list=flatten_2)
name_2 = Parameter.Name()  # unwired: parameter
code_block_32 = CodeBlock(x=filterByBoolMask_3.in) { x; }
isEmpty_2 = List.IsEmpty(list=code_block_32)
code_block_33 = CodeBlock(x=isEmpty_2, y=code_block_32)  # same code as code_block_29
code_block_34 = CodeBlock(x=isEmpty_2)
# ---------- code_block_34.designscript (12 lines) ----------
x;
res = [Imperative]
{
	if (x == false)
	{
		return = 0;
	}
	else
	{
		return = [];
	}
};
# ----------------------------------------
getItemAtIndex_5 = List.GetItemAtIndex(list=code_block_33.out2@L2, index=code_block_34.out1)
function_apply_2 = ApplyFunction(func=name_2, arg1=getItemAtIndex_5)
end = Revit.Transaction.Transaction.End(input=addNextRevision.Sheets)
sheet_torevision = Custom[Sheet ToRevision](sheet=end)  # package Genius Loci; Returns the revision of the given sheet.
getRevisionNumberOnSheet = archilab.Revit.Views.Sheets.GetRevisionNumberOnSheet(sheet=end, revision=sheet_torevision.Revision)
string_from_object = FromObject(obj=getRevisionNumberOnSheet)
setParameterByName_2 = Element.SetParameterByName(element=uniqueItems, parameterName=function_apply_2, value=string_from_object)
