# Dynamo graph script.dyn (Dynamo 2.3.2.15696)
# packages: Rhythm 2020.7.25, Orchid 200.4.0.7938, Data-Shapes 2021.2.94

code_block = CodeBlock { "Bloquear/Desbloquear Elementos"; }
code_block_2 = CodeBlock()
# ---------- code_block_2.designscript (13 lines) ----------
//buttonText
"INICIAR";

//cancelButton
"CANCELAR";

//maxHeight
860;

//width
430;

//labelWidth
# ----------------------------------------
code_block_3 = CodeBlock()
# ---------- code_block_3.designscript (9 lines) ----------
"Categoria";
[
"Structural Columns",
"Structural Framing",
"Floors",
"Walls"
];

0;
# ----------------------------------------
radiobuttons_data = Custom[RadioButtons Data](InputName=code_block_3.out0, Keys=code_block_3.out1, Values=code_block_3.out1, DefaultValueIndex=code_block_3.out2)  # package Data-Shapes; Create radio buttons input for UI.MultipleInputForm ++ .
code_block_4 = CodeBlock { "Material"; ["Concrete, Cast-in-Place gray","Steel"]; 0; }
radiobuttons_data_2 = Custom[RadioButtons Data](InputName=code_block_4.out0, Keys=code_block_4.out1, Values=code_block_4.out1, DefaultValueIndex=code_block_4.out2)
code_block_5 = CodeBlock { "Opciones"; ["BLOQUEAR","DESBLOQUEAR"]; [true,false]; 0; }
radiobuttons_data_3 = Custom[RadioButtons Data](InputName=code_block_5.out0, Keys=code_block_5.out1, Values=code_block_5.out2, DefaultValueIndex=code_block_5.out3)
list_create = List.Create(item0=radiobuttons_data, item1=radiobuttons_data_2, item2=radiobuttons_data_3)
boolean = BoolSelector(true)
multipleinputform = Custom[MultipleInputForm ++](Description_optional=code_block, ButtonText_optional=code_block_2.out0, Inputs=list_create, Toggle=boolean, CancelButtonText_optional=code_block_2.out1, MaxHeight_optional=code_block_2.out2, Width_optional=code_block_2.out3)  # package Data-Shapes; Create a form with multiple inputs. see www.data-shapes.net for tutorials and infos!
code_block_6 = CodeBlock(x=multipleinputform.User_Inputs)
# ---------- code_block_6.designscript (12 lines) ----------
x;
[Imperative]
{
	if(x == null)
	{
		return = [[],[],[]];
	}
	else
	{
		return = x;
	}
};
# ----------------------------------------
code_block_7 = CodeBlock(x=code_block_6.out1) { x[0]; }
byName = Category.ByName(name=code_block_7)
all_elements_of_category = ElementsOfCategory(Category=byName)
name = Material.Name()  # unwired: material
getMaterials = Element.GetMaterials(element=all_elements_of_category)
function_apply = ApplyFunction(func=name, arg1=getMaterials)
code_block_8 = CodeBlock(x=code_block_6.out1) { x[1]; }
code_block_9 = CodeBlock(x=function_apply, mat=code_block_8) { x == mat; }
anyTrue = Orchid.Common.List.AnyTrue(list=code_block_9)
filterByBoolMask = List.FilterByBoolMask(list=all_elements_of_category, mask=anyTrue)
code_block_10 = CodeBlock(x=code_block_6.out1) { x[2]; }
ʳʰʸᵗʰᵐ_elements_setpinnedstatus = Rhythm.Revit.Elements.Elements.SetPinnedStatus(element=filterByBoolMask.in, status=code_block_10)
