# Dynamo graph copyFromLink_script.dyn (Dynamo 2.3.2.15696)
# packages: Data-Shapes 2022.2.96, Crumple 2021.9.24, Genius Loci 2021.11.10, spring nodes 204.1.0

code_block = CodeBlock { "Copiar desde Link"; }
code_block_2 = CodeBlock()
# ---------- code_block_2.designscript (11 lines) ----------
//buttonText
"INICIAR";

//cancelButton
"CANCELAR";

//width
430;

//labelWidth
130;
# ----------------------------------------
code_block_3 = CodeBlock { "Elementos a Copiar"; "SELECCIONAR"; }
selectlinkedelement_s_data = Custom[SelectLinkedElement(s) Data](InputName=code_block_3.out0, ButtonText=code_block_3.out1)  # package Data-Shapes; Create a button input for UI.MultipleInputForm++ that allows to select elements in à linked document. See www.data-shapes.net for more infos!
code_block_4 = CodeBlock { "Phase"; }
phases = Custom[© Phases]()  # package Crumple; Returns all phases in a document.
code_block_5 = CodeBlock { 1; }
radiobuttons_data = Custom[RadioButtons Data](InputName=code_block_4, Keys=phases.names, Values=phases.phases, DefaultValueIndex=code_block_5)  # package Data-Shapes; Create radio buttons input for UI.MultipleInputForm ++ .
list_create = List.Create(item0=selectlinkedelement_s_data, item1=radiobuttons_data)
boolean = BoolSelector(true)
multipleinputform = Custom[MultipleInputForm ++](Description_optional=code_block, ButtonText_optional=code_block_2.out0, Inputs=list_create, Toggle=boolean, CancelButtonText_optional=code_block_2.out1, Width_optional=code_block_2.out2, LabelWidth_optional=code_block_2.out3)  # package Data-Shapes; Create a form with multiple inputs. see www.data-shapes.net for tutorials and infos!
code_block_6 = CodeBlock(x=multipleinputform.User_Inputs)
# ---------- code_block_6.designscript (13 lines) ----------
x;

[Imperative]
{
	if(x == null)
	{
		return = [[],[]];
	}
	else
	{
		return = x;
	}
};
# ----------------------------------------
code_block_7 = CodeBlock { 0; }
getItemAtIndex = List.GetItemAtIndex(list=code_block_6.out1@L3, index=code_block_7)
element_tolinkinstance = Custom[Element ToLinkInstance](element=getItemAtIndex@L2)  # package Genius Loci; Returns the RevitLinkInstance in which the linked Element resides.
ꟿ_document_copyfromlinkinstance = Custom[ꟿ Document.CopyFromLinkInstance](LinkInstance=element_tolinkinstance.RevitLinkInstance@L1, element=getItemAtIndex@L1)  # package spring nodes; The node will use the total transformation of the link instance to copy the input elements into the local document.
flatten = List.Flatten(list=ꟿ_document_copyfromlinkinstance)
code_block_8 = CodeBlock { "Phase Created"; }
code_block_9 = CodeBlock { 1; }
getItemAtIndex_2 = List.GetItemAtIndex(list=code_block_6.out1@L3, index=code_block_9)
setParameterByName = Element.SetParameterByName(element=flatten, parameterName=code_block_8, value=getItemAtIndex_2, lacing=Longest)
