# Dynamo graph plantaFundacion_script.dyn (Dynamo 2.3.1.11775)
# packages: Orchid 200.4.0.7938, Crumple 2022.2.13, Genius Loci 2020.8.3, Clockwork for Dynamo 2.x 2.4.0

activeView = Orchid.RevitProject.Common.Document.ActiveView()

# group: Etiqueta Viga de Fundación
activeView_2 = Orchid.RevitProject.Common.Document.ActiveView()
code_block = CodeBlock { "Structural Framing"; }
byName = Category.ByName(name=code_block)
code_block_2 = CodeBlock(x=activeView) { x; }  # frozen
all_elements_of_category_in_view = ElementsOfCategoryInView(Category=byName, View=code_block_2)
familyName = Orchid.RevitProject.Elements.Element.FamilyName(element=all_elements_of_category_in_view)
code_block_3 = CodeBlock { "EST_M_STRUCTURAL FRAMING_VIGA FUNDACION"; }
eq = familyName == code_block_3
filterByBoolMask = List.FilterByBoolMask(list=all_elements_of_category_in_view, mask=eq)
getMaterials = Element.GetMaterials(element=filterByBoolMask.in)
code_block_4 = CodeBlock { null; }
replaceEmptyLists = Custom[List.ReplaceEmptyLists](seq=getMaterials, Replacement=code_block_4)  # package Clockwork for Dynamo 2.x; Replaces all empty lists within a given list with a substitute
code_block_5 = CodeBlock { 0; }
getItemAtIndex = List.GetItemAtIndex(list=replaceEmptyLists@L2, index=code_block_5)
code_block_6 = CodeBlock { "Steel"; }
byName_2 = Material.ByName(name=code_block_6)
code_block_7 = CodeBlock(x=getItemAtIndex, y=byName_2)
# ---------- code_block_7.designscript (14 lines) ----------
x;
y;

[Imperative]
{
	if(x[0] == null)
	{
		return = y;
	}
	else
	{
		return = x;
	}
};
# ----------------------------------------
name = Material.Name(material=code_block_7.out2)
code_block_8 = CodeBlock { "Concrete, Cast-in-Place gray"; }
eq_2 = name == code_block_8
filterByBoolMask_2 = List.FilterByBoolMask(list=filterByBoolMask.in, mask=eq_2)
element_taggedstatus = Custom[Element TaggedStatus](element=filterByBoolMask_2.in)  # package Genius Loci; Identify the tagged and untagged elements. Please note : This doesn't work with areas and spaces.
code_block_9 = CodeBlock { "EST_A_STRUCTURAL FRAMING TAG_PLANTA"; }
byName_3 = Orchid.RevitProject.Elements.Family.ByName(name=code_block_9)
code_block_10 = CodeBlock { "Tag Viga"; }
byFamilyAndName = FamilyType.ByFamilyAndName(family=byName_3, name=code_block_10)
elementcentroid = Custom[© ElementCentroid](element=element_taggedstatus.NotTagged)  # package Crumple; Returns the centroid of the element's axis-aligned bounding box.
activeView_3 = Orchid.RevitProject.Common.Document.ActiveView()
plane = Custom[View.Plane](view=activeView_3)  # package Clockwork for Dynamo 2.x; Retrieves the plane of a given view
normal = Plane.Normal(plane=plane)
byOriginNormal = Plane.ByOriginNormal(origin=elementcentroid, normal=normal)
normal_2 = Plane.Normal(plane=byOriginNormal)
location = Custom[Element.Location+](element=element_taggedstatus.NotTagged)  # package Clockwork for Dynamo 2.x; Returns the location of an element as point, curve or curve loop, along with some booleans to help filtering the results. Unlike the OOTB Element.GetLocation node, it also retunrs sketch lines of sketch-based elements like floor slabs as well as the element's rotation property.
code_block_11 = CodeBlock(x=location.curves)
# ---------- code_block_11.designscript (13 lines) ----------
x;

[Imperative]
{
	if(x == null)
	{
		return = [];
	}
	else
	{
		return = x;
	}
};
# ----------------------------------------
direction = Line.Direction(line=code_block_11.out1)
normalized = Vector.Normalized(vector=direction)
code_block_12 = CodeBlock(p=normalized) { p.X; }
code_block_13 = CodeBlock { 2; }
round = Math.Round(number=code_block_12, digits=code_block_13)
code_block_14 = CodeBlock { 0; }
lt = round < code_block_14
reverse = Vector.Reverse(vector=normalized)
scopeIf = Custom[ScopeIf+](test=lt, True=reverse, False=normalized, lacing=Shortest)  # package Clockwork for Dynamo 2.x; A (hopefully) more robust implementation of ScopeIf. Tests a single boolean and returns a value accordingly.
code_block_15 = CodeBlock { null; }
replaceEmptyLists_2 = Custom[List.ReplaceEmptyLists](seq=scopeIf, Replacement=code_block_15)
XAxis = Vector.XAxis()
code_block_16 = CodeBlock(x=replaceEmptyLists_2, y=XAxis)
# ---------- code_block_16.designscript (14 lines) ----------
x;
y;

[Imperative]
{
	if(x == null)
	{
		return = y;
	}
	else
	{
		return = x;
	}
};
# ----------------------------------------
code_block_17 = CodeBlock { -90; }
rotate = Vector.Rotate(vector=normal_2, axis=code_block_16.out2, degrees=code_block_17)
code_block_18 = CodeBlock(x=element_taggedstatus.NotTagged) { Revit.Elements.Element.GetParameterValueByName(Revit.Elements.Element.GetParameterValueByName(x,"Type"),"Width")/2; }
translate = Geometry.Translate(geometry=elementcentroid, direction=rotate, distance=code_block_18)
byElementAndLocation = Orchid.RevitProject.Annotations.Tag.ByElementAndLocation(view=activeView_2, element=element_taggedstatus.NotTagged, tagType=byFamilyAndName, location=translate)

# group: Etiqueta Radier
activeView_4 = Orchid.RevitProject.Common.Document.ActiveView()
code_block_19 = CodeBlock { "Floors"; }
byName_4 = Category.ByName(name=code_block_19)
code_block_20 = CodeBlock(x=activeView) { x; }  # frozen
all_elements_of_category_in_view_2 = ElementsOfCategoryInView(Category=byName_4, View=code_block_20)
familyName_2 = Orchid.RevitProject.Elements.Element.FamilyName(element=all_elements_of_category_in_view_2)
code_block_21 = CodeBlock { "Floor"; }
eq_3 = familyName_2 == code_block_21
filterByBoolMask_3 = List.FilterByBoolMask(list=all_elements_of_category_in_view_2, mask=eq_3)
getMaterials_2 = Element.GetMaterials(element=filterByBoolMask_3.in)
code_block_22 = CodeBlock { null; }
replaceEmptyLists_3 = Custom[List.ReplaceEmptyLists](seq=getMaterials_2, Replacement=code_block_22)
code_block_23 = CodeBlock { 0; }
getItemAtIndex_2 = List.GetItemAtIndex(list=replaceEmptyLists_3@L2, index=code_block_23)
code_block_24 = CodeBlock { "Steel"; }
byName_5 = Material.ByName(name=code_block_24)
code_block_25 = CodeBlock(x=getItemAtIndex_2, y=byName_5)  # same code as code_block_7
name_2 = Material.Name(material=code_block_25.out2)
code_block_26 = CodeBlock { "Concrete, Cast-in-Place gray"; }
eq_4 = name_2 == code_block_26
filterByBoolMask_4 = List.FilterByBoolMask(list=filterByBoolMask_3.in, mask=eq_4)
element_taggedstatus_2 = Custom[Element TaggedStatus](element=filterByBoolMask_4.in)
code_block_27 = CodeBlock { "EST_A_FLOOR TAG_PLANTA_RADIER"; }
byName_6 = Orchid.RevitProject.Elements.Family.ByName(name=code_block_27)
code_block_28 = CodeBlock { "Tope Radier y Nivel"; }
byFamilyAndName_2 = FamilyType.ByFamilyAndName(family=byName_6, name=code_block_28)
elementcentroid_2 = Custom[© ElementCentroid](element=element_taggedstatus_2.NotTagged)
byElementAndLocation_2 = Orchid.RevitProject.Annotations.Tag.ByElementAndLocation(view=activeView_4, element=element_taggedstatus_2.NotTagged, tagType=byFamilyAndName_2, location=elementcentroid_2)

activeView_5 = Orchid.RevitProject.Common.Document.ActiveView()
code_block_29 = CodeBlock { "Structural Foundations"; }
byName_7 = Category.ByName(name=code_block_29)
code_block_30 = CodeBlock(x=activeView) { x; }
all_elements_of_category_in_view_3 = ElementsOfCategoryInView(Category=byName_7, View=code_block_30)
familyName_3 = Orchid.RevitProject.Elements.Element.FamilyName(element=all_elements_of_category_in_view_3)
code_block_31 = CodeBlock { "EST_M_STRUCTURAL FOUNDATION_FUNDACION AISLADA"; }
eq_5 = familyName_3 == code_block_31
filterByBoolMask_5 = List.FilterByBoolMask(list=all_elements_of_category_in_view_3, mask=eq_5)
element_taggedstatus_3 = Custom[Element TaggedStatus](element=filterByBoolMask_5.in)
code_block_32 = CodeBlock(x=element_taggedstatus_3.NotTagged) { x; }
code_block_33 = CodeBlock { "EST_A_STRUCTURAL FOUNDATION TAG_PLANTA_TIPO FUNDACION"; }
byName_8 = Orchid.RevitProject.Elements.Family.ByName(name=code_block_33)
code_block_34 = CodeBlock { "Tipo Fundacion"; }
byFamilyAndName_3 = FamilyType.ByFamilyAndName(family=byName_8, name=code_block_34)
geometry = Element.Geometry(element=code_block_32)
flatten = List.Flatten(list=geometry)
explode = Geometry.Explode(geometry=flatten)
code_block_35 = CodeBlock { 1; }
getItemAtIndex_3 = List.GetItemAtIndex(list=explode@L2, index=code_block_35)
code_block_36 = CodeBlock { 1; }
pointAtParameter = Surface.PointAtParameter(surface=getItemAtIndex_3, v=code_block_36)
byElementAndLocation_3 = Orchid.RevitProject.Annotations.Tag.ByElementAndLocation(view=activeView_5, element=code_block_32, tagType=byFamilyAndName_3, location=pointAtParameter)
activeView_6 = Orchid.RevitProject.Common.Document.ActiveView()
code_block_37 = CodeBlock(x=element_taggedstatus_3.NotTagged) { x; }
code_block_38 = CodeBlock { "EST_A_STRUCTURAL FOUNDATION TAG_PLANTA_SELLO FUNDACION"; }
byName_9 = Orchid.RevitProject.Elements.Family.ByName(name=code_block_38)
code_block_39 = CodeBlock { "Sello Fundacion"; }
byFamilyAndName_4 = FamilyType.ByFamilyAndName(family=byName_9, name=code_block_39)
geometry_2 = Element.Geometry(element=code_block_37)
flatten_2 = List.Flatten(list=geometry_2)
explode_2 = Geometry.Explode(geometry=flatten_2)
code_block_40 = CodeBlock { 1; }
getItemAtIndex_4 = List.GetItemAtIndex(list=explode_2@L2, index=code_block_40)
code_block_41 = CodeBlock { 0.5; }
pointAtParameter_2 = Surface.PointAtParameter(surface=getItemAtIndex_4, u=code_block_41)
byElementAndLocation_4 = Orchid.RevitProject.Annotations.Tag.ByElementAndLocation(view=activeView_6, element=code_block_37, tagType=byFamilyAndName_4, location=pointAtParameter_2)
