# Dynamo graph laminasPorCategoria_script.dyn (Dynamo 2.3.1.11775)
# packages: Data-Shapes 2022.2.96, Clockwork for Dynamo 2.x 2.3.0, Clockwork for Dynamo 2.x 2.4.0, Rhythm 2020.7.25, Genius Loci 2020.8.3, Orchid 200.4.0.7938

code_block = CodeBlock { "Sheets"; }
byName = Category.ByName(name=code_block)
all_elements_of_category = ElementsOfCategory(Category=byName)
code_block_2 = CodeBlock { "INICIAR"; "CANCELAR"; 500; "Crea Multiples Laminas"; }
code_block_3 = CodeBlock { "Tipo de Formato"; }
code_block_4 = CodeBlock { "Title Blocks"; }
byName_2 = Category.ByName(name=code_block_4)
boolean = BoolSelector(true)
all_family_types_of_category = Custom[All Family Types Of Category](category=byName_2, toggle=boolean)  # package Clockwork for Dynamo 2.x; Gets all family types/symbols of a given category in the model.
name = Element.Name(element=all_family_types_of_category)
code_block_5 = CodeBlock { "EST_A_SPLASH SCREEN"; }
eq = name == code_block_5
filterByBoolMask = List.FilterByBoolMask(list=all_family_types_of_category, mask=eq)
name_2 = Element.Name(element=filterByBoolMask.out)
code_block_6 = CodeBlock { 0; }
dropdown_data = Custom[DropDown Data](InputName=code_block_3, Keys=name_2, Values=filterByBoolMask.out, DefaultValueIndex=code_block_6)  # package Data-Shapes; Create data for DropDown input in UI.MultiInputForm ++ . Check out www.data-shapes.net for more infos.
code_block_7 = CodeBlock { "Categoria de\nlas Laminas"; }
code_block_8 = CodeBlock()
# ---------- code_block_8.designscript (17 lines) ----------
[
"PG - PLANTA GENERAL",
"LO - LOSAS",
"VH - VIGAS",
"MA - MUROS",
"CH - COLUMNAS",
"RP - RAMPAS",
"MC - MONTACARGAS",
"ES - ESCALERA",
"EM - ESTRUCTURA METALICA",
"DE - DETALLE ESTANQUE",
"SK - FICHA",
"DM - DEMOLICION",
"EL - ELEVACION",
"PC - PLANO DE CARGAS",
"SELECCIONA UNA CATEGORIA"
];
# ----------------------------------------
code_block_9 = CodeBlock { " - "; }
split = String.Split(str=code_block_8, separator0=code_block_9)
code_block_10 = CodeBlock { 0; }
getItemAtIndex = List.GetItemAtIndex(list=split@L2, index=code_block_10)
code_block_11 = CodeBlock { -1; "XX"; }
replaceItemAtIndex = List.ReplaceItemAtIndex(list=getItemAtIndex, index=code_block_11.out0, item=code_block_11.out1)
code_block_12 = CodeBlock { -1; }
boolean_2 = BoolSelector(false)
dropdown_data_2 = Custom[DropDown Data](InputName=code_block_7, Keys=code_block_8, Values=replaceItemAtIndex, DefaultValueIndex=code_block_12, Sorted_optional=boolean_2)
code_block_13 = CodeBlock { "Cantidad\nde Laminas"; true; }
textbox_data = Custom[TextBox Data](InputName=code_block_13.out0, IsNumberEntry=code_block_13.out1)  # package Data-Shapes; Create Data for TextBox input in UI.MultipleInputForm ++ . Check out www.data-shapes.net for more informations
code_block_14 = CodeBlock { "Titulo Tentativo"; }
textbox_data_2 = Custom[TextBox Data](InputName=code_block_14)
code_block_15 = CodeBlock()
# ---------- code_block_15.designscript (3 lines) ----------
"Calculó";
["N. VICUÑA","C. MANRIQUEZ","M. ECHEVERRIA","F. TORELLI","A. MARTINEZ","D. TRONCOSO","J. TORELLI","F. IBARRA"];
true;
# ----------------------------------------
dropdown_data_3 = Custom[DropDown Data](InputName=code_block_15.out0, Keys=code_block_15.out1, Values=code_block_15.out1, Sorted_optional=code_block_15.out2)
code_block_16 = CodeBlock { "Revisó"; ["N. VICUÑA","C. MANRIQUEZ","P. ARANEDA"]; true; }
dropdown_data_4 = Custom[DropDown Data](InputName=code_block_16.out0, Keys=code_block_16.out1, Values=code_block_16.out1, Sorted_optional=code_block_16.out2)
code_block_17 = CodeBlock()
# ---------- code_block_17.designscript (3 lines) ----------
"Dibujó";
["J. NUÑEZ","P. CAROCA","A. SANCHEZ","A. CIFUENTES","S. JIMENEZ","H. CARRASCO","R. PEREZ","C. ORREGO","R. MUÑOZ","C. SALINAS","D. SALAZAR","M. FUENTES","L. BARRIOS","R. AGUILA"];
true;
# ----------------------------------------
dropdown_data_5 = Custom[DropDown Data](InputName=code_block_17.out0, Keys=code_block_17.out1, Values=code_block_17.out1, Sorted_optional=code_block_17.out2)
now = DateTime.Now()
components = DateTime.Components(dateTime=now)
string_from_object = FromObject(obj=components.year)
code_block_18 = CodeBlock(year=string_from_object)
# ---------- code_block_18.designscript (4 lines) ----------
"Fecha creación\nde las Laminas";
["ENERO","FEBRERO","MARZO","ABRIL","MAYO","JUNIO","JULIO","AGOSTO","SEPTIEMBRE","OCTUBRE","NOVIEMBRE","DICIEMBRE"];
["ENE. "+year,"FEB ."+year,"MAR. "+year,"ABR. "+year,"MAY ."+year,"JUN. "+year,"JUL. "+year,"AGO. "+year,"SEP. "+year,"OCT. "+year,"NOV. "+year,"DIC. "+year];
false;
# ----------------------------------------
dropdown_data_6 = Custom[DropDown Data](InputName=code_block_18.out0, Keys=code_block_18.out1, Values=code_block_18.out2, Sorted_optional=code_block_18.out3)
list_create = List.Create(item0=dropdown_data, item1=dropdown_data_2, item2=textbox_data, item3=textbox_data_2, item4=dropdown_data_3, item5=dropdown_data_4, item6=dropdown_data_5, item7=dropdown_data_6)
boolean_3 = BoolSelector(true)
multipleinputform = Custom[MultipleInputForm ++](Description_optional=code_block_2.out3, ButtonText_optional=code_block_2.out0, Inputs=list_create, Toggle=boolean_3, CancelButtonText_optional=code_block_2.out1, Width_optional=code_block_2.out2)  # package Data-Shapes; Create a form with multiple inputs. see www.data-shapes.net for tutorials and infos!
code_block_19 = CodeBlock(l=multipleinputform.User_Inputs)
# ---------- code_block_19.designscript (12 lines) ----------
l;
[Imperative]
{
	if (l == null)
		{
		return = [[],[],[],[],[],[],[]];
		}
	else
		{
		return = l;
		}
};
# ----------------------------------------
code_block_20 = CodeBlock(x=code_block_19.out1) { x; }
code_block_21 = CodeBlock(l=code_block_20) { DSCore.List.Flatten(([l[1]]),1); }
identity = Object.Identity(obj=code_block_21)
code_block_22 = CodeBlock { "Clasificacion"; }
getParameterValueByName = Element.GetParameterValueByName(element=all_elements_of_category, parameterName=code_block_22)
eq_2 = identity == getParameterValueByName  # lacing=Longest
filterByBoolMask_2 = List.FilterByBoolMask(list=all_elements_of_category, mask=eq_2)
code_block_23 = CodeBlock { null; }
replaceEmptyLists = Custom[List.ReplaceEmptyLists](seq=filterByBoolMask_2.in, Replacement=code_block_23)  # package Clockwork for Dynamo 2.x; Replaces all empty lists within a given list with a substitute
code_block_24 = CodeBlock(l=code_block_20) { l[0]; l[2]; DSCore.List.OfRepeatedItem(l[0],l[2]); }
code_block_25 = CodeBlock(l=replaceEmptyLists, y=code_block_24.out2)
# ---------- code_block_25.designscript (13 lines) ----------
l;
y;
[Imperative]
{
	if (l == null)
		{
		return = y;
		}
	else
		{
		return = [];
		}
};
# ----------------------------------------
ʳʰʸᵗʰᵐ_sheet_create = Rhythm.Revit.Elements.Sheet.Create(titleblock=code_block_25.out2)
code_block_26 = CodeBlock()
# ---------- code_block_26.designscript (9 lines) ----------
[
"Sheet Name",
"Designed By",
"Checked By",
"Drawn By",
"Sheet Issue Date",
"Approved By",
"Clasificacion"
];
# ----------------------------------------
code_block_27 = CodeBlock(l=code_block_20) { l[3..7]; l[2]; DSCore.List.Flatten([l[3..7],"P. ARANEDA",l[1]],1); }
list_clean = Custom[List Clean](list=code_block_27.out2)  # package Genius Loci; Removes all Null, Empty and Blank from a list or nested list of lists.
setParameterByName = Element.SetParameterByName(element=ʳʰʸᵗʰᵐ_sheet_create@L1, parameterName=code_block_26@L2, value=list_clean@L2, lacing=Longest)
code_block_28 = CodeBlock(lst=setParameterByName) { DSCore.List.UniqueItems(DSCore.List.Flatten(lst,1)); }
code_block_29 = CodeBlock { "Sheet Number"; }
code_block_30 = CodeBlock(l=code_block_20) { 1..l[2]..1; }
code_block_31 = CodeBlock { 3; }
withLeadingZeroes = Custom[List.WithLeadingZeroes](num=code_block_30, n=code_block_31)  # package Clockwork for Dynamo 2.x; Adds leading zeros to a sequence of numbers
code_block_32 = CodeBlock { null; }
replaceEmptyLists_2 = Custom[List.ReplaceEmptyLists](seq=withLeadingZeroes, Replacement=code_block_32)
code_block_33 = CodeBlock(l=replaceEmptyLists_2)
# ---------- code_block_33.designscript (12 lines) ----------
l;
[Imperative]
{
	if (l == null)
		{
		return = [[]];
		}
	else
		{
		return = l;
		}
};
# ----------------------------------------
setParameterByName_2 = Element.SetParameterByName(element=code_block_28, parameterName=code_block_29, value=code_block_33.out1, lacing=Longest)
code_block_34 = CodeBlock { "Sheets"; }
byName_3 = Category.ByName(name=code_block_34)
all_elements_of_category_2 = ElementsOfCategory(Category=byName_3)
code_block_35 = CodeBlock(x=code_block_19.out1) { x; }
code_block_36 = CodeBlock(l=code_block_35) { DSCore.List.Flatten(([l[1]]),1); }
identity_2 = Object.Identity(obj=code_block_36)
code_block_37 = CodeBlock { "Clasificacion"; }
getParameterValueByName_2 = Element.GetParameterValueByName(element=all_elements_of_category_2, parameterName=code_block_37)
eq_3 = identity_2 == getParameterValueByName_2  # lacing=Longest
filterByBoolMask_3 = List.FilterByBoolMask(list=all_elements_of_category_2, mask=eq_3)
isEmpty = List.IsEmpty(list=filterByBoolMask_3.in)
sheetNumber = Sheet.SheetNumber(sheet=filterByBoolMask_3.in)
code_block_38 = CodeBlock { null; }
replaceEmptyLists_3 = Custom[List.ReplaceEmptyLists](seq=sheetNumber, Replacement=code_block_38)
code_block_39 = CodeBlock(l=replaceEmptyLists_3)  # same code as code_block_33
lastItem = List.LastItem(list=code_block_39.out1)
code_block_40 = CodeBlock { "0"; ""; }
replace = Orchid.Common.String.Replace(string=lastItem, searchFor=code_block_40.out0, replaceWith=code_block_40.out1)
code_block_41 = CodeBlock(l=code_block_35, x=replace) { lst = l[2]+DSCore.String.ToNumber(x); DSCore.String.ToNumber(x)+1..lst..1; }
code_block_42 = CodeBlock { 3; }
withLeadingZeroes_2 = Custom[List.WithLeadingZeroes](num=code_block_41.out1, n=code_block_42)
count = List.Count(list=withLeadingZeroes_2)
code_block_43 = CodeBlock(l=code_block_35, x=count) { l[0]; x; DSCore.List.OfRepeatedItem(l[0],x); }
code_block_44 = CodeBlock(l=isEmpty, y=code_block_43.out2)
# ---------- code_block_44.designscript (13 lines) ----------
l;
y;
[Imperative]
{
	if (l == false)
		{
		return = y;
		}
	else
		{
		return = [];
		}
};
# ----------------------------------------
ʳʰʸᵗʰᵐ_sheet_create_2 = Rhythm.Revit.Elements.Sheet.Create(titleblock=code_block_44.out2)
code_block_45 = CodeBlock()  # same code as code_block_26
code_block_46 = CodeBlock(l=code_block_35) { l[3..7]; l[2]; DSCore.List.Flatten([l[3..7],"P. ARANEDA",l[1]],1); }
list_clean_2 = Custom[List Clean](list=code_block_46.out2)
setParameterByName_3 = Element.SetParameterByName(element=ʳʰʸᵗʰᵐ_sheet_create_2@L1, parameterName=code_block_45@L2, value=list_clean_2@L2, lacing=Longest)
code_block_47 = CodeBlock(lst=setParameterByName_3) { DSCore.List.UniqueItems(DSCore.List.Flatten(lst,1)); }
code_block_48 = CodeBlock { "Sheet Number"; }
setParameterByName_4 = Element.SetParameterByName(element=code_block_47, parameterName=code_block_48, value=withLeadingZeroes_2, lacing=Longest)
